# Grasshopper definition 001_ten_parabolas_theDominion.gh (Grasshopper 1.0.7)
# plug-ins: HAL for Grasshopper, Pufferfish

# the_Dominion_001
sessionsettings = SessionSettings()

# ----
# x-axis and y-axis
panel = Panel("5")
xy_plane = XYPlane(Origin=Point(0, 0, 0))
# The graph of a certain function ƒ with domain [-2, 2]
# and range [0, 4] is shown
# Sketch the graphs of the following functions
# and specify their domains and ranges
range = Range(Domain=panel, Steps=10)
construct_point = ConstructPoint(XCoordinate=range, YCoordinate=0, ZCoordinate=0)
construct_point_2 = ConstructPoint(XCoordinate=0, YCoordinate=range, ZCoordinate=0)
list_item = ListItem(List=construct_point, Index=0, Wrap=True)  # -> Item1, Item
list_item_2 = ListItem(List=construct_point_2, Index=0, Wrap=True)  # -> Item1, Item
construct_point_3 = ConstructPoint(XCoordinate=0, YCoordinate=0, ZCoordinate=0)
vector_2pt = Vector2Pt(PointA=list_item.Item, PointB=list_item.Item1, Unitize=False)  # -> Vector, Length
vector_2pt_2 = Vector2Pt(PointA=list_item_2.Item, PointB=list_item_2.Item1, Unitize=False)  # -> Vector, Length
negative = Negative(Value=vector_2pt.Vector)
negative_2 = Negative(Value=vector_2pt_2.Vector)
vector_display = VectorDisplay(Anchor=construct_point_3, Vector=vector_2pt.Vector)
vector_display_2 = VectorDisplay(Anchor=construct_point_3, Vector=negative)
vector_display_3 = VectorDisplay(Anchor=construct_point_3, Vector=vector_2pt_2.Vector)
vector_display_4 = VectorDisplay(Anchor=construct_point_3, Vector=negative_2)

number_slider = Slider(2, range=0..4)
# ƒ(x) , the much needed parabola node in grasshopper brought to you by the Dominion!
negative_3 = Negative(Value=number_slider)
construct_domain = ConstructDomain(DomainStart=negative_3, DomainEnd=number_slider)
range_2 = Range(Domain=construct_domain, Steps=10)
panel_2 = Panel("""    
     y = f(x)""")
expression = Expression(x=range_2, Expression="x^2")
construct_point_4 = ConstructPoint(XCoordinate=range_2, YCoordinate=expression, ZCoordinate=0)
construct_point_5 = ConstructPoint(XCoordinate=range_2, YCoordinate=0, ZCoordinate=0)
construct_point_6 = ConstructPoint(XCoordinate=0, YCoordinate=expression, ZCoordinate=0)
interpolate = Interpolate(Vertices=construct_point_4, Degree=3, Periodic=False, KnotStyle=1)  # -> Curve, Length, Domain
interpolate_2 = Interpolate(Vertices=construct_point_5, Degree=3, Periodic=False, KnotStyle=1)  # -> Curve, Length, Domain
interpolate_3 = Interpolate(Vertices=construct_point_6, Degree=3, Periodic=False, KnotStyle=1)  # -> Curve, Length, Domain
curve_middle = CurveMiddle(Curve=interpolate_2.Curve)
curve_middle_2 = CurveMiddle(Curve=interpolate_3.Curve)
end_points = EndPoints(Curve=interpolate.Curve)  # -> Start, End
end_points_2 = EndPoints(Curve=interpolate_2.Curve)  # -> Start, End
end_points_3 = EndPoints(Curve=interpolate_3.Curve)  # -> Start, End
point_on_curve = PointOnCurve(interpolate.Curve, parameter=0.814)
deconstruct = Deconstruct(Point=graft(point_on_curve))  # -> XComponent, YComponent, ZComponent
construct_point_7 = ConstructPoint(XCoordinate=0, YCoordinate=deconstruct.YComponent, ZCoordinate=0)
construct_point_8 = ConstructPoint(XCoordinate=deconstruct.XComponent, YCoordinate=0, ZCoordinate=0)
line = Line(StartPoint=construct_point_7, EndPoint=point_on_curve)
line_2 = Line(StartPoint=construct_point_8, EndPoint=point_on_curve)
line_3 = Line(StartPoint=end_points_2.Start, EndPoint=end_points.Start)
line_4 = Line(StartPoint=end_points_3.Start, EndPoint=end_points.Start)
line_5 = Line(StartPoint=end_points_2.End, EndPoint=end_points.End)
line_6 = Line(StartPoint=end_points_3.End, EndPoint=end_points.End)
offset_curve = OffsetCurve(Curve=interpolate.Curve, Plane=PlaneXY(0, 0, 0), Distance=".06", BothSides=Toggle(True), Kinks=0, CapType=1)
boundary_surfaces = BoundarySurfaces(Edges=offset_curve)
text_tag_3d = TextTag3D(Location=curve_middle_2, Text="     R(f)     ", Size=".12", Justification=1)
text_tag_3d_2 = TextTag3D(Location=curve_middle, Text="D(f)", Size=".12", Justification=7)
text_tag_3d_3 = TextTag3D(Location=point_on_curve, Text=panel_2, Size=".12", Justification=7)
text_tag_3d_4 = TextTag3D(Location=construct_point_7, Text="f(x)     ", Size=".12", Justification=6)
text_tag_3d_5 = TextTag3D(Location=construct_point_8, Text="x", Size=".12", Justification=7)

# ----
# b) ƒ(x) - B
number_slider_2 = Slider(2, range=0..4)  # disabled
A = Slider(2, range=0..4)  # disabled
C = Slider(0, range=0..10)  # disabled
B = Slider(2, range=0..10)  # disabled
negative_4 = Negative(Value=number_slider_2)  # disabled
number_slider_3 = Slider(100, range=0..100)  # disabled
construct_domain_2 = ConstructDomain(DomainStart=negative_4, DomainEnd=number_slider_2)  # disabled
range_3 = Range(Domain=construct_domain_2, Steps=number_slider_3)  # disabled
panel_3 = Panel("""    
     y = f(x)- B""")  # disabled
expression_2 = Expression(x=range_3, B=B, Expression="x^2 - B")  # disabled
panel_4 = Panel("f(x)     ")  # disabled
construct_point_9 = ConstructPoint(XCoordinate=range_3, YCoordinate=expression_2, ZCoordinate=0)  # disabled
construct_point_10 = ConstructPoint(XCoordinate=range_3, YCoordinate=0, ZCoordinate=0)  # disabled
construct_point_11 = ConstructPoint(XCoordinate=0, YCoordinate=expression_2, ZCoordinate=0)  # disabled
interpolate_4 = Interpolate(Vertices=construct_point_9, Degree=3, Periodic=False, KnotStyle=1)  # -> Curve, Length, Domain; disabled
interpolate_5 = Interpolate(Vertices=construct_point_10, Degree=3, Periodic=False, KnotStyle=1)  # -> Curve, Length, Domain; disabled
interpolate_6 = Interpolate(Vertices=construct_point_11, Degree=3, Periodic=False, KnotStyle=1)  # -> Curve, Length, Domain; disabled
curve_middle_3 = CurveMiddle(Curve=interpolate_5.Curve)  # disabled
curve_middle_4 = CurveMiddle(Curve=interpolate_6.Curve)  # disabled
end_points_4 = EndPoints(Curve=interpolate_4.Curve)  # -> Start, End; disabled
end_points_5 = EndPoints(Curve=interpolate_5.Curve)  # -> Start, End; disabled
end_points_6 = EndPoints(Curve=interpolate_6.Curve)  # -> Start, End; disabled
point_on_curve_2 = PointOnCurve(interpolate_4.Curve, parameter=0.814)  # disabled
deconstruct_2 = Deconstruct(Point=graft(point_on_curve_2))  # -> XComponent, YComponent, ZComponent; disabled
construct_point_12 = ConstructPoint(XCoordinate=0, YCoordinate=deconstruct_2.YComponent, ZCoordinate=0)  # disabled
construct_point_13 = ConstructPoint(XCoordinate=deconstruct_2.XComponent, YCoordinate=0, ZCoordinate=0)  # disabled
panel_5 = Panel(".12")  # disabled
boolean_toggle = BooleanToggle(True)  # disabled
line_7 = Line(StartPoint=construct_point_12, EndPoint=point_on_curve_2)  # disabled
line_8 = Line(StartPoint=construct_point_13, EndPoint=point_on_curve_2)  # disabled
line_9 = Line(StartPoint=end_points_5.Start, EndPoint=end_points_4.Start)  # disabled
line_10 = Line(StartPoint=end_points_6.Start, EndPoint=end_points_4.Start)  # disabled
line_11 = Line(StartPoint=end_points_5.End, EndPoint=end_points_4.End)  # disabled
line_12 = Line(StartPoint=end_points_6.End, EndPoint=end_points_4.End)  # disabled
panel_6 = Panel(".06")  # disabled
panel_7 = Panel("     R(f)     ")  # disabled
panel_8 = Panel("D(f)")  # disabled
panel_9 = Panel("x")  # disabled
offset_curve_2 = OffsetCurve(Curve=interpolate_4.Curve, Plane=PlaneXY(0, 0, 0), Distance=panel_6, BothSides=boolean_toggle, Kinks=0, CapType=1)  # disabled
boundary_surfaces_2 = BoundarySurfaces(Edges=offset_curve_2)  # disabled
text_tag_3d_6 = TextTag3D(Location=curve_middle_4, Text=panel_7, Size=panel_5, Justification=1)  # disabled
text_tag_3d_7 = TextTag3D(Location=curve_middle_3, Text=panel_8, Size=panel_5, Justification=7)  # disabled
text_tag_3d_8 = TextTag3D(Location=point_on_curve_2, Text=panel_3, Size=panel_5, Justification=7)  # disabled
text_tag_3d_9 = TextTag3D(Location=construct_point_12, Text=panel_4, Size=panel_5, Justification=6)  # disabled
text_tag_3d_10 = TextTag3D(Location=construct_point_13, Text=panel_9, Size=panel_5, Justification=7)  # disabled

# ----
# a) ƒ(x) + B
number_slider_4 = Slider(2, range=0..4)  # disabled
A_2 = Slider(2, range=0..4)  # disabled
C_2 = Slider(0, range=0..10)  # disabled
B_2 = Slider(2, range=0..10)  # disabled
negative_5 = Negative(Value=number_slider_4)  # disabled
construct_domain_3 = ConstructDomain(DomainStart=negative_5, DomainEnd=number_slider_4)  # disabled
range_4 = Range(Domain=construct_domain_3, Steps=Slider(100, range=0..100))  # disabled
panel_10 = Panel("""    
     y = f(x)+ 2""")  # disabled
expression_3 = Expression(x=range_4, B=B_2, Expression="x^2 + B")  # disabled
panel_11 = Panel("f(x)     ")  # disabled
construct_point_14 = ConstructPoint(XCoordinate=range_4, YCoordinate=expression_3, ZCoordinate=0)  # disabled
construct_point_15 = ConstructPoint(XCoordinate=range_4, YCoordinate=0, ZCoordinate=0)  # disabled
construct_point_16 = ConstructPoint(XCoordinate=0, YCoordinate=expression_3, ZCoordinate=0)  # disabled
interpolate_7 = Interpolate(Vertices=construct_point_14, Degree=3, Periodic=False, KnotStyle=1)  # -> Curve, Length, Domain; disabled
interpolate_8 = Interpolate(Vertices=construct_point_15, Degree=3, Periodic=False, KnotStyle=1)  # -> Curve, Length, Domain; disabled
interpolate_9 = Interpolate(Vertices=construct_point_16, Degree=3, Periodic=False, KnotStyle=1)  # -> Curve, Length, Domain; disabled
curve_middle_5 = CurveMiddle(Curve=interpolate_8.Curve)  # disabled
curve_middle_6 = CurveMiddle(Curve=interpolate_9.Curve)  # disabled
end_points_7 = EndPoints(Curve=interpolate_7.Curve)  # -> Start, End; disabled
end_points_8 = EndPoints(Curve=interpolate_8.Curve)  # -> Start, End; disabled
end_points_9 = EndPoints(Curve=interpolate_9.Curve)  # -> Start, End; disabled
point_on_curve_3 = PointOnCurve(interpolate_7.Curve, parameter=0.814)  # disabled
deconstruct_3 = Deconstruct(Point=graft(point_on_curve_3))  # -> XComponent, YComponent, ZComponent; disabled
construct_point_17 = ConstructPoint(XCoordinate=0, YCoordinate=deconstruct_3.YComponent, ZCoordinate=0)  # disabled
construct_point_18 = ConstructPoint(XCoordinate=deconstruct_3.XComponent, YCoordinate=0, ZCoordinate=0)  # disabled
panel_12 = Panel(".12")  # disabled
boolean_toggle_2 = BooleanToggle(True)  # disabled
line_13 = Line(StartPoint=construct_point_17, EndPoint=point_on_curve_3)  # disabled
line_14 = Line(StartPoint=construct_point_18, EndPoint=point_on_curve_3)  # disabled
line_15 = Line(StartPoint=end_points_8.Start, EndPoint=end_points_7.Start)  # disabled
line_16 = Line(StartPoint=end_points_9.Start, EndPoint=end_points_7.Start)  # disabled
line_17 = Line(StartPoint=end_points_8.End, EndPoint=end_points_7.End)  # disabled
line_18 = Line(StartPoint=end_points_9.End, EndPoint=end_points_7.End)  # disabled
panel_13 = Panel(".06")  # disabled
panel_14 = Panel("     R(f)     ")  # disabled
panel_15 = Panel("D(f)")  # disabled
panel_16 = Panel("x")  # disabled
offset_curve_3 = OffsetCurve(Curve=interpolate_7.Curve, Plane=PlaneXY(0, 0, 0), Distance=panel_13, BothSides=boolean_toggle_2, Kinks=0, CapType=1)  # disabled
boundary_surfaces_3 = BoundarySurfaces(Edges=offset_curve_3)  # disabled
text_tag_3d_11 = TextTag3D(Location=curve_middle_6, Text=panel_14, Size=panel_12, Justification=1)  # disabled
text_tag_3d_12 = TextTag3D(Location=curve_middle_5, Text=panel_15, Size=panel_12, Justification=7)  # disabled
text_tag_3d_13 = TextTag3D(Location=point_on_curve_3, Text=panel_10, Size=panel_12, Justification=7)  # disabled
text_tag_3d_14 = TextTag3D(Location=construct_point_17, Text=panel_11, Size=panel_12, Justification=6)  # disabled
text_tag_3d_15 = TextTag3D(Location=construct_point_18, Text=panel_16, Size=panel_12, Justification=7)  # disabled

# ----
# d) -ƒ(x)
number_slider_5 = Slider(2, range=0..4)  # disabled
A_3 = Slider(2, range=0..4)  # disabled
C_3 = Slider(0, range=0..10)  # disabled
B_3 = Slider(2, range=0..10)  # disabled
negative_6 = Negative(Value=number_slider_5)  # disabled
number_slider_6 = Slider(100, range=0..100)  # disabled
construct_domain_4 = ConstructDomain(DomainStart=negative_6, DomainEnd=number_slider_5)  # disabled
range_5 = Range(Domain=construct_domain_4, Steps=number_slider_6)  # disabled
panel_17 = Panel("""    
     y = -f(x)""")  # disabled
expression_4 = Expression(x=range_5, B=B_3, Expression="-1 * x^2")  # disabled
panel_18 = Panel("f(x)     ")  # disabled
construct_point_19 = ConstructPoint(XCoordinate=range_5, YCoordinate=expression_4, ZCoordinate=0)  # disabled
construct_point_20 = ConstructPoint(XCoordinate=range_5, YCoordinate=0, ZCoordinate=0)  # disabled
construct_point_21 = ConstructPoint(XCoordinate=0, YCoordinate=expression_4, ZCoordinate=0)  # disabled
interpolate_10 = Interpolate(Vertices=construct_point_19, Degree=3, Periodic=False, KnotStyle=1)  # -> Curve, Length, Domain; disabled
interpolate_11 = Interpolate(Vertices=construct_point_20, Degree=3, Periodic=False, KnotStyle=1)  # -> Curve, Length, Domain; disabled
interpolate_12 = Interpolate(Vertices=construct_point_21, Degree=3, Periodic=False, KnotStyle=1)  # -> Curve, Length, Domain; disabled
curve_middle_7 = CurveMiddle(Curve=interpolate_11.Curve)  # disabled
curve_middle_8 = CurveMiddle(Curve=interpolate_12.Curve)  # disabled
end_points_10 = EndPoints(Curve=interpolate_10.Curve)  # -> Start, End; disabled
end_points_11 = EndPoints(Curve=interpolate_11.Curve)  # -> Start, End; disabled
end_points_12 = EndPoints(Curve=interpolate_12.Curve)  # -> Start, End; disabled
point_on_curve_4 = PointOnCurve(interpolate_10.Curve, parameter=0.814)  # disabled
deconstruct_4 = Deconstruct(Point=graft(point_on_curve_4))  # -> XComponent, YComponent, ZComponent; disabled
construct_point_22 = ConstructPoint(XCoordinate=0, YCoordinate=deconstruct_4.YComponent, ZCoordinate=0)  # disabled
construct_point_23 = ConstructPoint(XCoordinate=deconstruct_4.XComponent, YCoordinate=0, ZCoordinate=0)  # disabled
panel_19 = Panel(".12")  # disabled
boolean_toggle_3 = BooleanToggle(True)  # disabled
line_19 = Line(StartPoint=construct_point_22, EndPoint=point_on_curve_4)  # disabled
line_20 = Line(StartPoint=construct_point_23, EndPoint=point_on_curve_4)  # disabled
line_21 = Line(StartPoint=end_points_11.Start, EndPoint=end_points_10.Start)  # disabled
line_22 = Line(StartPoint=end_points_12.Start, EndPoint=end_points_10.Start)  # disabled
line_23 = Line(StartPoint=end_points_11.End, EndPoint=end_points_10.End)  # disabled
line_24 = Line(StartPoint=end_points_12.End, EndPoint=end_points_10.End)  # disabled
panel_20 = Panel(".06")  # disabled
panel_21 = Panel("     R(f)     ")  # disabled
panel_22 = Panel("D(f)")  # disabled
panel_23 = Panel("x")  # disabled
offset_curve_4 = OffsetCurve(Curve=interpolate_10.Curve, Plane=PlaneXY(0, 0, 0), Distance=panel_20, BothSides=boolean_toggle_3, Kinks=0, CapType=1)  # disabled
boundary_surfaces_4 = BoundarySurfaces(Edges=offset_curve_4)  # disabled
text_tag_3d_16 = TextTag3D(Location=curve_middle_8, Text=panel_21, Size=panel_19, Justification=1)  # disabled
text_tag_3d_17 = TextTag3D(Location=curve_middle_7, Text=panel_22, Size=panel_19, Justification=7)  # disabled
text_tag_3d_18 = TextTag3D(Location=point_on_curve_4, Text=panel_17, Size=panel_19, Justification=7)  # disabled
text_tag_3d_19 = TextTag3D(Location=construct_point_22, Text=panel_18, Size=panel_19, Justification=6)  # disabled
text_tag_3d_20 = TextTag3D(Location=construct_point_23, Text=panel_23, Size=panel_19, Justification=7)  # disabled

# ----
# c) Aƒ(x)
number_slider_7 = Slider(2, range=0..4)  # disabled
A_4 = Slider(2, range=0..4)  # disabled
C_4 = Slider(0, range=0..10)  # disabled
B_4 = Slider(2, range=0..10)  # disabled
negative_7 = Negative(Value=number_slider_7)  # disabled
construct_domain_5 = ConstructDomain(DomainStart=negative_7, DomainEnd=number_slider_7)  # disabled
range_6 = Range(Domain=construct_domain_5, Steps=Slider(100, range=0..100))  # disabled
panel_24 = Panel("""    
     y = A * ƒ(x)""")  # disabled
expression_5 = Expression(x=range_6, A=A_4, Expression="A *(x^2)")  # disabled
panel_25 = Panel("f(x)     ")  # disabled
construct_point_24 = ConstructPoint(XCoordinate=range_6, YCoordinate=expression_5, ZCoordinate=0)  # disabled
construct_point_25 = ConstructPoint(XCoordinate=range_6, YCoordinate=0, ZCoordinate=0)  # disabled
construct_point_26 = ConstructPoint(XCoordinate=0, YCoordinate=expression_5, ZCoordinate=0)  # disabled
interpolate_13 = Interpolate(Vertices=construct_point_24, Degree=3, Periodic=False, KnotStyle=1)  # -> Curve, Length, Domain; disabled
interpolate_14 = Interpolate(Vertices=construct_point_25, Degree=3, Periodic=False, KnotStyle=1)  # -> Curve, Length, Domain; disabled
interpolate_15 = Interpolate(Vertices=construct_point_26, Degree=3, Periodic=False, KnotStyle=1)  # -> Curve, Length, Domain; disabled
curve_middle_9 = CurveMiddle(Curve=interpolate_14.Curve)  # disabled
curve_middle_10 = CurveMiddle(Curve=interpolate_15.Curve)  # disabled
end_points_13 = EndPoints(Curve=interpolate_13.Curve)  # -> Start, End; disabled
end_points_14 = EndPoints(Curve=interpolate_14.Curve)  # -> Start, End; disabled
end_points_15 = EndPoints(Curve=interpolate_15.Curve)  # -> Start, End; disabled
point_on_curve_5 = PointOnCurve(interpolate_13.Curve, parameter=0.814)  # disabled
deconstruct_5 = Deconstruct(Point=graft(point_on_curve_5))  # -> XComponent, YComponent, ZComponent; disabled
construct_point_27 = ConstructPoint(XCoordinate=0, YCoordinate=deconstruct_5.YComponent, ZCoordinate=0)  # disabled
construct_point_28 = ConstructPoint(XCoordinate=deconstruct_5.XComponent, YCoordinate=0, ZCoordinate=0)  # disabled
panel_26 = Panel(".12")  # disabled
boolean_toggle_4 = BooleanToggle(True)  # disabled
line_25 = Line(StartPoint=construct_point_27, EndPoint=point_on_curve_5)  # disabled
line_26 = Line(StartPoint=construct_point_28, EndPoint=point_on_curve_5)  # disabled
line_27 = Line(StartPoint=end_points_14.Start, EndPoint=end_points_13.Start)  # disabled
line_28 = Line(StartPoint=end_points_15.Start, EndPoint=end_points_13.Start)  # disabled
line_29 = Line(StartPoint=end_points_14.End, EndPoint=end_points_13.End)  # disabled
line_30 = Line(StartPoint=end_points_15.End, EndPoint=end_points_13.End)  # disabled
panel_27 = Panel(".06")  # disabled
panel_28 = Panel("     R(f)     ")  # disabled
panel_29 = Panel("D(f)")  # disabled
panel_30 = Panel("x")  # disabled
offset_curve_5 = OffsetCurve(Curve=interpolate_13.Curve, Plane=PlaneXY(0, 0, 0), Distance=panel_27, BothSides=boolean_toggle_4, Kinks=0, CapType=1)  # disabled
boundary_surfaces_5 = BoundarySurfaces(Edges=offset_curve_5)  # disabled
text_tag_3d_21 = TextTag3D(Location=curve_middle_10, Text=panel_28, Size=panel_26, Justification=1)  # disabled
text_tag_3d_22 = TextTag3D(Location=curve_middle_9, Text=panel_29, Size=panel_26, Justification=7)  # disabled
text_tag_3d_23 = TextTag3D(Location=point_on_curve_5, Text=panel_24, Size=panel_26, Justification=7)  # disabled
text_tag_3d_24 = TextTag3D(Location=construct_point_27, Text=panel_25, Size=panel_26, Justification=6)  # disabled
text_tag_3d_25 = TextTag3D(Location=construct_point_28, Text=panel_30, Size=panel_26, Justification=7)  # disabled

# ----
# f) ƒ(x - B)
number_slider_8 = Slider(4, range=0..4)  # disabled
A_5 = Slider(2, range=0..4)  # disabled
C_5 = Slider(0, range=0..10)  # disabled
B_5 = Slider(2, range=0..10)  # disabled
negative_8 = Negative(Value=number_slider_8)  # disabled
number_slider_9 = Slider(100, range=0..100)  # disabled
construct_domain_6 = ConstructDomain(DomainStart=negative_8, DomainEnd=number_slider_8)  # disabled
range_7 = Range(Domain=construct_domain_6, Steps=number_slider_9)  # disabled
panel_31 = Panel("""    
     y = f(x - B)""")  # disabled
expression_6 = Expression(x=range_7, B=B_5, Expression="(x - B)^2")  # disabled
panel_32 = Panel("f(x)     ")  # disabled
construct_point_29 = ConstructPoint(XCoordinate=range_7, YCoordinate=expression_6, ZCoordinate=0)  # disabled
construct_point_30 = ConstructPoint(XCoordinate=range_7, YCoordinate=0, ZCoordinate=0)  # disabled
construct_point_31 = ConstructPoint(XCoordinate=0, YCoordinate=expression_6, ZCoordinate=0)  # disabled
interpolate_16 = Interpolate(Vertices=construct_point_29, Degree=3, Periodic=False, KnotStyle=1)  # -> Curve, Length, Domain; disabled
interpolate_17 = Interpolate(Vertices=construct_point_30, Degree=3, Periodic=False, KnotStyle=1)  # -> Curve, Length, Domain; disabled
interpolate_18 = Interpolate(Vertices=construct_point_31, Degree=3, Periodic=False, KnotStyle=1)  # -> Curve, Length, Domain; disabled
curve_middle_11 = CurveMiddle(Curve=interpolate_17.Curve)  # disabled
curve_middle_12 = CurveMiddle(Curve=interpolate_18.Curve)  # disabled
end_points_16 = EndPoints(Curve=interpolate_16.Curve)  # -> Start, End; disabled
end_points_17 = EndPoints(Curve=interpolate_17.Curve)  # -> Start, End; disabled
end_points_18 = EndPoints(Curve=interpolate_18.Curve)  # -> Start, End; disabled
point_on_curve_6 = PointOnCurve(interpolate_16.Curve, parameter=0.966)  # disabled
deconstruct_6 = Deconstruct(Point=graft(point_on_curve_6))  # -> XComponent, YComponent, ZComponent; disabled
construct_point_32 = ConstructPoint(XCoordinate=0, YCoordinate=deconstruct_6.YComponent, ZCoordinate=0)  # disabled
construct_point_33 = ConstructPoint(XCoordinate=deconstruct_6.XComponent, YCoordinate=0, ZCoordinate=0)  # disabled
panel_33 = Panel(".12")  # disabled
boolean_toggle_5 = BooleanToggle(True)  # disabled
line_31 = Line(StartPoint=construct_point_32, EndPoint=point_on_curve_6)  # disabled
line_32 = Line(StartPoint=construct_point_33, EndPoint=point_on_curve_6)  # disabled
line_33 = Line(StartPoint=end_points_17.Start, EndPoint=end_points_16.Start)  # disabled
line_34 = Line(StartPoint=end_points_18.Start, EndPoint=end_points_16.Start)  # disabled
line_35 = Line(StartPoint=end_points_17.End, EndPoint=end_points_16.End)  # disabled
line_36 = Line(StartPoint=end_points_18.End, EndPoint=end_points_16.End)  # disabled
panel_34 = Panel(".06")  # disabled
panel_35 = Panel("     R(f)     ")  # disabled
panel_36 = Panel("D(f)")  # disabled
panel_37 = Panel("x")  # disabled
offset_curve_6 = OffsetCurve(Curve=interpolate_16.Curve, Plane=PlaneXY(0, 0, 0), Distance=panel_34, BothSides=boolean_toggle_5, Kinks=0, CapType=1)  # disabled
boundary_surfaces_6 = BoundarySurfaces(Edges=offset_curve_6)  # disabled
text_tag_3d_26 = TextTag3D(Location=curve_middle_12, Text=panel_35, Size=panel_33, Justification=1)  # disabled
text_tag_3d_27 = TextTag3D(Location=curve_middle_11, Text=panel_36, Size=panel_33, Justification=7)  # disabled
text_tag_3d_28 = TextTag3D(Location=point_on_curve_6, Text=panel_31, Size=panel_33, Justification=7)  # disabled
text_tag_3d_29 = TextTag3D(Location=construct_point_32, Text=panel_32, Size=panel_33, Justification=6)  # disabled
text_tag_3d_30 = TextTag3D(Location=construct_point_33, Text=panel_37, Size=panel_33, Justification=7)  # disabled

# ----
# e) ƒ(x + B)
number_slider_10 = Slider(4, range=0..4)  # disabled
A_6 = Slider(2, range=0..4)  # disabled
C_6 = Slider(0, range=0..10)  # disabled
B_6 = Slider(2, range=0..10)  # disabled
negative_9 = Negative(Value=number_slider_10)  # disabled
number_slider_11 = Slider(100, range=0..100)  # disabled
construct_domain_7 = ConstructDomain(DomainStart=negative_9, DomainEnd=number_slider_10)  # disabled
range_8 = Range(Domain=construct_domain_7, Steps=number_slider_11)  # disabled
panel_38 = Panel("""    
     y = ƒ(x + B)""")  # disabled
expression_7 = Expression(x=range_8, B=B_6, Expression="(x + B)^2")  # disabled
panel_39 = Panel("f(x)     ")  # disabled
construct_point_34 = ConstructPoint(XCoordinate=range_8, YCoordinate=expression_7, ZCoordinate=0)  # disabled
construct_point_35 = ConstructPoint(XCoordinate=range_8, YCoordinate=0, ZCoordinate=0)  # disabled
construct_point_36 = ConstructPoint(XCoordinate=0, YCoordinate=expression_7, ZCoordinate=0)  # disabled
interpolate_19 = Interpolate(Vertices=construct_point_34, Degree=3, Periodic=False, KnotStyle=1)  # -> Curve, Length, Domain; disabled
interpolate_20 = Interpolate(Vertices=construct_point_35, Degree=3, Periodic=False, KnotStyle=1)  # -> Curve, Length, Domain; disabled
interpolate_21 = Interpolate(Vertices=construct_point_36, Degree=3, Periodic=False, KnotStyle=1)  # -> Curve, Length, Domain; disabled
curve_middle_13 = CurveMiddle(Curve=interpolate_20.Curve)  # disabled
curve_middle_14 = CurveMiddle(Curve=interpolate_21.Curve)  # disabled
end_points_19 = EndPoints(Curve=interpolate_19.Curve)  # -> Start, End; disabled
end_points_20 = EndPoints(Curve=interpolate_20.Curve)  # -> Start, End; disabled
end_points_21 = EndPoints(Curve=interpolate_21.Curve)  # -> Start, End; disabled
point_on_curve_7 = PointOnCurve(interpolate_19.Curve, parameter=0.814)  # disabled
deconstruct_7 = Deconstruct(Point=graft(point_on_curve_7))  # -> XComponent, YComponent, ZComponent; disabled
construct_point_37 = ConstructPoint(XCoordinate=0, YCoordinate=deconstruct_7.YComponent, ZCoordinate=0)  # disabled
construct_point_38 = ConstructPoint(XCoordinate=deconstruct_7.XComponent, YCoordinate=0, ZCoordinate=0)  # disabled
panel_40 = Panel(".12")  # disabled
boolean_toggle_6 = BooleanToggle(True)  # disabled
line_37 = Line(StartPoint=construct_point_37, EndPoint=point_on_curve_7)  # disabled
line_38 = Line(StartPoint=construct_point_38, EndPoint=point_on_curve_7)  # disabled
line_39 = Line(StartPoint=end_points_20.Start, EndPoint=end_points_19.Start)  # disabled
line_40 = Line(StartPoint=end_points_21.Start, EndPoint=end_points_19.Start)  # disabled
line_41 = Line(StartPoint=end_points_20.End, EndPoint=end_points_19.End)  # disabled
line_42 = Line(StartPoint=end_points_21.End, EndPoint=end_points_19.End)  # disabled
panel_41 = Panel(".06")  # disabled
panel_42 = Panel("     R(f)     ")  # disabled
panel_43 = Panel("D(f)")  # disabled
panel_44 = Panel("x")  # disabled
offset_curve_7 = OffsetCurve(Curve=interpolate_19.Curve, Plane=PlaneXY(0, 0, 0), Distance=panel_41, BothSides=boolean_toggle_6, Kinks=0, CapType=1)  # disabled
boundary_surfaces_7 = BoundarySurfaces(Edges=offset_curve_7)  # disabled
text_tag_3d_31 = TextTag3D(Location=curve_middle_14, Text=panel_42, Size=panel_40, Justification=1)  # disabled
text_tag_3d_32 = TextTag3D(Location=curve_middle_13, Text=panel_43, Size=panel_40, Justification=7)  # disabled
text_tag_3d_33 = TextTag3D(Location=point_on_curve_7, Text=panel_38, Size=panel_40, Justification=7)  # disabled
text_tag_3d_34 = TextTag3D(Location=construct_point_37, Text=panel_39, Size=panel_40, Justification=6)  # disabled
text_tag_3d_35 = TextTag3D(Location=construct_point_38, Text=panel_44, Size=panel_40, Justification=7)  # disabled

# ----
# h) ƒ(-x)
number_slider_12 = Slider(2, range=0..4)  # disabled
A_7 = Slider(2, range=0..4)  # disabled
C_7 = Slider(0, range=0..10)  # disabled
B_7 = Slider(2, range=0..10)  # disabled
negative_10 = Negative(Value=number_slider_12)  # disabled
number_slider_13 = Slider(100, range=0..100)  # disabled
construct_domain_8 = ConstructDomain(DomainStart=negative_10, DomainEnd=number_slider_12)  # disabled
range_9 = Range(Domain=construct_domain_8, Steps=number_slider_13)  # disabled
panel_45 = Panel("""    
     y = f(-x)""")  # disabled
expression_8 = Expression(x=range_9, B=B_7, Expression="(-1 * x)^2 ")  # disabled
panel_46 = Panel("f(x)     ")  # disabled
construct_point_39 = ConstructPoint(XCoordinate=range_9, YCoordinate=expression_8, ZCoordinate=0)  # disabled
construct_point_40 = ConstructPoint(XCoordinate=range_9, YCoordinate=0, ZCoordinate=0)  # disabled
construct_point_41 = ConstructPoint(XCoordinate=0, YCoordinate=expression_8, ZCoordinate=0)  # disabled
interpolate_22 = Interpolate(Vertices=construct_point_39, Degree=3, Periodic=False, KnotStyle=1)  # -> Curve, Length, Domain; disabled
interpolate_23 = Interpolate(Vertices=construct_point_40, Degree=3, Periodic=False, KnotStyle=1)  # -> Curve, Length, Domain; disabled
interpolate_24 = Interpolate(Vertices=construct_point_41, Degree=3, Periodic=False, KnotStyle=1)  # -> Curve, Length, Domain; disabled
curve_middle_15 = CurveMiddle(Curve=interpolate_23.Curve)  # disabled
curve_middle_16 = CurveMiddle(Curve=interpolate_24.Curve)  # disabled
end_points_22 = EndPoints(Curve=interpolate_22.Curve)  # -> Start, End; disabled
end_points_23 = EndPoints(Curve=interpolate_23.Curve)  # -> Start, End; disabled
end_points_24 = EndPoints(Curve=interpolate_24.Curve)  # -> Start, End; disabled
point_on_curve_8 = PointOnCurve(interpolate_22.Curve, parameter=0.966)  # disabled
deconstruct_8 = Deconstruct(Point=graft(point_on_curve_8))  # -> XComponent, YComponent, ZComponent; disabled
construct_point_42 = ConstructPoint(XCoordinate=0, YCoordinate=deconstruct_8.YComponent, ZCoordinate=0)  # disabled
construct_point_43 = ConstructPoint(XCoordinate=deconstruct_8.XComponent, YCoordinate=0, ZCoordinate=0)  # disabled
panel_47 = Panel(".12")  # disabled
boolean_toggle_7 = BooleanToggle(True)  # disabled
line_43 = Line(StartPoint=construct_point_42, EndPoint=point_on_curve_8)  # disabled
line_44 = Line(StartPoint=construct_point_43, EndPoint=point_on_curve_8)  # disabled
line_45 = Line(StartPoint=end_points_23.Start, EndPoint=end_points_22.Start)  # disabled
line_46 = Line(StartPoint=end_points_24.Start, EndPoint=end_points_22.Start)  # disabled
line_47 = Line(StartPoint=end_points_23.End, EndPoint=end_points_22.End)  # disabled
line_48 = Line(StartPoint=end_points_24.End, EndPoint=end_points_22.End)  # disabled
panel_48 = Panel(".06")  # disabled
panel_49 = Panel("     R(f)     ")  # disabled
panel_50 = Panel("D(f)")  # disabled
panel_51 = Panel("x")  # disabled
offset_curve_8 = OffsetCurve(Curve=interpolate_22.Curve, Plane=PlaneXY(0, 0, 0), Distance=panel_48, BothSides=boolean_toggle_7, Kinks=0, CapType=1)  # disabled
boundary_surfaces_8 = BoundarySurfaces(Edges=offset_curve_8)  # disabled
text_tag_3d_36 = TextTag3D(Location=curve_middle_16, Text=panel_49, Size=panel_47, Justification=1)  # disabled
text_tag_3d_37 = TextTag3D(Location=curve_middle_15, Text=panel_50, Size=panel_47, Justification=7)  # disabled
text_tag_3d_38 = TextTag3D(Location=point_on_curve_8, Text=panel_45, Size=panel_47, Justification=7)  # disabled
text_tag_3d_39 = TextTag3D(Location=construct_point_42, Text=panel_46, Size=panel_47, Justification=6)  # disabled
text_tag_3d_40 = TextTag3D(Location=construct_point_43, Text=panel_51, Size=panel_47, Justification=7)  # disabled

# ----
# g) ƒ(Ax)
number_slider_14 = Slider(4, range=0..4)  # disabled
A_8 = Slider(2, range=0..4)  # disabled
C_8 = Slider(0, range=0..10)  # disabled
B_8 = Slider(2, range=0..10)  # disabled
negative_11 = Negative(Value=number_slider_14)  # disabled
number_slider_15 = Slider(100, range=0..100)  # disabled
construct_domain_9 = ConstructDomain(DomainStart=negative_11, DomainEnd=number_slider_14)  # disabled
range_10 = Range(Domain=construct_domain_9, Steps=number_slider_15)  # disabled
panel_52 = Panel("""    
     y = ƒ(Ax)""")  # disabled
expression_9 = Expression(x=range_10, A=A_8, Expression="(A * x)^2")  # disabled
panel_53 = Panel("f(x)     ")  # disabled
construct_point_44 = ConstructPoint(XCoordinate=range_10, YCoordinate=expression_9, ZCoordinate=0)  # disabled
construct_point_45 = ConstructPoint(XCoordinate=range_10, YCoordinate=0, ZCoordinate=0)  # disabled
construct_point_46 = ConstructPoint(XCoordinate=0, YCoordinate=expression_9, ZCoordinate=0)  # disabled
interpolate_25 = Interpolate(Vertices=construct_point_44, Degree=3, Periodic=False, KnotStyle=1)  # -> Curve, Length, Domain; disabled
interpolate_26 = Interpolate(Vertices=construct_point_45, Degree=3, Periodic=False, KnotStyle=1)  # -> Curve, Length, Domain; disabled
interpolate_27 = Interpolate(Vertices=construct_point_46, Degree=3, Periodic=False, KnotStyle=1)  # -> Curve, Length, Domain; disabled
curve_middle_17 = CurveMiddle(Curve=interpolate_26.Curve)  # disabled
curve_middle_18 = CurveMiddle(Curve=interpolate_27.Curve)  # disabled
end_points_25 = EndPoints(Curve=interpolate_25.Curve)  # -> Start, End; disabled
end_points_26 = EndPoints(Curve=interpolate_26.Curve)  # -> Start, End; disabled
end_points_27 = EndPoints(Curve=interpolate_27.Curve)  # -> Start, End; disabled
point_on_curve_9 = PointOnCurve(interpolate_25.Curve, parameter=0.814)  # disabled
deconstruct_9 = Deconstruct(Point=graft(point_on_curve_9))  # -> XComponent, YComponent, ZComponent; disabled
construct_point_47 = ConstructPoint(XCoordinate=0, YCoordinate=deconstruct_9.YComponent, ZCoordinate=0)  # disabled
construct_point_48 = ConstructPoint(XCoordinate=deconstruct_9.XComponent, YCoordinate=0, ZCoordinate=0)  # disabled
panel_54 = Panel(".12")  # disabled
boolean_toggle_8 = BooleanToggle(True)  # disabled
line_49 = Line(StartPoint=construct_point_47, EndPoint=point_on_curve_9)  # disabled
line_50 = Line(StartPoint=construct_point_48, EndPoint=point_on_curve_9)  # disabled
line_51 = Line(StartPoint=end_points_26.Start, EndPoint=end_points_25.Start)  # disabled
line_52 = Line(StartPoint=end_points_27.Start, EndPoint=end_points_25.Start)  # disabled
line_53 = Line(StartPoint=end_points_26.End, EndPoint=end_points_25.End)  # disabled
line_54 = Line(StartPoint=end_points_27.End, EndPoint=end_points_25.End)  # disabled
panel_55 = Panel(".06")  # disabled
panel_56 = Panel("     R(f)     ")  # disabled
panel_57 = Panel("D(f)")  # disabled
panel_58 = Panel("x")  # disabled
offset_curve_9 = OffsetCurve(Curve=interpolate_25.Curve, Plane=PlaneXY(0, 0, 0), Distance=panel_55, BothSides=boolean_toggle_8, Kinks=0, CapType=1)  # disabled
boundary_surfaces_9 = BoundarySurfaces(Edges=offset_curve_9)  # disabled
text_tag_3d_41 = TextTag3D(Location=curve_middle_18, Text=panel_56, Size=panel_54, Justification=1)  # disabled
text_tag_3d_42 = TextTag3D(Location=curve_middle_17, Text=panel_57, Size=panel_54, Justification=7)  # disabled
text_tag_3d_43 = TextTag3D(Location=point_on_curve_9, Text=panel_52, Size=panel_54, Justification=7)  # disabled
text_tag_3d_44 = TextTag3D(Location=construct_point_47, Text=panel_53, Size=panel_54, Justification=6)  # disabled
text_tag_3d_45 = TextTag3D(Location=construct_point_48, Text=panel_58, Size=panel_54, Justification=7)  # disabled

# ----
# j) 1 - Aƒ((x - B)/C), C != 0
number_slider_16 = Slider(4, range=0..4)
A_9 = Slider(2, range=0..4)
C_9 = Slider(2, range=0..10)
B_9 = Slider(1, range=0..10)
negative_12 = Negative(Value=number_slider_16)
construct_domain_10 = ConstructDomain(DomainStart=negative_12, DomainEnd=number_slider_16)
range_11 = Range(Domain=construct_domain_10, Steps=Slider(100, range=0..100))
expression_10 = Expression(x=range_11, A=A_9, B=B_9, C=C_9, Expression="1 - A * ((x - B)/C)^2 ")
panel_59 = Panel("""    
     y = f(-x)""")
construct_point_49 = ConstructPoint(XCoordinate=range_11, YCoordinate=expression_10, ZCoordinate=0)
construct_point_50 = ConstructPoint(XCoordinate=range_11, YCoordinate=0, ZCoordinate=0)
construct_point_51 = ConstructPoint(XCoordinate=0, YCoordinate=expression_10, ZCoordinate=0)
interpolate_28 = Interpolate(Vertices=construct_point_49, Degree=3, Periodic=False, KnotStyle=1)  # -> Curve, Length, Domain
interpolate_29 = Interpolate(Vertices=construct_point_50, Degree=3, Periodic=False, KnotStyle=1)  # -> Curve, Length, Domain
interpolate_30 = Interpolate(Vertices=construct_point_51, Degree=3, Periodic=False, KnotStyle=1)  # -> Curve, Length, Domain
curve_middle_19 = CurveMiddle(Curve=interpolate_29.Curve)
curve_middle_20 = CurveMiddle(Curve=interpolate_30.Curve)
end_points_28 = EndPoints(Curve=interpolate_28.Curve)  # -> Start, End
end_points_29 = EndPoints(Curve=interpolate_29.Curve)  # -> Start, End
end_points_30 = EndPoints(Curve=interpolate_30.Curve)  # -> Start, End
point_on_curve_10 = PointOnCurve(interpolate_28.Curve, parameter=0.966)
deconstruct_10 = Deconstruct(Point=graft(point_on_curve_10))  # -> XComponent, YComponent, ZComponent
construct_point_52 = ConstructPoint(XCoordinate=0, YCoordinate=deconstruct_10.YComponent, ZCoordinate=0)
construct_point_53 = ConstructPoint(XCoordinate=deconstruct_10.XComponent, YCoordinate=0, ZCoordinate=0)
line_55 = Line(StartPoint=construct_point_52, EndPoint=point_on_curve_10)
line_56 = Line(StartPoint=construct_point_53, EndPoint=point_on_curve_10)
line_57 = Line(StartPoint=end_points_29.Start, EndPoint=end_points_28.Start)
line_58 = Line(StartPoint=end_points_30.Start, EndPoint=end_points_28.Start)
line_59 = Line(StartPoint=end_points_29.End, EndPoint=end_points_28.End)
line_60 = Line(StartPoint=end_points_30.End, EndPoint=end_points_28.End)
offset_curve_10 = OffsetCurve(Curve=interpolate_28.Curve, Plane=PlaneXY(0, 0, 0), Distance=".06", BothSides=Toggle(True), Kinks=0, CapType=1)
boundary_surfaces_10 = BoundarySurfaces(Edges=offset_curve_10)
text_tag_3d_46 = TextTag3D(Location=curve_middle_20, Text="     R(f)     ", Size=".12", Justification=1)
text_tag_3d_47 = TextTag3D(Location=curve_middle_19, Text="D(f)", Size=".12", Justification=7)
text_tag_3d_48 = TextTag3D(Location=point_on_curve_10, Text=panel_59, Size=".12", Justification=7)
text_tag_3d_49 = TextTag3D(Location=construct_point_52, Text="f(x)     ", Size=".12", Justification=6)
text_tag_3d_50 = TextTag3D(Location=construct_point_53, Text="x", Size=".12", Justification=7)

# ----
# i) ƒ(x/C), C != 0
number_slider_17 = Slider(4, range=0..4)
A_10 = Slider(2, range=0..4)
C_10 = Slider(2, range=0..10)
B_10 = Slider(2, range=0..10)
negative_13 = Negative(Value=number_slider_17)
construct_domain_11 = ConstructDomain(DomainStart=negative_13, DomainEnd=number_slider_17)
range_12 = Range(Domain=construct_domain_11, Steps=Slider(100, range=0..100))
panel_60 = Panel("""    
     y = ƒ(x/C)""")
expression_11 = Expression(x=range_12, C=C_10, Expression="(x/C)^2")
construct_point_54 = ConstructPoint(XCoordinate=range_12, YCoordinate=expression_11, ZCoordinate=0)
construct_point_55 = ConstructPoint(XCoordinate=range_12, YCoordinate=0, ZCoordinate=0)
construct_point_56 = ConstructPoint(XCoordinate=0, YCoordinate=expression_11, ZCoordinate=0)
interpolate_31 = Interpolate(Vertices=construct_point_54, Degree=3, Periodic=False, KnotStyle=1)  # -> Curve, Length, Domain
interpolate_32 = Interpolate(Vertices=construct_point_55, Degree=3, Periodic=False, KnotStyle=1)  # -> Curve, Length, Domain
interpolate_33 = Interpolate(Vertices=construct_point_56, Degree=3, Periodic=False, KnotStyle=1)  # -> Curve, Length, Domain
curve_middle_21 = CurveMiddle(Curve=interpolate_32.Curve)
curve_middle_22 = CurveMiddle(Curve=interpolate_33.Curve)
end_points_31 = EndPoints(Curve=interpolate_31.Curve)  # -> Start, End
end_points_32 = EndPoints(Curve=interpolate_32.Curve)  # -> Start, End
end_points_33 = EndPoints(Curve=interpolate_33.Curve)  # -> Start, End
point_on_curve_11 = PointOnCurve(interpolate_31.Curve, parameter=0.814)
deconstruct_11 = Deconstruct(Point=graft(point_on_curve_11))  # -> XComponent, YComponent, ZComponent
construct_point_57 = ConstructPoint(XCoordinate=0, YCoordinate=deconstruct_11.YComponent, ZCoordinate=0)
construct_point_58 = ConstructPoint(XCoordinate=deconstruct_11.XComponent, YCoordinate=0, ZCoordinate=0)
line_61 = Line(StartPoint=construct_point_57, EndPoint=point_on_curve_11)
line_62 = Line(StartPoint=construct_point_58, EndPoint=point_on_curve_11)
line_63 = Line(StartPoint=end_points_32.Start, EndPoint=end_points_31.Start)
line_64 = Line(StartPoint=end_points_33.Start, EndPoint=end_points_31.Start)
line_65 = Line(StartPoint=end_points_32.End, EndPoint=end_points_31.End)
line_66 = Line(StartPoint=end_points_33.End, EndPoint=end_points_31.End)
offset_curve_11 = OffsetCurve(Curve=interpolate_31.Curve, Plane=PlaneXY(0, 0, 0), Distance=".06", BothSides=Toggle(True), Kinks=0, CapType=1)
boundary_surfaces_11 = BoundarySurfaces(Edges=offset_curve_11)
text_tag_3d_51 = TextTag3D(Location=curve_middle_22, Text="     R(f)     ", Size=".12", Justification=1)
text_tag_3d_52 = TextTag3D(Location=curve_middle_21, Text="D(f)", Size=".12", Justification=7)
text_tag_3d_53 = TextTag3D(Location=point_on_curve_11, Text=panel_60, Size=".12", Justification=7)
text_tag_3d_54 = TextTag3D(Location=construct_point_57, Text="f(x)     ", Size=".12", Justification=6)
text_tag_3d_55 = TextTag3D(Location=construct_point_58, Text="x", Size=".12", Justification=7)
