# Grasshopper definition 030_MASTER_SCRITP_functions.gh (Grasshopper 1.0.7)
# plug-ins: HAL for Grasshopper, Pufferfish

# 1.3
# Functions:
# alt + 159 = ƒ
# Definition of a Function
# - a function ƒ is a rule that assigns to each element x
# in some set D(ƒ) (called the domain of ƒ)
# a unique object ƒ(x) called the value of ƒ at x
# - let's assume that our functions consist of real numbers
# and that the values of our functions are also real numbers
# - domain 𝐷(ƒ)
# - the squaring function on IR is the function
# ƒ that assigns to each real number x
# its square, x²:
# ƒ(x) = x², for x in IR
# - the domain of ƒ is the set of all real numbers:
# 𝐷(ƒ) = IR
# - it is common to refer to the function loosely as ƒ(x)
# - the squaring function is often simply
# called the function x²
# - another way of denoting the function is:
# ƒ : x → ƒ(x)
# - this reads as "the function ƒ that takes x to ƒ(x)
# - the squaring function can be donated:
# ƒ : x → x²
# or even more simply
# x → x²
# - this required that the domain be specified
# - if the functio g is defined by
# g(x) = x² for -1 <= x < 2,
# then g is not the same function as ƒ
# because g and ƒ have different domains
# - we don't want to specify for real numbers and real values
# The Domain Convention:
sessionsettings = SessionSettings()

# ----
# ƒ(x) = x²
# The Domain Convention:
# - Unless the domain of a function ƒ is given explicity,
# we assume that it is the largest set of real numbers
# for which ƒ(x) makes sense as a real number
# - x² has domain all real numbers
# 1/x² has domain all real numbers except 0
# 
# The Range of a Function
# - the range of function ƒ is the set of
# all real numbers that are
# values of the function: that is
# it is the set of all numbers y such that
# y = ƒ(x) for some x in D(ƒ).
# the range of ƒ is denotes at R(ƒ)
# 
# The Graph of a Function
# - the graph of a function ƒ is the graph
# of the equation y = ƒ(x) in the Cartesian plane
# Thus it is the set of all points with coordinates
# (x, ƒ(x)), where x belongs to D(ƒ)
number_slider = Slider(2.489, range=0..4)  # disabled
negative = Negative(Value=number_slider)  # disabled
construct_domain = ConstructDomain(DomainStart=negative, DomainEnd=number_slider)  # disabled
A = Slider(0.1, range=0..0.1)  # disabled
number_slider_2 = Slider(0, range=0..10)  # disabled
range = Range(Domain=construct_domain, Steps=10)  # disabled
panel = Panel("1")  # disabled
expression = Expression(x=range, A=panel, B=number_slider_2, Expression="A*x^2 + B")  # disabled
construct_point = ConstructPoint(XCoordinate=range, YCoordinate=expression, ZCoordinate=0)  # disabled
construct_point_2 = ConstructPoint(XCoordinate=range, YCoordinate=0, ZCoordinate=0)  # disabled
construct_point_3 = ConstructPoint(XCoordinate=0, YCoordinate=expression, ZCoordinate=0)  # disabled
interpolate = Interpolate(Vertices=construct_point, Degree=3, Periodic=False, KnotStyle=1)  # -> Curve, Length, Domain; disabled
interpolate_2 = Interpolate(Vertices=construct_point_2, Degree=3, Periodic=False, KnotStyle=1)  # -> Curve, Length, Domain; disabled
interpolate_3 = Interpolate(Vertices=construct_point_3, Degree=3, Periodic=False, KnotStyle=1)  # -> Curve, Length, Domain; disabled
curve_middle = CurveMiddle(Curve=interpolate_2.Curve)  # disabled
point_on_curve = PointOnCurve(interpolate.Curve, parameter=0.814)  # disabled
end_points = EndPoints(Curve=interpolate.Curve)  # -> Start, End; disabled
end_points_2 = EndPoints(Curve=interpolate_2.Curve)  # -> Start, End; disabled
end_points_3 = EndPoints(Curve=interpolate_3.Curve)  # -> Start, End; disabled
deconstruct = Deconstruct(Point=graft(point_on_curve))  # -> XComponent, YComponent, ZComponent; disabled
construct_point_4 = ConstructPoint(XCoordinate=0, YCoordinate=deconstruct.YComponent, ZCoordinate=0)  # disabled
construct_point_5 = ConstructPoint(XCoordinate=deconstruct.XComponent, YCoordinate=0, ZCoordinate=0)  # disabled
panel_2 = Panel(".12")  # disabled
line = Line(StartPoint=construct_point_4, EndPoint=point_on_curve)  # disabled
line_2 = Line(StartPoint=construct_point_5, EndPoint=point_on_curve)  # disabled
line_3 = Line(StartPoint=end_points_2.Start, EndPoint=end_points.Start)  # disabled
line_4 = Line(StartPoint=end_points_3.Start, EndPoint=end_points.Start)  # disabled
line_5 = Line(StartPoint=end_points_2.End, EndPoint=end_points.End)  # disabled
line_6 = Line(StartPoint=end_points_3.End, EndPoint=end_points.End)  # disabled
panel_3 = Panel(".06")  # disabled
panel_4 = Panel("     y    ")  # disabled
panel_5 = Panel("x")  # disabled
panel_6 = Panel("""    
     y = f(x)""")  # disabled
panel_7 = Panel("f(x)     ")  # disabled
panel_8 = Panel("x")  # disabled
offset_curve = OffsetCurve(Curve=interpolate.Curve, Plane=PlaneXY(0, 0, 0), Distance=panel_3, BothSides=False, Kinks=0, CapType=1)  # disabled
boundary_surfaces = BoundarySurfaces(Edges=offset_curve)  # disabled
text_tag_3d = TextTag3D(Location=end_points_3.End, Text=panel_4, Size=panel_2, Justification=6)  # disabled
text_tag_3d_2 = TextTag3D(Location=end_points_2.End, Text=panel_5, Size=panel_2, Justification=7)  # disabled
text_tag_3d_3 = TextTag3D(Location=point_on_curve, Text=panel_6, Size=panel_2, Justification=7)  # disabled
text_tag_3d_4 = TextTag3D(Location=construct_point_4, Text=panel_7, Size=panel_2, Justification=6)  # disabled
text_tag_3d_5 = TextTag3D(Location=construct_point_5, Text=panel_8, Size=panel_2, Justification=7)  # disabled

# ----
# Illustrate the domain, range and graph of function ƒ
# - note that the domain of the function ƒ can be
# regarded as the set of points on the x-axis
# and the range as a set on the y-axis
# - note that the graph of the function is such that any vertical
# line through a point in the domain meets the graph
# at exactly one point (because ƒ(x)
# IS A UNIQUE NUMBER FOR EACH X
# the horizontal line through this point
# on the graph meets the y-axis at ƒ(x)
# Thus ƒ(x) is the vertical displacement of that point
# on the graph
# x-axis and y-axis
xy_plane = XYPlane(Origin=Point(0, 0, 0))
range_2 = Range(Domain="5", Steps=10)
construct_point_6 = ConstructPoint(XCoordinate=range_2, YCoordinate=0, ZCoordinate=0)
construct_point_7 = ConstructPoint(XCoordinate=0, YCoordinate=range_2, ZCoordinate=0)
list_item = ListItem(List=construct_point_6, Index=0, Wrap=True)  # -> Item1, Item
list_item_2 = ListItem(List=construct_point_7, Index=0, Wrap=True)  # -> Item1, Item
construct_point_8 = ConstructPoint(XCoordinate=0, YCoordinate=0, ZCoordinate=0)
vector_2pt = Vector2Pt(PointA=list_item.Item, PointB=list_item.Item1, Unitize=False)  # -> Vector, Length
vector_2pt_2 = Vector2Pt(PointA=list_item_2.Item, PointB=list_item_2.Item1, Unitize=False)  # -> Vector, Length
negative_2 = Negative(Value=vector_2pt.Vector)
negative_3 = Negative(Value=vector_2pt_2.Vector)
vector_display = VectorDisplay(Anchor=construct_point_8, Vector=vector_2pt.Vector)
vector_display_2 = VectorDisplay(Anchor=construct_point_8, Vector=negative_2)
vector_display_3 = VectorDisplay(Anchor=construct_point_8, Vector=vector_2pt_2.Vector)
vector_display_4 = VectorDisplay(Anchor=construct_point_8, Vector=negative_3)

# ----
# ghPython
number_slider_3 = Slider(4, range=0..14)  # disabled
negative_4 = Negative(Value=number_slider_3)  # disabled
number_slider_4 = Slider(100, range=0..100)  # disabled
construct_domain_2 = ConstructDomain(DomainStart=negative_4, DomainEnd=number_slider_3)  # disabled
range_3 = Range(Domain=construct_domain_2, Steps=number_slider_4)  # disabled
ghpython_script = GhPythonScript(numList=range_3)  # -> out, numListX, numListY, y1, y2; inputs numList: list; disabled
# ---------- ghpython_script: Python ----------
__author__ = "Sculpture"
__version__ = "2021.07.15"

import rhinoscriptsyntax as rs

numbers1 = []
numListX = []
numbers2 = []
numListY = []

for valX in numList:
    if valX > 1:
        numListX.append(valX)
        numbers1.append(1/(valX - 1))
        y1 = numbers1
print numListX
    
for valY in numList:
    if valY < 1:
        numListY.append(valY)
        numbers2.append(1/(valY - 1))
        y2 = numbers2
print numListY
# ---------- end ghpython_script ----------
construct_point_9 = ConstructPoint(XCoordinate=ghpython_script.numListX, YCoordinate=ghpython_script.y1, ZCoordinate=0)  # disabled
construct_point_10 = ConstructPoint(XCoordinate=ghpython_script.numListY, YCoordinate=ghpython_script.y2, ZCoordinate=0)  # disabled
interpolate_4 = Interpolate(Vertices=construct_point_9, Degree=3, Periodic=False, KnotStyle=1)  # -> Curve, Length, Domain; disabled
interpolate_5 = Interpolate(Vertices=construct_point_10, Degree=3, Periodic=False, KnotStyle=1)  # -> Curve, Length, Domain; disabled

# ----
# C#
number_slider_5 = Slider(4, range=0..14)  # disabled
negative_5 = Negative(Value=number_slider_5)  # disabled
number_slider_6 = Slider(100, range=0..100)  # disabled
construct_domain_3 = ConstructDomain(DomainStart=negative_5, DomainEnd=number_slider_5)  # disabled
range_4 = Range(Domain=construct_domain_3, Steps=number_slider_6)  # disabled
l_02_foreachloop = L_02_ForeachLoop(numList=range_4)  # -> out, function; inputs numList: list of Double, func: Double; disabled
# ---------- l_02_foreachloop: C# usings ----------
using System.IO;
using System.Linq;
using System.Data;
using System.Drawing;
using System.Reflection;
using System.Windows.Forms;
using System.Xml;
using System.Xml.Linq;
using System.Runtime.InteropServices;

using Rhino.DocObjects;
using Rhino.Collections;
using GH_IO;
using GH_IO.Serialization;
# ---------- l_02_foreachloop: C# ----------
    List<double> numbers = new List<double>();

    foreach(double val in numList)
      numbers.Add(1 / (val - 1));

    function = numbers;
# ---------- end l_02_foreachloop ----------
construct_point_11 = ConstructPoint(XCoordinate=range_4, YCoordinate=l_02_foreachloop.function, ZCoordinate=0)  # disabled
interpolate_6 = Interpolate(Vertices=construct_point_11, Degree=3, Periodic=False, KnotStyle=1)  # -> Curve, Length, Domain; disabled

boolean_toggle = BooleanToggle(True)  # disabled

# ----
# illustrates the domain, range and graph of a function
number_slider_7 = Slider(1.959, range=0..4)  # disabled
number_slider_8 = Slider(4, range=0..4)  # disabled
construct_domain_4 = ConstructDomain(DomainStart=number_slider_7, DomainEnd=number_slider_8)  # disabled
A_2 = Slider(0.1, range=0..0.1)  # disabled
number_slider_9 = Slider(1, range=0..10)  # disabled
range_5 = Range(Domain=construct_domain_4, Steps=10)  # disabled
expression_2 = Expression(x=range_5, A=A_2, B=number_slider_9, Expression="A*x^2 + B")  # disabled
construct_point_12 = ConstructPoint(XCoordinate=range_5, YCoordinate=expression_2, ZCoordinate=0)  # disabled
construct_point_13 = ConstructPoint(XCoordinate=range_5, YCoordinate=0, ZCoordinate=0)  # disabled
construct_point_14 = ConstructPoint(XCoordinate=0, YCoordinate=expression_2, ZCoordinate=0)  # disabled
interpolate_7 = Interpolate(Vertices=construct_point_12, Degree=3, Periodic=False, KnotStyle=1)  # -> Curve, Length, Domain; disabled
interpolate_8 = Interpolate(Vertices=construct_point_13, Degree=3, Periodic=False, KnotStyle=1)  # -> Curve, Length, Domain; disabled
interpolate_9 = Interpolate(Vertices=construct_point_14, Degree=3, Periodic=False, KnotStyle=1)  # -> Curve, Length, Domain; disabled
curve_middle_2 = CurveMiddle(Curve=interpolate_8.Curve)  # disabled
curve_middle_3 = CurveMiddle(Curve=interpolate_9.Curve)  # disabled
point_on_curve_2 = PointOnCurve(interpolate_7.Curve, parameter=0.241)  # disabled
end_points_4 = EndPoints(Curve=interpolate_7.Curve)  # -> Start, End; disabled
end_points_5 = EndPoints(Curve=interpolate_8.Curve)  # -> Start, End; disabled
end_points_6 = EndPoints(Curve=interpolate_9.Curve)  # -> Start, End; disabled
deconstruct_2 = Deconstruct(Point=graft(point_on_curve_2))  # -> XComponent, YComponent, ZComponent; disabled
construct_point_15 = ConstructPoint(XCoordinate=0, YCoordinate=deconstruct_2.YComponent, ZCoordinate=0)  # disabled
construct_point_16 = ConstructPoint(XCoordinate=deconstruct_2.XComponent, YCoordinate=0, ZCoordinate=0)  # disabled
panel_9 = Panel(".12")  # disabled
line_7 = Line(StartPoint=construct_point_15, EndPoint=point_on_curve_2)  # disabled
line_8 = Line(StartPoint=construct_point_16, EndPoint=point_on_curve_2)  # disabled
line_9 = Line(StartPoint=end_points_5.Start, EndPoint=end_points_4.Start)  # disabled
line_10 = Line(StartPoint=end_points_6.Start, EndPoint=end_points_4.Start)  # disabled
line_11 = Line(StartPoint=end_points_5.End, EndPoint=end_points_4.End)  # disabled
line_12 = Line(StartPoint=end_points_6.End, EndPoint=end_points_4.End)  # disabled
panel_10 = Panel(".06")  # disabled
panel_11 = Panel("     R(f)     ")  # disabled
panel_12 = Panel("D(f)")  # disabled
panel_13 = Panel("""    
     y = f(x)""")  # disabled
panel_14 = Panel("f(x)     ")  # disabled
panel_15 = Panel("x")  # disabled
offset_curve_2 = OffsetCurve(
    Curve=[interpolate_7.Curve, interpolate_9.Curve, interpolate_8.Curve],
    Plane=PlaneXY(0, 0, 0),
    Distance=panel_10,
    BothSides=boolean_toggle,
    Kinks=0,
    CapType=1)  # disabled
boundary_surfaces_2 = BoundarySurfaces(Edges=offset_curve_2)  # disabled
# Since sqaures of numbers cannot be negative
# the square root function √x is defined for x >= 0 only
# - the uniqueness condition in the definition of function
# requires that there be only one value of √x
# for wach value x in D(√) = [0, ∞)
# 
# By convention, the term square root and the symbol √ always
# refer to the nonnegative aquare root
# Thus, while there are two numbers whose
# square is 4,
# only one of these is called √4, namely √4 = 2
# The graph y = √x is shown
# if we want to give both solutions of the equation
# x² = a, (a > 0),
# we can indicate them as x = √a and x = -√a
# - a common mistake is to write √x² = x
# THIS IS INCORRECT unless you know beforehand
# that x >= 0
# 
# This formula is always correct:
# The Square Root of a Square
# √x² = |x|
text_tag_3d_6 = TextTag3D(Location=curve_middle_3, Text=panel_11, Size=panel_9, Justification=1)  # disabled
text_tag_3d_7 = TextTag3D(Location=curve_middle_2, Text=panel_12, Size=panel_9, Justification=7)  # disabled
text_tag_3d_8 = TextTag3D(Location=point_on_curve_2, Text=panel_13, Size=panel_9, Justification=7)  # disabled
text_tag_3d_9 = TextTag3D(Location=construct_point_15, Text=panel_14, Size=panel_9, Justification=6)  # disabled
text_tag_3d_10 = TextTag3D(Location=construct_point_16, Text=panel_15, Size=panel_9, Justification=7)  # disabled

# ----
# working domain sets
number_slider_10 = Slider(1, range=0..1)
number_slider_11 = Slider(4, range=0..10)
construct_domain_5 = ConstructDomain(DomainStart=number_slider_10, DomainEnd=Slider(7, range=0..10))
construct_domain_6 = ConstructDomain(DomainStart=Slider(4, range=0..10), DomainEnd=Slider(10, range=0..10))
range_6 = Range(Domain=construct_domain_5, Steps=number_slider_11)
range_7 = Range(Domain=construct_domain_6, Steps=number_slider_11)
set_difference_s = SetDifferenceS(SetA=range_6, SetB=range_7)
create_set = CreateSet(List=range_6)  # -> Set, Map
set_union = SetUnion(SetA=range_6, SetB=range_7)
set_difference = SetDifference(SetA=range_6, SetB=range_7)
set_intersection = SetIntersection(SetA=range_6, SetB=range_7)
create_set_2 = CreateSet(List=range_7)  # -> Set, Map
panel_16 = Panel(set_intersection)
panel_17 = Panel(create_set.Set)
panel_18 = Panel(create_set_2.Set)

number_slider_12 = Slider(4, range=0..4)
negative_6 = Negative(Value=number_slider_12)
construct_domain_7 = ConstructDomain(DomainStart=negative_6, DomainEnd=number_slider_12)
range_8 = Range(Domain=construct_domain_7, Steps=Slider(16, range=0..100))

# ----
# Exercises:
# Single Domains
number_slider_13 = Slider(4, range=0..4)
negative_7 = Negative(Value=number_slider_13)
construct_domain_8 = ConstructDomain(DomainStart=negative_7, DomainEnd=number_slider_13)
range_9 = Range(Domain=construct_domain_8, Steps=Slider(16, range=0..100))

number_slider_14 = Slider(4, range=0..4)
negative_8 = Negative(Value=number_slider_14)
construct_domain_9 = ConstructDomain(DomainStart=negative_8, DomainEnd=number_slider_14)
range_10 = Range(Domain=construct_domain_9, Steps=Slider(16, range=0..100))

construct_domain_10 = ConstructDomain(DomainStart="2", DomainEnd=Slider(4, range=0..4))
# ƒ(x) = Sqrt(x - 2)
range_11 = Range(Domain=construct_domain_10, Steps=Slider(24, range=0..100))

# ----
# ƒ(x) = Sqrt(1 - x^2)
panel_19 = Panel("0")

number_slider_15 = Slider(4, range=0..4)
negative_9 = Negative(Value=number_slider_15)
construct_domain_11 = ConstructDomain(DomainStart=negative_9, DomainEnd=number_slider_15)
range_12 = Range(Domain=construct_domain_11, Steps=Slider(48, range=0..100))

# ----
# ƒ(x) = (x - 2)^2 - B)
number_slider_16 = Slider(48, range=0..100)

number_slider_17 = Slider(4, range=0..4)
negative_10 = Negative(Value=number_slider_17)
construct_domain_12 = ConstructDomain(DomainStart=negative_10, DomainEnd=number_slider_17)
range_13 = Range(Domain=construct_domain_12, Steps=number_slider_16)

# ----
# ƒ(x) = 1/(x^2 + B)
number_slider_18 = Slider(48, range=0..100)

number_slider_19 = Slider(4, range=0..4)
negative_11 = Negative(Value=number_slider_19)
construct_domain_13 = ConstructDomain(DomainStart=negative_11, DomainEnd=number_slider_19)
range_14 = Range(Domain=construct_domain_13, Steps=number_slider_18)

# ----
# ƒ(x) = 2 - x
number_slider_20 = Slider(1, range=0..10)
expression_3 = Expression(x=range_8, A=number_slider_20, B=Slider(0, range=0..10), Expression="A * (2 - x)")

expression_4 = Expression(x=range_11, A=Slider(1, range=0..10), B=Slider(0, range=0..10), Expression="A * (Sqrt(x - 2))")
panel_20 = Panel("""A * (Sqrt(x - 2))
       """)

# ----
# ƒ(x) = 5
number_slider_21 = Slider(1, range=0..10)
panel_21 = Panel(""" 
     A * 5 + B""")
expression_5 = Expression(x=range_9, A=number_slider_21, B=Slider(0, range=0..10), Expression="A * 5 + B")

# ----
# ƒ(x) = 2 - x^2
number_slider_22 = Slider(1, range=0..10)
expression_6 = Expression(x=range_10, A=number_slider_22, B=Slider(0, range=0..10), Expression="A * (2 - x^2)")

expression_7 = Expression(x=range_12, A=Slider(1, range=0..10), B=Slider(3, range=0..10), Expression="A * (Sqrt(B^2 - x^2))")
panel_22 = Panel("""     A * (Sqrt(B^2 - x^2))
         for  -B <= x <= B""")

expression_8 = Expression(x=range_13, A=Slider(0, range=0..10), B=Slider(9.157, range=0..10), Expression="A * ((x - 2)^2 - B)")
panel_23 = Panel("     A * ((x - 2)^2 - B)")

expression_9 = Expression(x=range_14, A=Slider(2.27, range=0..10), B=Slider(0.423, range=0..10), Expression="A * (1/(x^2 + B))")

construct_point_17 = ConstructPoint(XCoordinate=range_8, YCoordinate=expression_3, ZCoordinate=0)
construct_point_18 = ConstructPoint(XCoordinate=range_8, YCoordinate=0, ZCoordinate=0)
construct_point_19 = ConstructPoint(XCoordinate=0, YCoordinate=range_8, ZCoordinate=0)
interpolate_10 = Interpolate(Vertices=construct_point_18, Degree=3, Periodic=False, KnotStyle=1)  # -> Curve, Length, Domain
interpolate_11 = Interpolate(Vertices=construct_point_19, Degree=3, Periodic=False, KnotStyle=1)  # -> Curve, Length, Domain
interpolate_12 = Interpolate(Vertices=construct_point_17, Degree=3, Periodic=False, KnotStyle=1)  # -> Curve, Length, Domain

construct_point_20 = ConstructPoint(XCoordinate=range_9, YCoordinate=expression_5, ZCoordinate=0)
construct_point_21 = ConstructPoint(XCoordinate=range_9, YCoordinate=0, ZCoordinate=0)
construct_point_22 = ConstructPoint(XCoordinate=0, YCoordinate=range_9, ZCoordinate=0)
interpolate_13 = Interpolate(Vertices=construct_point_21, Degree=3, Periodic=False, KnotStyle=1)  # -> Curve, Length, Domain
interpolate_14 = Interpolate(Vertices=construct_point_22, Degree=3, Periodic=False, KnotStyle=1)  # -> Curve, Length, Domain
interpolate_15 = Interpolate(Vertices=construct_point_20, Degree=3, Periodic=False, KnotStyle=1)  # -> Curve, Length, Domain

construct_point_23 = ConstructPoint(XCoordinate=range_11, YCoordinate=0, ZCoordinate=0)
construct_point_24 = ConstructPoint(XCoordinate=0, YCoordinate=range_11, ZCoordinate=0)
construct_point_25 = ConstructPoint(XCoordinate=range_11, YCoordinate=expression_4, ZCoordinate=0)
interpolate_16 = Interpolate(Vertices=construct_point_23, Degree=3, Periodic=False, KnotStyle=1)  # -> Curve, Length, Domain
interpolate_17 = Interpolate(Vertices=construct_point_24, Degree=3, Periodic=False, KnotStyle=1)  # -> Curve, Length, Domain
interpolate_18 = Interpolate(Vertices=construct_point_25, Degree=3, Periodic=False, KnotStyle=1)  # -> Curve, Length, Domain

construct_point_26 = ConstructPoint(XCoordinate=range_10, YCoordinate=expression_6, ZCoordinate=0)
construct_point_27 = ConstructPoint(XCoordinate=range_10, YCoordinate=0, ZCoordinate=0)
construct_point_28 = ConstructPoint(XCoordinate=0, YCoordinate=range_10, ZCoordinate=0)
interpolate_19 = Interpolate(Vertices=construct_point_27, Degree=3, Periodic=False, KnotStyle=1)  # -> Curve, Length, Domain
interpolate_20 = Interpolate(Vertices=construct_point_28, Degree=3, Periodic=False, KnotStyle=1)  # -> Curve, Length, Domain
interpolate_21 = Interpolate(Vertices=construct_point_26, Degree=3, Periodic=False, KnotStyle=1)  # -> Curve, Length, Domain

construct_point_29 = ConstructPoint(XCoordinate=range_12, YCoordinate=expression_7, ZCoordinate=0)
construct_point_30 = ConstructPoint(XCoordinate=range_12, YCoordinate=0, ZCoordinate=0)
construct_point_31 = ConstructPoint(XCoordinate=0, YCoordinate=range_12, ZCoordinate=0)
interpolate_22 = Interpolate(Vertices=construct_point_30, Degree=3, Periodic=False, KnotStyle=1)  # -> Curve, Length, Domain
interpolate_23 = Interpolate(Vertices=construct_point_31, Degree=3, Periodic=False, KnotStyle=1)  # -> Curve, Length, Domain
interpolate_24 = Interpolate(Vertices=construct_point_29, Degree=3, Periodic=False, KnotStyle=1)  # -> Curve, Length, Domain

construct_point_32 = ConstructPoint(XCoordinate=range_13, YCoordinate=expression_8, ZCoordinate=number_slider_17)
construct_point_33 = ConstructPoint(XCoordinate=range_13, YCoordinate=0, ZCoordinate=0)
construct_point_34 = ConstructPoint(XCoordinate=0, YCoordinate=range_13, ZCoordinate=0)
interpolate_25 = Interpolate(Vertices=construct_point_33, Degree=3, Periodic=False, KnotStyle=1)  # -> Curve, Length, Domain
interpolate_26 = Interpolate(Vertices=construct_point_34, Degree=3, Periodic=False, KnotStyle=1)  # -> Curve, Length, Domain
interpolate_27 = Interpolate(Vertices=construct_point_32, Degree=3, Periodic=False, KnotStyle=1)  # -> Curve, Length, Domain

construct_point_35 = ConstructPoint(XCoordinate=range_14, YCoordinate=expression_9, ZCoordinate=0)
construct_point_36 = ConstructPoint(XCoordinate=range_14, YCoordinate=0, ZCoordinate=0)
construct_point_37 = ConstructPoint(XCoordinate=0, YCoordinate=range_14, ZCoordinate=0)
interpolate_28 = Interpolate(Vertices=construct_point_36, Degree=3, Periodic=False, KnotStyle=1)  # -> Curve, Length, Domain
interpolate_29 = Interpolate(Vertices=construct_point_37, Degree=3, Periodic=False, KnotStyle=1)  # -> Curve, Length, Domain
interpolate_30 = Interpolate(Vertices=construct_point_35, Degree=3, Periodic=False, KnotStyle=1)  # -> Curve, Length, Domain

curve_middle_4 = CurveMiddle(Curve=interpolate_10.Curve)
point_on_curve_3 = PointOnCurve(interpolate_12.Curve, parameter=0.821)
end_points_7 = EndPoints(Curve=interpolate_10.Curve)  # -> Start, End
end_points_8 = EndPoints(Curve=interpolate_11.Curve)  # -> Start, End
deconstruct_3 = Deconstruct(Point=point_on_curve_3)  # -> XComponent, YComponent, ZComponent
construct_point_38 = ConstructPoint(XCoordinate=0, YCoordinate=deconstruct_3.YComponent, ZCoordinate=0)
construct_point_39 = ConstructPoint(XCoordinate=deconstruct_3.XComponent, YCoordinate=0, ZCoordinate=0)

curve_middle_5 = CurveMiddle(Curve=interpolate_13.Curve)
point_on_curve_4 = PointOnCurve(interpolate_15.Curve, parameter=0.144)
end_points_9 = EndPoints(Curve=interpolate_13.Curve)  # -> Start, End
end_points_10 = EndPoints(Curve=interpolate_14.Curve)  # -> Start, End
deconstruct_4 = Deconstruct(Point=point_on_curve_4)  # -> XComponent, YComponent, ZComponent
construct_point_40 = ConstructPoint(XCoordinate=0, YCoordinate=deconstruct_4.YComponent, ZCoordinate=0)
construct_point_41 = ConstructPoint(XCoordinate=deconstruct_4.XComponent, YCoordinate=0, ZCoordinate=0)

curve_middle_6 = CurveMiddle(Curve=interpolate_16.Curve)
point_on_curve_5 = PointOnCurve(interpolate_18.Curve, parameter=1)
end_points_11 = EndPoints(Curve=interpolate_16.Curve)  # -> Start, End
end_points_12 = EndPoints(Curve=interpolate_17.Curve)  # -> Start, End
deconstruct_5 = Deconstruct(Point=point_on_curve_5)  # -> XComponent, YComponent, ZComponent
construct_point_42 = ConstructPoint(XCoordinate=0, YCoordinate=deconstruct_5.YComponent, ZCoordinate=0)
construct_point_43 = ConstructPoint(XCoordinate=deconstruct_5.XComponent, YCoordinate=0, ZCoordinate=0)

curve_middle_7 = CurveMiddle(Curve=interpolate_19.Curve)
point_on_curve_6 = PointOnCurve(interpolate_21.Curve, parameter=0.654)
end_points_13 = EndPoints(Curve=interpolate_19.Curve)  # -> Start, End
end_points_14 = EndPoints(Curve=interpolate_20.Curve)  # -> Start, End
deconstruct_6 = Deconstruct(Point=point_on_curve_6)  # -> XComponent, YComponent, ZComponent
construct_point_44 = ConstructPoint(XCoordinate=0, YCoordinate=deconstruct_6.YComponent, ZCoordinate=0)
construct_point_45 = ConstructPoint(XCoordinate=deconstruct_6.XComponent, YCoordinate=0, ZCoordinate=0)

curve_middle_8 = CurveMiddle(Curve=interpolate_22.Curve)
point_on_curve_7 = PointOnCurve(interpolate_24.Curve, parameter=0.751)
end_points_15 = EndPoints(Curve=interpolate_22.Curve)  # -> Start, End
end_points_16 = EndPoints(Curve=interpolate_23.Curve)  # -> Start, End
deconstruct_7 = Deconstruct(Point=point_on_curve_7)  # -> XComponent, YComponent, ZComponent
construct_point_46 = ConstructPoint(XCoordinate=0, YCoordinate=deconstruct_7.YComponent, ZCoordinate=0)
construct_point_47 = ConstructPoint(XCoordinate=deconstruct_7.XComponent, YCoordinate=0, ZCoordinate=0)

curve_middle_9 = CurveMiddle(Curve=interpolate_25.Curve)
end_points_17 = EndPoints(Curve=interpolate_25.Curve)  # -> Start, End
point_on_curve_8 = PointOnCurve(interpolate_27.Curve, parameter=1)
end_points_18 = EndPoints(Curve=interpolate_26.Curve)  # -> Start, End
deconstruct_8 = Deconstruct(Point=point_on_curve_8)  # -> XComponent, YComponent, ZComponent
construct_point_48 = ConstructPoint(XCoordinate=0, YCoordinate=deconstruct_8.YComponent, ZCoordinate=0)
construct_point_49 = ConstructPoint(XCoordinate=deconstruct_8.XComponent, YCoordinate=0, ZCoordinate=0)

curve_middle_10 = CurveMiddle(Curve=interpolate_28.Curve)
point_on_curve_9 = PointOnCurve(interpolate_30.Curve, parameter=0.751)
end_points_19 = EndPoints(Curve=interpolate_28.Curve)  # -> Start, End
end_points_20 = EndPoints(Curve=interpolate_29.Curve)  # -> Start, End
deconstruct_9 = Deconstruct(Point=point_on_curve_9)  # -> XComponent, YComponent, ZComponent
construct_point_50 = ConstructPoint(XCoordinate=0, YCoordinate=deconstruct_9.YComponent, ZCoordinate=0)
construct_point_51 = ConstructPoint(XCoordinate=deconstruct_9.XComponent, YCoordinate=0, ZCoordinate=0)

loft = Loft(
    Curves=[interpolate_30.Curve, interpolate_27.Curve],
    Options={Adjust=False, Closed=False, LoftEnds=0, LoftSimp=0, LoftType=0, Rebuild=10, Refit=0.01})

offset_curve_3 = OffsetCurve(Curve=interpolate_12.Curve, Plane=PlaneXY(0, 0, 0), Distance=".03", BothSides=Toggle(True), Kinks=0, CapType=1)
line_13 = Line(StartPoint=construct_point_39, EndPoint=point_on_curve_3)
line_14 = Line(StartPoint=construct_point_38, EndPoint=point_on_curve_3)
boundary_surfaces_3 = BoundarySurfaces(Edges=offset_curve_3)
curve = Curve(interpolate_12.Curve)

offset_curve_4 = OffsetCurve(Curve=interpolate_15.Curve, Plane=PlaneXY(0, 0, 0), Distance=".03", BothSides=Toggle(True), Kinks=0, CapType=1)
line_15 = Line(StartPoint=construct_point_41, EndPoint=point_on_curve_4)
line_16 = Line(StartPoint=construct_point_40, EndPoint=point_on_curve_4)
boundary_surfaces_4 = BoundarySurfaces(Edges=offset_curve_4)
curve_2 = Curve(interpolate_15.Curve)

offset_curve_5 = OffsetCurve(Curve=interpolate_21.Curve, Plane=PlaneXY(0, 0, 0), Distance=".03", BothSides=Toggle(True), Kinks=0, CapType=1)
line_17 = Line(StartPoint=construct_point_45, EndPoint=point_on_curve_6)
line_18 = Line(StartPoint=construct_point_44, EndPoint=point_on_curve_6)
boundary_surfaces_5 = BoundarySurfaces(Edges=offset_curve_5)
curve_3 = Curve(interpolate_21.Curve)

concatenate = Concatenate(FragmentA="      ƒ(x) = ", FragmentB=panel_20)
text_tag_3d_11 = TextTag3D(Location=point_on_curve_5, Text=concatenate, Size=".12", Justification=7)
text_tag_3d_12 = TextTag3D(Location=construct_point_42, Text=panel_20, Size=".12", Justification=1)
text_tag_3d_13 = TextTag3D(Location=construct_point_43, Text="x", Size=".12", Justification=7)
text_tag_3d_14 = TextTag3D(Location=curve_middle_6, Text="0         ", Size=".12", Justification=3)

offset_curve_6 = OffsetCurve(Curve=interpolate_18.Curve, Plane=PlaneXY(0, 0, 0), Distance=".03", BothSides=Toggle(True), Kinks=0, CapType=1)
line_19 = Line(StartPoint=construct_point_43, EndPoint=point_on_curve_5)
boundary_surfaces_6 = BoundarySurfaces(Edges=offset_curve_6)
line_20 = Line(StartPoint=construct_point_42, EndPoint=point_on_curve_5)
curve_4 = Curve(interpolate_18.Curve)

concatenate_2 = Concatenate(FragmentA="      ƒ(x) = ", FragmentB=panel_22)
text_tag_3d_15 = TextTag3D(Location=point_on_curve_7, Text=concatenate_2, Size=".12", Justification=7)
text_tag_3d_16 = TextTag3D(Location=construct_point_46, Text=panel_22, Size=".12", Justification=1)
text_tag_3d_17 = TextTag3D(Location=construct_point_47, Text="x", Size=".12", Justification=7)
text_tag_3d_18 = TextTag3D(Location=curve_middle_8, Text="0         ", Size=".12", Justification=3)

concatenate_3 = Concatenate(FragmentA="      ƒ(x) = ", FragmentB=panel_23)
text_tag_3d_19 = TextTag3D(Location=point_on_curve_8, Text=concatenate_3, Size=".12", Justification=7)
text_tag_3d_20 = TextTag3D(Location=construct_point_48, Text=panel_23, Size=".12", Justification=1)
text_tag_3d_21 = TextTag3D(Location=construct_point_49, Text="x", Size=".12", Justification=7)
text_tag_3d_22 = TextTag3D(Location=curve_middle_9, Text="0         ", Size=".12", Justification=3)

concatenate_4 = Concatenate(FragmentA="      ƒ(x) = ", FragmentB="     A * (1/(x^2 + B))")
text_tag_3d_23 = TextTag3D(Location=point_on_curve_9, Text=concatenate_4, Size=".12", Justification=7)
text_tag_3d_24 = TextTag3D(Location=construct_point_50, Text="     A * (1/(x^2 + B))", Size=".12", Justification=1)
text_tag_3d_25 = TextTag3D(Location=construct_point_51, Text="x", Size=".12", Justification=7)
text_tag_3d_26 = TextTag3D(Location=curve_middle_10, Text="0         ", Size=".12", Justification=3)

offset_curve_7 = OffsetCurve(Curve=interpolate_24.Curve, Plane=PlaneXY(0, 0, 0), Distance=".03", BothSides=Toggle(True), Kinks=0, CapType=1)
line_21 = Line(StartPoint=construct_point_47, EndPoint=point_on_curve_7)
line_22 = Line(StartPoint=construct_point_46, EndPoint=point_on_curve_7)
boundary_surfaces_7 = BoundarySurfaces(Edges=offset_curve_7)
curve_5 = Curve(interpolate_24.Curve)

offset_curve_8 = OffsetCurve(Curve=interpolate_27.Curve, Plane=PlaneXY(0, 0, 0), Distance=".03", BothSides=Toggle(True), Kinks=0, CapType=1)
line_23 = Line(StartPoint=construct_point_49, EndPoint=point_on_curve_8)
line_24 = Line(StartPoint=construct_point_48, EndPoint=point_on_curve_8)
boundary_surfaces_8 = BoundarySurfaces(Edges=offset_curve_8)
curve_6 = Curve(interpolate_27.Curve)

offset_curve_9 = OffsetCurve(Curve=interpolate_30.Curve, Plane=PlaneXY(0, 0, 0), Distance=".03", BothSides=Toggle(True), Kinks=0, CapType=1)
line_25 = Line(StartPoint=construct_point_51, EndPoint=point_on_curve_9)
line_26 = Line(StartPoint=construct_point_50, EndPoint=point_on_curve_9)
boundary_surfaces_9 = BoundarySurfaces(Edges=offset_curve_9)
curve_7 = Curve(interpolate_30.Curve)

# ----
# ƒ(x) = (x + 1)/x
# ƒ(x) = (x + 1)/x
number_slider_23 = Slider(24, range=0..100)

construct_domain_14 = ConstructDomain(DomainStart="0", DomainEnd=Slider(4, range=0..4))
range_15 = Range(Domain=construct_domain_14, Steps=number_slider_23)

negative_12 = Negative(Value=Slider(4, range=0..4))
construct_domain_15 = ConstructDomain(DomainStart=negative_12, DomainEnd="0")
range_16 = Range(Domain=construct_domain_15, Steps=number_slider_23)

# ----
# ƒ(x) = 1/((2 + x)
# ƒ(x) = 1/((2 + x)
number_slider_24 = Slider(26, range=0..100)

construct_domain_16 = ConstructDomain(DomainStart="-2", DomainEnd=Slider(4, range=0..4))
range_17 = Range(Domain=construct_domain_16, Steps=number_slider_24)

# ----
# Multiple Domains
number_slider_25 = Slider(4, range=0..4)
negative_13 = Negative(Value=number_slider_25)
construct_domain_17 = ConstructDomain(DomainStart=negative_13, DomainEnd="-2")
range_18 = Range(Domain=construct_domain_17, Steps=number_slider_24)

# ----
# ƒ(x) = x /(1 - x)
# ƒ(x) = x /(1 - x)
number_slider_26 = Slider(24, range=0..100)

construct_domain_18 = ConstructDomain(DomainStart="1", DomainEnd=Slider(4, range=0..4))
range_19 = Range(Domain=construct_domain_18, Steps=number_slider_26)

negative_14 = Negative(Value=Slider(4, range=0..4))
construct_domain_19 = ConstructDomain(DomainStart=negative_14, DomainEnd="1")
range_20 = Range(Domain=construct_domain_19, Steps=number_slider_26)

number_slider_27 = Slider(4, range=0..4)
negative_15 = Negative(Value=number_slider_27)
number_slider_28 = Slider(100, range=0..100)
construct_domain_20 = ConstructDomain(DomainStart="1", DomainEnd=number_slider_27)
construct_domain_21 = ConstructDomain(DomainStart=negative_15, DomainEnd="0")
range_21 = Range(Domain=construct_domain_21, Steps=number_slider_28)
range_22 = Range(Domain=construct_domain_20, Steps=number_slider_28)

number_slider_29 = Slider(1.77, range=-4..4)
square = Square(Value=number_slider_29)
subtraction = Subtraction(A=square, B=number_slider_29)
panel_24 = Panel(subtraction)

expression_10 = Expression(x=range_17, A=Slider(1, range=0..10), B=Slider(0, range=0..10), Expression="A * (1/(2 + x))")
panel_25 = Panel("""A * (1/(2 + x))
       for x > -2""")

expression_11 = Expression(x=range_18, A=Slider(1, range=0..10), B=Slider(0, range=0..10), Expression="A * (1/(2 + x))")
panel_26 = Panel("""A * (1/(2 + x))
       for x < -2""")

expression_12 = Expression(x=range_15, A=Slider(1, range=0..10), B=Slider(0, range=0..10), Expression="A * ((x + 1)/x)")
panel_27 = Panel("""A * ((x + 1)/x)
       for x > 0""")

expression_13 = Expression(x=range_16, A=Slider(1, range=0..10), B=Slider(0, range=0..10), Expression="A * ((x + 1)/x)")
panel_28 = Panel("""A * ((x + 1)/x)
       for x < 0""")

# ----
# ƒ(x) = Sqrt(x^2 - x)
number_slider_30 = Slider(1, range=0..10)
expression_14 = Expression(x=range_21, A=number_slider_30, B=Slider(0, range=0..10), Expression="A * (Sqrt(x^2 - x))")
panel_29 = Panel("""     A * (Sqrt(x^2 - x))
	for x < 1""")

number_slider_31 = Slider(1, range=0..10)
expression_15 = Expression(x=range_22, A=number_slider_30, B=Slider(0, range=0..10), Expression="A * (Sqrt(x^2 - x))")
panel_30 = Panel("""     A * (Sqrt(x^2 - x))
for x > 1""")

expression_16 = Expression(x=range_19, A=Slider(1, range=0..10), B=Slider(0, range=0..10), Expression="A * (x /(1 - x))")
panel_31 = Panel("""A * (x /(1 - x))
       for x > 1""")

expression_17 = Expression(x=range_20, A=Slider(1, range=0..10), B=Slider(0, range=0..10), Expression="A * (x /(1 - x))")
panel_32 = Panel("""A * (x /(1 - x))
       for x < 1""")

construct_point_52 = ConstructPoint(XCoordinate=range_18, YCoordinate=expression_11, ZCoordinate=0)
construct_point_53 = ConstructPoint(XCoordinate=range_18, YCoordinate=0, ZCoordinate=0)
construct_point_54 = ConstructPoint(XCoordinate=0, YCoordinate=range_18, ZCoordinate=0)
interpolate_31 = Interpolate(Vertices=construct_point_53, Degree=3, Periodic=False, KnotStyle=1)  # -> Curve, Length, Domain
interpolate_32 = Interpolate(Vertices=construct_point_54, Degree=3, Periodic=False, KnotStyle=1)  # -> Curve, Length, Domain
interpolate_33 = Interpolate(Vertices=construct_point_52, Degree=3, Periodic=False, KnotStyle=1)  # -> Curve, Length, Domain

construct_point_55 = ConstructPoint(XCoordinate=range_17, YCoordinate=expression_10, ZCoordinate=0)
construct_point_56 = ConstructPoint(XCoordinate=range_17, YCoordinate=0, ZCoordinate=0)
construct_point_57 = ConstructPoint(XCoordinate=0, YCoordinate=range_17, ZCoordinate=0)
interpolate_34 = Interpolate(Vertices=construct_point_56, Degree=3, Periodic=False, KnotStyle=1)  # -> Curve, Length, Domain
interpolate_35 = Interpolate(Vertices=construct_point_57, Degree=3, Periodic=False, KnotStyle=1)  # -> Curve, Length, Domain
interpolate_36 = Interpolate(Vertices=construct_point_55, Degree=3, Periodic=False, KnotStyle=1)  # -> Curve, Length, Domain

construct_point_58 = ConstructPoint(XCoordinate=range_16, YCoordinate=expression_13, ZCoordinate=0)
construct_point_59 = ConstructPoint(XCoordinate=range_16, YCoordinate=0, ZCoordinate=0)
construct_point_60 = ConstructPoint(XCoordinate=0, YCoordinate=range_16, ZCoordinate=0)
interpolate_37 = Interpolate(Vertices=construct_point_59, Degree=3, Periodic=False, KnotStyle=1)  # -> Curve, Length, Domain
interpolate_38 = Interpolate(Vertices=construct_point_60, Degree=3, Periodic=False, KnotStyle=1)  # -> Curve, Length, Domain
interpolate_39 = Interpolate(Vertices=construct_point_58, Degree=3, Periodic=False, KnotStyle=1)  # -> Curve, Length, Domain

construct_point_61 = ConstructPoint(XCoordinate=range_15, YCoordinate=expression_12, ZCoordinate=0)
construct_point_62 = ConstructPoint(XCoordinate=range_15, YCoordinate=0, ZCoordinate=0)
construct_point_63 = ConstructPoint(XCoordinate=0, YCoordinate=range_15, ZCoordinate=0)
interpolate_40 = Interpolate(Vertices=construct_point_62, Degree=3, Periodic=False, KnotStyle=1)  # -> Curve, Length, Domain
interpolate_41 = Interpolate(Vertices=construct_point_63, Degree=3, Periodic=False, KnotStyle=1)  # -> Curve, Length, Domain
interpolate_42 = Interpolate(Vertices=construct_point_61, Degree=3, Periodic=False, KnotStyle=1)  # -> Curve, Length, Domain

construct_point_64 = ConstructPoint(XCoordinate=range_22, YCoordinate=expression_15, ZCoordinate=0)
construct_point_65 = ConstructPoint(XCoordinate=range_22, YCoordinate=0, ZCoordinate=0)
construct_point_66 = ConstructPoint(XCoordinate=0, YCoordinate=range_22, ZCoordinate=0)
interpolate_43 = Interpolate(Vertices=construct_point_65, Degree=3, Periodic=False, KnotStyle=1)  # -> Curve, Length, Domain
interpolate_44 = Interpolate(Vertices=construct_point_66, Degree=3, Periodic=False, KnotStyle=1)  # -> Curve, Length, Domain
interpolate_45 = Interpolate(Vertices=construct_point_64, Degree=3, Periodic=False, KnotStyle=1)  # -> Curve, Length, Domain

construct_point_67 = ConstructPoint(XCoordinate=range_20, YCoordinate=expression_17, ZCoordinate=0)
construct_point_68 = ConstructPoint(XCoordinate=range_20, YCoordinate=0, ZCoordinate=0)
construct_point_69 = ConstructPoint(XCoordinate=0, YCoordinate=range_20, ZCoordinate=0)
interpolate_46 = Interpolate(Vertices=construct_point_68, Degree=3, Periodic=False, KnotStyle=1)  # -> Curve, Length, Domain
interpolate_47 = Interpolate(Vertices=construct_point_69, Degree=3, Periodic=False, KnotStyle=1)  # -> Curve, Length, Domain
interpolate_48 = Interpolate(Vertices=construct_point_67, Degree=3, Periodic=False, KnotStyle=1)  # -> Curve, Length, Domain

construct_point_70 = ConstructPoint(XCoordinate=range_19, YCoordinate=expression_16, ZCoordinate=0)
construct_point_71 = ConstructPoint(XCoordinate=range_19, YCoordinate=0, ZCoordinate=0)
construct_point_72 = ConstructPoint(XCoordinate=0, YCoordinate=range_19, ZCoordinate=0)
interpolate_49 = Interpolate(Vertices=construct_point_71, Degree=3, Periodic=False, KnotStyle=1)  # -> Curve, Length, Domain
interpolate_50 = Interpolate(Vertices=construct_point_72, Degree=3, Periodic=False, KnotStyle=1)  # -> Curve, Length, Domain
interpolate_51 = Interpolate(Vertices=construct_point_70, Degree=3, Periodic=False, KnotStyle=1)  # -> Curve, Length, Domain

construct_point_73 = ConstructPoint(XCoordinate=range_21, YCoordinate=expression_14, ZCoordinate=0)
construct_point_74 = ConstructPoint(XCoordinate=range_21, YCoordinate=0, ZCoordinate=0)
construct_point_75 = ConstructPoint(XCoordinate=0, YCoordinate=range_21, ZCoordinate=0)
interpolate_52 = Interpolate(Vertices=construct_point_74, Degree=3, Periodic=False, KnotStyle=1)  # -> Curve, Length, Domain
interpolate_53 = Interpolate(Vertices=construct_point_75, Degree=3, Periodic=False, KnotStyle=1)  # -> Curve, Length, Domain
interpolate_54 = Interpolate(Vertices=construct_point_73, Degree=3, Periodic=False, KnotStyle=1)  # -> Curve, Length, Domain

curve_middle_11 = CurveMiddle(Curve=interpolate_34.Curve)
point_on_curve_10 = PointOnCurve(interpolate_36.Curve, parameter=0.263)
end_points_21 = EndPoints(Curve=interpolate_34.Curve)  # -> Start, End
end_points_22 = EndPoints(Curve=interpolate_35.Curve)  # -> Start, End
deconstruct_10 = Deconstruct(Point=point_on_curve_10)  # -> XComponent, YComponent, ZComponent
construct_point_76 = ConstructPoint(XCoordinate=0, YCoordinate=deconstruct_10.YComponent, ZCoordinate=0)
construct_point_77 = ConstructPoint(XCoordinate=deconstruct_10.XComponent, YCoordinate=0, ZCoordinate=0)

curve_middle_12 = CurveMiddle(Curve=interpolate_31.Curve)
point_on_curve_11 = PointOnCurve(interpolate_33.Curve, parameter=0.317)
end_points_23 = EndPoints(Curve=interpolate_31.Curve)  # -> Start, End
end_points_24 = EndPoints(Curve=interpolate_32.Curve)  # -> Start, End
deconstruct_11 = Deconstruct(Point=point_on_curve_11)  # -> XComponent, YComponent, ZComponent
construct_point_78 = ConstructPoint(XCoordinate=0, YCoordinate=deconstruct_11.YComponent, ZCoordinate=0)
construct_point_79 = ConstructPoint(XCoordinate=deconstruct_11.XComponent, YCoordinate=0, ZCoordinate=0)

curve_middle_13 = CurveMiddle(Curve=interpolate_40.Curve)
point_on_curve_12 = PointOnCurve(interpolate_42.Curve, parameter=0.614)
end_points_25 = EndPoints(Curve=interpolate_40.Curve)  # -> Start, End
end_points_26 = EndPoints(Curve=interpolate_41.Curve)  # -> Start, End
deconstruct_12 = Deconstruct(Point=point_on_curve_12)  # -> XComponent, YComponent, ZComponent
construct_point_80 = ConstructPoint(XCoordinate=0, YCoordinate=deconstruct_12.YComponent, ZCoordinate=0)
construct_point_81 = ConstructPoint(XCoordinate=deconstruct_12.XComponent, YCoordinate=0, ZCoordinate=0)

curve_middle_14 = CurveMiddle(Curve=interpolate_37.Curve)
point_on_curve_13 = PointOnCurve(interpolate_39.Curve, parameter=0.114)
end_points_27 = EndPoints(Curve=interpolate_37.Curve)  # -> Start, End
end_points_28 = EndPoints(Curve=interpolate_38.Curve)  # -> Start, End
deconstruct_13 = Deconstruct(Point=point_on_curve_13)  # -> XComponent, YComponent, ZComponent
construct_point_82 = ConstructPoint(XCoordinate=0, YCoordinate=deconstruct_13.YComponent, ZCoordinate=0)
construct_point_83 = ConstructPoint(XCoordinate=deconstruct_13.XComponent, YCoordinate=0, ZCoordinate=0)

curve_middle_15 = CurveMiddle(Curve=interpolate_43.Curve)
end_points_29 = EndPoints(Curve=interpolate_43.Curve)  # -> Start, End
end_points_30 = EndPoints(Curve=interpolate_44.Curve)  # -> Start, End
point_on_curve_14 = PointOnCurve(interpolate_45.Curve, parameter=1)
deconstruct_14 = Deconstruct(Point=point_on_curve_14)  # -> XComponent, YComponent, ZComponent
construct_point_84 = ConstructPoint(XCoordinate=0, YCoordinate=deconstruct_14.YComponent, ZCoordinate=0)
construct_point_85 = ConstructPoint(XCoordinate=deconstruct_14.XComponent, YCoordinate=0, ZCoordinate=0)

curve_middle_16 = CurveMiddle(Curve=interpolate_49.Curve)
point_on_curve_15 = PointOnCurve(interpolate_51.Curve, parameter=0.634)
end_points_31 = EndPoints(Curve=interpolate_49.Curve)  # -> Start, End
end_points_32 = EndPoints(Curve=interpolate_50.Curve)  # -> Start, End
deconstruct_15 = Deconstruct(Point=point_on_curve_15)  # -> XComponent, YComponent, ZComponent
construct_point_86 = ConstructPoint(XCoordinate=0, YCoordinate=deconstruct_15.YComponent, ZCoordinate=0)
construct_point_87 = ConstructPoint(XCoordinate=deconstruct_15.XComponent, YCoordinate=0, ZCoordinate=0)

curve_middle_17 = CurveMiddle(Curve=interpolate_46.Curve)
point_on_curve_16 = PointOnCurve(interpolate_48.Curve, parameter=0.886)
end_points_33 = EndPoints(Curve=interpolate_46.Curve)  # -> Start, End
end_points_34 = EndPoints(Curve=interpolate_47.Curve)  # -> Start, End
deconstruct_16 = Deconstruct(Point=point_on_curve_16)  # -> XComponent, YComponent, ZComponent
construct_point_88 = ConstructPoint(XCoordinate=0, YCoordinate=deconstruct_16.YComponent, ZCoordinate=0)
construct_point_89 = ConstructPoint(XCoordinate=deconstruct_16.XComponent, YCoordinate=0, ZCoordinate=0)

curve_middle_18 = CurveMiddle(Curve=interpolate_52.Curve)
end_points_35 = EndPoints(Curve=interpolate_52.Curve)  # -> Start, End
end_points_36 = EndPoints(Curve=interpolate_53.Curve)  # -> Start, End
point_on_curve_17 = PointOnCurve(interpolate_54.Curve, parameter=0.481)
deconstruct_17 = Deconstruct(Point=point_on_curve_17)  # -> XComponent, YComponent, ZComponent
construct_point_90 = ConstructPoint(XCoordinate=0, YCoordinate=deconstruct_17.YComponent, ZCoordinate=0)
construct_point_91 = ConstructPoint(XCoordinate=deconstruct_17.XComponent, YCoordinate=0, ZCoordinate=0)

concatenate_5 = Concatenate(FragmentA="      ƒ(x) = ", FragmentB=panel_26)
text_tag_3d_27 = TextTag3D(Location=point_on_curve_11, Text=concatenate_5, Size=".12", Justification=7)
text_tag_3d_28 = TextTag3D(Location=construct_point_78, Text=panel_26, Size=".12", Justification=1)
text_tag_3d_29 = TextTag3D(Location=construct_point_79, Text="x", Size=".12", Justification=7)
text_tag_3d_30 = TextTag3D(Location=curve_middle_12, Text="0         ", Size=".12", Justification=3)

concatenate_6 = Concatenate(FragmentA="      ƒ(x) = ", FragmentB=panel_25)
text_tag_3d_31 = TextTag3D(Location=point_on_curve_10, Text=concatenate_6, Size=".12", Justification=7)
text_tag_3d_32 = TextTag3D(Location=construct_point_76, Text=panel_25, Size=".12", Justification=1)
text_tag_3d_33 = TextTag3D(Location=end_points_22.End, Text="y    ", Size=".12", Justification=6)
text_tag_3d_34 = TextTag3D(Location=end_points_21.End, Text="x", Size=".12", Justification=7)
text_tag_3d_35 = TextTag3D(Location=construct_point_77, Text="x", Size=".12", Justification=7)
text_tag_3d_36 = TextTag3D(Location=curve_middle_11, Text="0         ", Size=".12", Justification=3)

concatenate_7 = Concatenate(FragmentA="      ƒ(x) = ", FragmentB=panel_27)
text_tag_3d_37 = TextTag3D(Location=point_on_curve_12, Text=concatenate_7, Size=".12", Justification=7)
text_tag_3d_38 = TextTag3D(Location=construct_point_80, Text=panel_27, Size=".12", Justification=1)
text_tag_3d_39 = TextTag3D(Location=end_points_26.End, Text="y    ", Size=".12", Justification=6)
text_tag_3d_40 = TextTag3D(Location=end_points_25.End, Text="x", Size=".12", Justification=7)
text_tag_3d_41 = TextTag3D(Location=construct_point_81, Text="x", Size=".12", Justification=7)
text_tag_3d_42 = TextTag3D(Location=curve_middle_13, Text="0         ", Size=".12", Justification=3)

offset_curve_10 = OffsetCurve(
    Curve=[interpolate_39.Curve, interpolate_42.Curve],
    Plane=PlaneXY(0, 0, 0),
    Distance=".03",
    BothSides=Toggle(True),
    Kinks=0,
    CapType=1)
line_27 = Line(StartPoint=construct_point_83, EndPoint=point_on_curve_13)
line_28 = Line(StartPoint=construct_point_82, EndPoint=point_on_curve_13)
boundary_surfaces_10 = BoundarySurfaces(Edges=offset_curve_10)
line_29 = Line(StartPoint=construct_point_80, EndPoint=point_on_curve_12)
line_30 = Line(StartPoint=construct_point_81, EndPoint=point_on_curve_12)
curve_8 = Curve(interpolate_39.Curve)
curve_9 = Curve(interpolate_42.Curve)

concatenate_8 = Concatenate(FragmentA="      ƒ(x) = ", FragmentB=panel_28)
text_tag_3d_43 = TextTag3D(Location=point_on_curve_13, Text=concatenate_8, Size=".12", Justification=7)
text_tag_3d_44 = TextTag3D(Location=construct_point_82, Text=panel_28, Size=".12", Justification=1)
text_tag_3d_45 = TextTag3D(Location=construct_point_83, Text="x", Size=".12", Justification=7)
text_tag_3d_46 = TextTag3D(Location=curve_middle_14, Text="0         ", Size=".12", Justification=3)

concatenate_9 = Concatenate(FragmentA="      ƒ(x) = ", FragmentB=panel_31)
text_tag_3d_47 = TextTag3D(Location=point_on_curve_15, Text=concatenate_9, Size=".12", Justification=7)
text_tag_3d_48 = TextTag3D(Location=construct_point_86, Text=panel_31, Size=".12", Justification=1)
text_tag_3d_49 = TextTag3D(Location=end_points_32.End, Text="y    ", Size=".12", Justification=6)
text_tag_3d_50 = TextTag3D(Location=end_points_31.End, Text="x", Size=".12", Justification=7)
text_tag_3d_51 = TextTag3D(Location=construct_point_87, Text="x", Size=".12", Justification=7)
text_tag_3d_52 = TextTag3D(Location=curve_middle_16, Text="0         ", Size=".12", Justification=3)

concatenate_10 = Concatenate(FragmentA="      ƒ(x) = ", FragmentB=panel_30)
text_tag_3d_53 = TextTag3D(Location=point_on_curve_14, Text=concatenate_10, Size=".12", Justification=7)
text_tag_3d_54 = TextTag3D(Location=construct_point_84, Text=panel_30, Size=".12", Justification=1)
text_tag_3d_55 = TextTag3D(Location=construct_point_85, Text="x", Size=".12", Justification=7)
text_tag_3d_56 = TextTag3D(Location=curve_middle_15, Text="0         ", Size=".12", Justification=3)

offset_curve_11 = OffsetCurve(
    Curve=[interpolate_48.Curve, interpolate_51.Curve],
    Plane=PlaneXY(0, 0, 0),
    Distance=".03",
    BothSides=Toggle(True),
    Kinks=0,
    CapType=1)
line_31 = Line(StartPoint=construct_point_89, EndPoint=point_on_curve_16)
line_32 = Line(StartPoint=construct_point_88, EndPoint=point_on_curve_16)
boundary_surfaces_11 = BoundarySurfaces(Edges=offset_curve_11)
line_33 = Line(StartPoint=construct_point_86, EndPoint=point_on_curve_15)
line_34 = Line(StartPoint=construct_point_87, EndPoint=point_on_curve_15)
curve_10 = Curve(interpolate_48.Curve)
curve_11 = Curve(interpolate_51.Curve)

concatenate_11 = Concatenate(FragmentA="      ƒ(x) = ", FragmentB=panel_32)
text_tag_3d_57 = TextTag3D(Location=point_on_curve_16, Text=concatenate_11, Size=".12", Justification=7)
text_tag_3d_58 = TextTag3D(Location=construct_point_88, Text=panel_32, Size=".12", Justification=1)
text_tag_3d_59 = TextTag3D(Location=construct_point_89, Text="x", Size=".12", Justification=7)
text_tag_3d_60 = TextTag3D(Location=curve_middle_17, Text="0         ", Size=".12", Justification=3)

offset_curve_12 = OffsetCurve(
    Curve=[interpolate_33.Curve, interpolate_36.Curve],
    Plane=PlaneXY(0, 0, 0),
    Distance=".03",
    BothSides=Toggle(True),
    Kinks=0,
    CapType=1)
line_35 = Line(StartPoint=construct_point_79, EndPoint=point_on_curve_11)
line_36 = Line(StartPoint=construct_point_77, EndPoint=point_on_curve_10)
line_37 = Line(StartPoint=construct_point_78, EndPoint=point_on_curve_11)
line_38 = Line(StartPoint=construct_point_76, EndPoint=point_on_curve_10)
boundary_surfaces_12 = BoundarySurfaces(Edges=offset_curve_12)
curve_12 = Curve(interpolate_33.Curve)
curve_13 = Curve(interpolate_36.Curve)

concatenate_12 = Concatenate(FragmentA="      ƒ(x) = ", FragmentB=panel_29)
text_tag_3d_61 = TextTag3D(Location=point_on_curve_17, Text=concatenate_12, Size=".12", Justification=7)
text_tag_3d_62 = TextTag3D(Location=construct_point_90, Text=panel_29, Size=".12", Justification=1)
text_tag_3d_63 = TextTag3D(Location=construct_point_91, Text="x", Size=".12", Justification=7)
text_tag_3d_64 = TextTag3D(Location=curve_middle_18, Text="0         ", Size=".12", Justification=3)

offset_curve_13 = OffsetCurve(Curve=interpolate_45.Curve, Plane=PlaneXY(0, 0, 0), Distance=".03", BothSides=Toggle(True), Kinks=0, CapType=1)
line_39 = Line(StartPoint=construct_point_85, EndPoint=point_on_curve_14)
line_40 = Line(StartPoint=construct_point_84, EndPoint=point_on_curve_14)
boundary_surfaces_13 = BoundarySurfaces(Edges=offset_curve_13)
curve_14 = Curve(interpolate_45.Curve)

offset_curve_14 = OffsetCurve(Curve=interpolate_54.Curve, Plane=PlaneXY(0, 0, 0), Distance=".03", BothSides=Toggle(True), Kinks=0, CapType=1)
line_41 = Line(StartPoint=construct_point_91, EndPoint=point_on_curve_17)
line_42 = Line(StartPoint=construct_point_90, EndPoint=point_on_curve_17)
boundary_surfaces_14 = BoundarySurfaces(Edges=offset_curve_14)
curve_15 = Curve(interpolate_54.Curve)

number_slider_32 = Slider(5, range=0..5)
negative_16 = Negative(Value=number_slider_32)
construct_domain_22 = ConstructDomain(DomainStart=negative_16, DomainEnd=number_slider_32)
range_23 = Range(Domain=construct_domain_22, Steps=Slider(100, range=0..100))

number_slider_33 = Slider(4, range=0..4)
negative_17 = Negative(Value=number_slider_33)
construct_domain_23 = ConstructDomain(DomainStart=negative_17, DomainEnd=number_slider_33)
range_24 = Range(Domain=construct_domain_23, Steps=Slider(96, range=0..100))

number_slider_34 = Slider(2, range=0..2)
negative_18 = Negative(Value=number_slider_34)
construct_domain_24 = ConstructDomain(DomainStart=negative_18, DomainEnd=number_slider_34)
range_25 = Range(Domain=construct_domain_24, Steps=Slider(100, range=0..100))

square_2 = Square(Value=Slider(0, range=-4..4))
subtraction_2 = Subtraction(A=square_2, B="1")
# ƒ(x) = abs(x^2 - 1)
absolute = Absolute(Value=subtraction_2)
panel_33 = Panel(absolute)

number_slider_35 = Slider(3.21, range=-4..4)

number_slider_36 = Slider(2, range=0..2)
negative_19 = Negative(Value=number_slider_36)
construct_domain_25 = ConstructDomain(DomainStart=negative_19, DomainEnd=number_slider_36)
range_26 = Range(Domain=construct_domain_25, Steps=Slider(100, range=0..100))

number_slider_37 = Slider(4, range=-4..4)
multiplication = Multiplication(A="2", B=number_slider_37)
square_3 = Square(Value=number_slider_37)
subtraction_3 = Subtraction(A=square_3, B=multiplication)
# ƒ(x) = Sqrt(x^2 - (2 * x) + 1))
panel_34 = Panel("1")
addition = Addition(A=subtraction_3, B=panel_34)
square_root = SquareRoot(Value=addition)
panel_35 = Panel(square_root)

# ----
# watch for complex numbers
number_slider_38 = Slider(-1.16, range=-4..4)
square_4 = Square(Value=number_slider_38)
# ƒ(x) = Sqrt(4 - x^2)
subtraction_4 = Subtraction(A="4", B=square_4)
square_root_2 = SquareRoot(Value=subtraction_4)
panel_36 = Panel(square_root_2)

number_slider_39 = Slider(4, range=0..4)
# Exercises:
# Single Domains
negative_20 = Negative(Value=number_slider_39)
construct_domain_26 = ConstructDomain(DomainStart=negative_20, DomainEnd=number_slider_39)
range_27 = Range(Domain=construct_domain_26, Steps=Slider(16, range=0..100))

number_slider_40 = Slider(4, range=0..4)
negative_21 = Negative(Value=number_slider_40)
construct_domain_27 = ConstructDomain(DomainStart=negative_21, DomainEnd=number_slider_40)
range_28 = Range(Domain=construct_domain_27, Steps=Slider(16, range=0..100))

number_slider_41 = Slider(2, range=0..2)
negative_22 = Negative(Value=number_slider_41)
construct_domain_28 = ConstructDomain(DomainStart=negative_22, DomainEnd=number_slider_41)
range_29 = Range(Domain=construct_domain_28, Steps=Slider(100, range=0..100))

absolute_2 = Absolute(Value=number_slider_35)
subtraction_5 = Subtraction(A=number_slider_35, B="2")
absolute_3 = Absolute(Value=subtraction_5)

panel_37 = Panel(""" 
     A * Sqrt(x^2 - (2 * x) + 1)""")
expression_18 = Expression(x=range_24, A=Slider(1, range=0..10), B=Slider(1, range=0..10), Expression="A * Sqrt(x^2 - (2 * x) + 1)")

# ----
# ƒ(x) = (abs(x) + abs(x - B))
number_slider_42 = Slider(1, range=0..10)
expression_19 = Expression(x=range_23, A=number_slider_42, B=Slider(2, range=0..10), Expression="A * (abs(x) + abs(x - B))")

panel_38 = Panel(""" 
     A * Sqrt(4 - x^2)""")
expression_20 = Expression(x=range_25, A=Slider(1, range=0..10), B=Slider(1, range=0..10), Expression="A * Sqrt(4 - x^2)")

expression_21 = Expression(x=range_26, A=Slider(1, range=0..10), B=Slider(1, range=0..10), Expression="A * abs(x^2 - 1)")

addition_2 = Addition(A=absolute_2, B=absolute_3)

# ----
# ƒ(x) = 1/(Sqrt(4 - x^2))
number_slider_43 = Slider(1, range=0..10)
expression_22 = Expression(x=range_29, A=number_slider_43, B=Slider(2, range=0..10), Expression="A * 1/Sqrt(B^2 - x^2)")

# ----
# ƒ(x) = Sqrt(abs(x))
number_slider_44 = Slider(1, range=0..10)
expression_23 = Expression(x=range_28, A=number_slider_44, B=Slider(0, range=0..10), Expression="A * Sqrt(abs(x)) + B")
panel_39 = Panel(""" 
     A * Sqrt(abs(x)) + B""")

# ----
# ƒ(x) = x^3
number_slider_45 = Slider(1, range=0..10)
panel_40 = Panel(""" 
     A * x^3 + B""")
expression_24 = Expression(x=range_27, A=number_slider_45, B=Slider(0, range=0..10), Expression="A * x^3 + B")

panel_41 = Panel(addition_2)

construct_point_92 = ConstructPoint(XCoordinate=range_23, YCoordinate=0, ZCoordinate=0)
construct_point_93 = ConstructPoint(XCoordinate=0, YCoordinate=range_23, ZCoordinate=0)
construct_point_94 = ConstructPoint(XCoordinate=range_23, YCoordinate=expression_19, ZCoordinate=0)
interpolate_55 = Interpolate(Vertices=construct_point_92, Degree=3, Periodic=False, KnotStyle=1)  # -> Curve, Length, Domain
interpolate_56 = Interpolate(Vertices=construct_point_93, Degree=3, Periodic=False, KnotStyle=1)  # -> Curve, Length, Domain
interpolate_57 = Interpolate(Vertices=construct_point_94, Degree=Slider(1, range=1..3), Periodic=False, KnotStyle=1)  # -> Curve, Length, Domain

construct_point_95 = ConstructPoint(XCoordinate=range_24, YCoordinate=0, ZCoordinate=0)
construct_point_96 = ConstructPoint(XCoordinate=0, YCoordinate=range_24, ZCoordinate=0)
construct_point_97 = ConstructPoint(XCoordinate=range_24, YCoordinate=expression_18, ZCoordinate=0)
interpolate_58 = Interpolate(Vertices=construct_point_95, Degree=3, Periodic=False, KnotStyle=1)  # -> Curve, Length, Domain
interpolate_59 = Interpolate(Vertices=construct_point_96, Degree=3, Periodic=False, KnotStyle=1)  # -> Curve, Length, Domain
interpolate_60 = Interpolate(Vertices=construct_point_97, Degree=Slider(1, range=0..1), Periodic=False, KnotStyle=1)  # -> Curve, Length, Domain

construct_point_98 = ConstructPoint(XCoordinate=range_25, YCoordinate=0, ZCoordinate=0)
construct_point_99 = ConstructPoint(XCoordinate=0, YCoordinate=range_25, ZCoordinate=0)
construct_point_100 = ConstructPoint(XCoordinate=range_25, YCoordinate=expression_20, ZCoordinate=0)
interpolate_61 = Interpolate(Vertices=construct_point_98, Degree=3, Periodic=False, KnotStyle=1)  # -> Curve, Length, Domain
interpolate_62 = Interpolate(Vertices=construct_point_99, Degree=3, Periodic=False, KnotStyle=1)  # -> Curve, Length, Domain
interpolate_63 = Interpolate(Vertices=construct_point_100, Degree=Slider(1, range=0..1), Periodic=False, KnotStyle=1)  # -> Curve, Length, Domain

construct_point_101 = ConstructPoint(XCoordinate=range_26, YCoordinate=0, ZCoordinate=0)
construct_point_102 = ConstructPoint(XCoordinate=0, YCoordinate=range_26, ZCoordinate=0)
construct_point_103 = ConstructPoint(XCoordinate=range_26, YCoordinate=expression_21, ZCoordinate=0)
interpolate_64 = Interpolate(Vertices=construct_point_101, Degree=3, Periodic=False, KnotStyle=1)  # -> Curve, Length, Domain
interpolate_65 = Interpolate(Vertices=construct_point_102, Degree=3, Periodic=False, KnotStyle=1)  # -> Curve, Length, Domain
interpolate_66 = Interpolate(Vertices=construct_point_103, Degree=Slider(1, range=1..3), Periodic=False, KnotStyle=1)  # -> Curve, Length, Domain

construct_point_104 = ConstructPoint(XCoordinate=range_27, YCoordinate=expression_24, ZCoordinate=0)
construct_point_105 = ConstructPoint(XCoordinate=range_27, YCoordinate=0, ZCoordinate=0)
construct_point_106 = ConstructPoint(XCoordinate=0, YCoordinate=range_27, ZCoordinate=0)
interpolate_67 = Interpolate(Vertices=construct_point_105, Degree=3, Periodic=False, KnotStyle=1)  # -> Curve, Length, Domain
interpolate_68 = Interpolate(Vertices=construct_point_106, Degree=3, Periodic=False, KnotStyle=1)  # -> Curve, Length, Domain
interpolate_69 = Interpolate(Vertices=construct_point_104, Degree=3, Periodic=False, KnotStyle=1)  # -> Curve, Length, Domain

construct_point_107 = ConstructPoint(XCoordinate=range_28, YCoordinate=expression_23, ZCoordinate=0)
construct_point_108 = ConstructPoint(XCoordinate=range_28, YCoordinate=0, ZCoordinate=0)
construct_point_109 = ConstructPoint(XCoordinate=0, YCoordinate=range_28, ZCoordinate=0)
interpolate_70 = Interpolate(Vertices=construct_point_108, Degree=3, Periodic=False, KnotStyle=1)  # -> Curve, Length, Domain
interpolate_71 = Interpolate(Vertices=construct_point_109, Degree=3, Periodic=False, KnotStyle=1)  # -> Curve, Length, Domain
interpolate_72 = Interpolate(Vertices=construct_point_107, Degree=3, Periodic=False, KnotStyle=1)  # -> Curve, Length, Domain

construct_point_110 = ConstructPoint(XCoordinate=range_29, YCoordinate=0, ZCoordinate=0)
construct_point_111 = ConstructPoint(XCoordinate=0, YCoordinate=range_29, ZCoordinate=0)
construct_point_112 = ConstructPoint(XCoordinate=range_29, YCoordinate=expression_22, ZCoordinate=0)
interpolate_73 = Interpolate(Vertices=construct_point_110, Degree=3, Periodic=False, KnotStyle=1)  # -> Curve, Length, Domain
interpolate_74 = Interpolate(Vertices=construct_point_111, Degree=3, Periodic=False, KnotStyle=1)  # -> Curve, Length, Domain
interpolate_75 = Interpolate(Vertices=construct_point_112, Degree=3, Periodic=False, KnotStyle=1)  # -> Curve, Length, Domain

curve_middle_19 = CurveMiddle(Curve=interpolate_55.Curve)
point_on_curve_18 = PointOnCurve(interpolate_57.Curve, parameter=0.78)
end_points_37 = EndPoints(Curve=interpolate_55.Curve)  # -> Start, End
end_points_38 = EndPoints(Curve=interpolate_56.Curve)  # -> Start, End
deconstruct_18 = Deconstruct(Point=point_on_curve_18)  # -> XComponent, YComponent, ZComponent
construct_point_113 = ConstructPoint(XCoordinate=0, YCoordinate=deconstruct_18.YComponent, ZCoordinate=0)
construct_point_114 = ConstructPoint(XCoordinate=deconstruct_18.XComponent, YCoordinate=0, ZCoordinate=0)

curve_middle_20 = CurveMiddle(Curve=interpolate_58.Curve)
point_on_curve_19 = PointOnCurve(interpolate_60.Curve, parameter=0.909)
end_points_39 = EndPoints(Curve=interpolate_58.Curve)  # -> Start, End
end_points_40 = EndPoints(Curve=interpolate_59.Curve)  # -> Start, End
deconstruct_19 = Deconstruct(Point=point_on_curve_19)  # -> XComponent, YComponent, ZComponent
construct_point_115 = ConstructPoint(XCoordinate=0, YCoordinate=deconstruct_19.YComponent, ZCoordinate=0)
construct_point_116 = ConstructPoint(XCoordinate=deconstruct_19.XComponent, YCoordinate=0, ZCoordinate=0)

curve_middle_21 = CurveMiddle(Curve=interpolate_61.Curve)
point_on_curve_20 = PointOnCurve(interpolate_63.Curve, parameter=0.862)
end_points_41 = EndPoints(Curve=interpolate_61.Curve)  # -> Start, End
end_points_42 = EndPoints(Curve=interpolate_62.Curve)  # -> Start, End
deconstruct_20 = Deconstruct(Point=point_on_curve_20)  # -> XComponent, YComponent, ZComponent
construct_point_117 = ConstructPoint(XCoordinate=0, YCoordinate=deconstruct_20.YComponent, ZCoordinate=0)
construct_point_118 = ConstructPoint(XCoordinate=deconstruct_20.XComponent, YCoordinate=0, ZCoordinate=0)

curve_middle_22 = CurveMiddle(Curve=interpolate_64.Curve)
point_on_curve_21 = PointOnCurve(interpolate_66.Curve, parameter=0.78)
end_points_43 = EndPoints(Curve=interpolate_64.Curve)  # -> Start, End
end_points_44 = EndPoints(Curve=interpolate_65.Curve)  # -> Start, End
deconstruct_21 = Deconstruct(Point=point_on_curve_21)  # -> XComponent, YComponent, ZComponent
construct_point_119 = ConstructPoint(XCoordinate=0, YCoordinate=deconstruct_21.YComponent, ZCoordinate=0)
construct_point_120 = ConstructPoint(XCoordinate=deconstruct_21.XComponent, YCoordinate=0, ZCoordinate=0)

curve_middle_23 = CurveMiddle(Curve=interpolate_67.Curve)
point_on_curve_22 = PointOnCurve(interpolate_69.Curve, parameter=0.527)
end_points_45 = EndPoints(Curve=interpolate_67.Curve)  # -> Start, End
end_points_46 = EndPoints(Curve=interpolate_68.Curve)  # -> Start, End
deconstruct_22 = Deconstruct(Point=point_on_curve_22)  # -> XComponent, YComponent, ZComponent
construct_point_121 = ConstructPoint(XCoordinate=0, YCoordinate=deconstruct_22.YComponent, ZCoordinate=0)
construct_point_122 = ConstructPoint(XCoordinate=deconstruct_22.XComponent, YCoordinate=0, ZCoordinate=0)

curve_middle_24 = CurveMiddle(Curve=interpolate_70.Curve)
point_on_curve_23 = PointOnCurve(interpolate_72.Curve, parameter=0.527)
end_points_47 = EndPoints(Curve=interpolate_70.Curve)  # -> Start, End
end_points_48 = EndPoints(Curve=interpolate_71.Curve)  # -> Start, End
deconstruct_23 = Deconstruct(Point=point_on_curve_23)  # -> XComponent, YComponent, ZComponent
construct_point_123 = ConstructPoint(XCoordinate=0, YCoordinate=deconstruct_23.YComponent, ZCoordinate=0)
construct_point_124 = ConstructPoint(XCoordinate=deconstruct_23.XComponent, YCoordinate=0, ZCoordinate=0)

curve_middle_25 = CurveMiddle(Curve=interpolate_73.Curve)
point_on_curve_24 = PointOnCurve(interpolate_75.Curve, parameter=0.78)
end_points_49 = EndPoints(Curve=interpolate_73.Curve)  # -> Start, End
end_points_50 = EndPoints(Curve=interpolate_74.Curve)  # -> Start, End
deconstruct_24 = Deconstruct(Point=point_on_curve_24)  # -> XComponent, YComponent, ZComponent
construct_point_125 = ConstructPoint(XCoordinate=0, YCoordinate=deconstruct_24.YComponent, ZCoordinate=0)
construct_point_126 = ConstructPoint(XCoordinate=deconstruct_24.XComponent, YCoordinate=0, ZCoordinate=0)

offset_curve_15 = OffsetCurve(Curve=interpolate_57.Curve, Plane=PlaneXY(0, 0, 0), Distance=".03", BothSides=Toggle(True), Kinks=0, CapType=1)
line_43 = Line(StartPoint=construct_point_114, EndPoint=point_on_curve_18)
line_44 = Line(StartPoint=construct_point_113, EndPoint=point_on_curve_18)
boundary_surfaces_15 = BoundarySurfaces(Edges=offset_curve_15)
curve_16 = Curve(interpolate_57.Curve)

offset_curve_16 = OffsetCurve(Curve=interpolate_60.Curve, Plane=PlaneXY(0, 0, 0), Distance=".03", BothSides=Toggle(True), Kinks=0, CapType=1)
line_45 = Line(StartPoint=construct_point_116, EndPoint=point_on_curve_19)
line_46 = Line(StartPoint=construct_point_115, EndPoint=point_on_curve_19)
boundary_surfaces_16 = BoundarySurfaces(Edges=offset_curve_16)
curve_17 = Curve(interpolate_60.Curve)

offset_curve_17 = OffsetCurve(Curve=interpolate_63.Curve, Plane=PlaneXY(0, 0, 0), Distance=".03", BothSides=Toggle(True), Kinks=0, CapType=1)
line_47 = Line(StartPoint=construct_point_118, EndPoint=point_on_curve_20)
line_48 = Line(StartPoint=construct_point_117, EndPoint=point_on_curve_20)
boundary_surfaces_17 = BoundarySurfaces(Edges=offset_curve_17)
curve_18 = Curve(interpolate_63.Curve)

offset_curve_18 = OffsetCurve(Curve=interpolate_66.Curve, Plane=PlaneXY(0, 0, 0), Distance=".03", BothSides=Toggle(True), Kinks=0, CapType=1)
line_49 = Line(StartPoint=construct_point_120, EndPoint=point_on_curve_21)
line_50 = Line(StartPoint=construct_point_119, EndPoint=point_on_curve_21)
boundary_surfaces_18 = BoundarySurfaces(Edges=offset_curve_18)
curve_19 = Curve(interpolate_66.Curve)

offset_curve_19 = OffsetCurve(Curve=interpolate_69.Curve, Plane=PlaneXY(0, 0, 0), Distance=".03", BothSides=Toggle(True), Kinks=0, CapType=1)
line_51 = Line(StartPoint=construct_point_122, EndPoint=point_on_curve_22)
line_52 = Line(StartPoint=construct_point_121, EndPoint=point_on_curve_22)
boundary_surfaces_19 = BoundarySurfaces(Edges=offset_curve_19)
curve_20 = Curve(interpolate_69.Curve)

offset_curve_20 = OffsetCurve(Curve=interpolate_72.Curve, Plane=PlaneXY(0, 0, 0), Distance=".03", BothSides=Toggle(True), Kinks=0, CapType=1)
line_53 = Line(StartPoint=construct_point_124, EndPoint=point_on_curve_23)
line_54 = Line(StartPoint=construct_point_123, EndPoint=point_on_curve_23)
boundary_surfaces_20 = BoundarySurfaces(Edges=offset_curve_20)
curve_21 = Curve(interpolate_72.Curve)

offset_curve_21 = OffsetCurve(Curve=interpolate_75.Curve, Plane=PlaneXY(0, 0, 0), Distance=".03", BothSides=Toggle(True), Kinks=0, CapType=1)
line_55 = Line(StartPoint=construct_point_126, EndPoint=point_on_curve_24)
line_56 = Line(StartPoint=construct_point_125, EndPoint=point_on_curve_24)
boundary_surfaces_21 = BoundarySurfaces(Edges=offset_curve_21)
curve_22 = Curve(interpolate_75.Curve)

# ----
# S(x) = 1/(x - 1)
number_slider_46 = Slider(4, range=0..14)  # disabled
number_slider_47 = Slider(100, range=0..100)  # disabled
negative_23 = Negative(Value=number_slider_46)  # disabled
construct_domain_29 = ConstructDomain(DomainStart=negative_23, DomainEnd=number_slider_46)  # disabled
panel_42 = Panel("1")  # disabled
number_slider_48 = Slider(0, range=0..10)  # disabled
range_30 = Range(Domain=construct_domain_29, Steps=number_slider_47)  # disabled
smaller_than = SmallerThan(FirstNumber=range_30, SecondNumber=panel_42)  # -> SmallerThan, OrEqualTo; disabled
larger_than = LargerThan(FirstNumber=range_30, SecondNumber=panel_42)  # -> LargerThan, OrEqualTo; disabled
cull_pattern = CullPattern(List=range_30, CullPattern=larger_than.LargerThan)  # disabled
cull_pattern_2 = CullPattern(List=range_30, CullPattern=smaller_than.SmallerThan)  # disabled
xz_plane = XZPlane(Origin=Point(0, 0, 0))  # disabled
panel_43 = Panel(".12")  # disabled
panel_44 = Panel(".06")  # disabled
panel_45 = Panel("y         ")  # disabled
panel_46 = Panel("x")  # disabled

expression_25 = Expression(x=cull_pattern, A=panel_42, B=number_slider_48, Expression="1/(x - 1)")  # disabled
panel_47 = Panel("""    
     y = S(x)""")  # disabled
panel_48 = Panel("S(x)     ")  # disabled

expression_26 = Expression(x=cull_pattern_2, A=panel_42, B=number_slider_48, Expression="1/(x - 1)")  # disabled

construct_point_127 = ConstructPoint(XCoordinate=cull_pattern, YCoordinate=expression_25, ZCoordinate=0)  # disabled
construct_point_128 = ConstructPoint(XCoordinate=expression_25, YCoordinate=0, ZCoordinate=0)  # disabled
construct_point_129 = ConstructPoint(XCoordinate=cull_pattern_2, YCoordinate=expression_26, ZCoordinate=0)  # disabled
construct_point_130 = ConstructPoint(XCoordinate=0, YCoordinate=expression_26, ZCoordinate=0)  # disabled
interpolate_76 = Interpolate(Vertices=construct_point_129, Degree=3, Periodic=False, KnotStyle=1)  # -> Curve, Length, Domain; disabled
interpolate_77 = Interpolate(Vertices=construct_point_128, Degree=3, Periodic=False, KnotStyle=1)  # -> Curve, Length, Domain; disabled
interpolate_78 = Interpolate(Vertices=construct_point_130, Degree=3, Periodic=False, KnotStyle=1)  # -> Curve, Length, Domain; disabled
interpolate_79 = Interpolate(Vertices=construct_point_127, Degree=3, Periodic=False, KnotStyle=1)  # -> Curve, Length, Domain; disabled
mirror = Mirror(Geometry=interpolate_78.Curve, Plane=xz_plane)  # -> Geometry, Transform; disabled
point_on_curve_25 = PointOnCurve(interpolate_79.Curve, parameter=0.858)  # disabled
point_on_curve_26 = PointOnCurve(interpolate_77.Curve, parameter=0.868)  # disabled
point_on_curve_27 = PointOnCurve(mirror.Geometry, parameter=0.128)  # disabled
end_points_51 = EndPoints(Curve=interpolate_79.Curve)  # -> Start, End; disabled
end_points_52 = EndPoints(Curve=interpolate_77.Curve)  # -> Start, End; disabled
end_points_53 = EndPoints(Curve=interpolate_76.Curve)  # -> Start, End; disabled
deconstruct_25 = Deconstruct(Point=graft(point_on_curve_25))  # -> XComponent, YComponent, ZComponent; disabled
construct_point_131 = ConstructPoint(XCoordinate=deconstruct_25.XComponent, YCoordinate=0, ZCoordinate=0)  # disabled
construct_point_132 = ConstructPoint(XCoordinate=0, YCoordinate=deconstruct_25.YComponent, ZCoordinate=0)  # disabled
offset_curve_22 = OffsetCurve(
    Curve=[interpolate_79.Curve, interpolate_76.Curve],
    Plane=PlaneXY(0, 0, 0),
    Distance=panel_44,
    BothSides=False,
    Kinks=0,
    CapType=1)  # disabled
line_57 = Line(StartPoint=construct_point_132, EndPoint=point_on_curve_25)  # disabled
line_58 = Line(StartPoint=construct_point_131, EndPoint=point_on_curve_25)  # disabled
boundary_surfaces_22 = BoundarySurfaces(Edges=offset_curve_22)  # disabled
text_tag_3d_65 = TextTag3D(Location=point_on_curve_27, Text=panel_45, Size=panel_43, Justification=6)  # disabled
text_tag_3d_66 = TextTag3D(Location=point_on_curve_25, Text=panel_47, Size=panel_43, Justification=7)  # disabled
text_tag_3d_67 = TextTag3D(Location=construct_point_132, Text=panel_48, Size=panel_43, Justification=6)  # disabled
text_tag_3d_68 = TextTag3D(Location=[construct_point_131, point_on_curve_26], Text=panel_46, Size=panel_43, Justification=7)  # disabled

number_slider_49 = Slider(-4, range=-4..4.001)  # disabled
number_slider_50 = Slider(4, range=0..4)  # disabled
A_3 = Slider(0.1, range=0..0.1)  # disabled
number_slider_51 = Slider(1, range=0..10)  # disabled
panel_49 = Panel("1")  # disabled
panel_50 = Panel(".12")  # disabled
panel_51 = Panel(".06")  # disabled
panel_52 = Panel("     y    ")  # disabled
panel_53 = Panel("x")  # disabled
panel_54 = Panel("x")  # disabled

# ----
# k(x) = |x|
number_slider_52 = Slider(-4, range=-4..4.001)  # disabled
number_slider_53 = Slider(4, range=0..4)  # disabled
construct_domain_30 = ConstructDomain(DomainStart=number_slider_52, DomainEnd=number_slider_53)  # disabled
A_4 = Slider(0.1, range=0..0.1)  # disabled
number_slider_54 = Slider(0, range=0..10)  # disabled
range_31 = Range(Domain=construct_domain_30, Steps=10)  # disabled
panel_55 = Panel("1")  # disabled
construct_point_133 = ConstructPoint(XCoordinate=range_31, YCoordinate=0, ZCoordinate=0)  # disabled
interpolate_80 = Interpolate(Vertices=construct_point_133, Degree=3, Periodic=False, KnotStyle=1)  # -> Curve, Length, Domain; disabled
curve_middle_26 = CurveMiddle(Curve=interpolate_80.Curve)  # disabled
end_points_54 = EndPoints(Curve=interpolate_80.Curve)  # -> Start, End; disabled
panel_56 = Panel(".12")  # disabled
panel_57 = Panel(".06")  # disabled
panel_58 = Panel("     y    ")  # disabled
panel_59 = Panel("x")  # disabled
panel_60 = Panel("x")  # disabled
text_tag_3d_69 = TextTag3D(Location=end_points_54.End, Text=panel_59, Size=panel_56, Justification=7)  # disabled

expression_27 = Expression(x=range_31, A=panel_55, B=number_slider_54, Expression="A*abs(x) + B")  # disabled
panel_61 = Panel("1")  # disabled
panel_62 = Panel("""    
     y = k(x)""")  # disabled
panel_63 = Panel("k(x)     ")  # disabled

construct_point_134 = ConstructPoint(XCoordinate=range_31, YCoordinate=expression_27, ZCoordinate=0)  # disabled
construct_point_135 = ConstructPoint(XCoordinate=0, YCoordinate=expression_27, ZCoordinate=0)  # disabled
interpolate_81 = Interpolate(Vertices=construct_point_134, Degree=panel_61, Periodic=False, KnotStyle=1)  # -> Curve, Length, Domain; disabled
interpolate_82 = Interpolate(Vertices=construct_point_135, Degree=3, Periodic=False, KnotStyle=1)  # -> Curve, Length, Domain; disabled
point_on_curve_28 = PointOnCurve(interpolate_81.Curve, parameter=0.912)  # disabled
end_points_55 = EndPoints(Curve=interpolate_81.Curve)  # -> Start, End; disabled
end_points_56 = EndPoints(Curve=interpolate_82.Curve)  # -> Start, End; disabled
deconstruct_26 = Deconstruct(Point=graft(point_on_curve_28))  # -> XComponent, YComponent, ZComponent; disabled
construct_point_136 = ConstructPoint(XCoordinate=0, YCoordinate=deconstruct_26.YComponent, ZCoordinate=0)  # disabled
construct_point_137 = ConstructPoint(XCoordinate=deconstruct_26.XComponent, YCoordinate=0, ZCoordinate=0)  # disabled
line_59 = Line(StartPoint=construct_point_136, EndPoint=point_on_curve_28)  # disabled
line_60 = Line(StartPoint=construct_point_137, EndPoint=point_on_curve_28)  # disabled
line_61 = Line(StartPoint=end_points_54.Start, EndPoint=end_points_55.Start)  # disabled
line_62 = Line(StartPoint=end_points_56.Start, EndPoint=end_points_55.Start)  # disabled
line_63 = Line(StartPoint=end_points_54.End, EndPoint=end_points_55.End)  # disabled
line_64 = Line(StartPoint=end_points_56.End, EndPoint=end_points_55.End)  # disabled
offset_curve_23 = OffsetCurve(Curve=interpolate_81.Curve, Plane=PlaneXY(0, 0, 0), Distance=panel_57, BothSides=False, Kinks=0, CapType=1)  # disabled
boundary_surfaces_23 = BoundarySurfaces(Edges=offset_curve_23)  # disabled
text_tag_3d_70 = TextTag3D(Location=end_points_56.End, Text=panel_58, Size=panel_56, Justification=6)  # disabled
text_tag_3d_71 = TextTag3D(Location=point_on_curve_28, Text=panel_62, Size=panel_56, Justification=7)  # disabled
text_tag_3d_72 = TextTag3D(Location=construct_point_136, Text=panel_63, Size=panel_56, Justification=6)  # disabled
text_tag_3d_73 = TextTag3D(Location=construct_point_137, Text=panel_60, Size=panel_56, Justification=7)  # disabled

# ----
# g(x) = x²
# for -1 <= x < 2
panel_64 = Panel("-1")  # disabled
panel_65 = Panel("2")  # disabled
panel_66 = Panel("""    
     y = g(x)""")  # disabled
panel_67 = Panel("g(x)     ")  # disabled

construct_domain_31 = ConstructDomain(DomainStart=panel_64, DomainEnd=panel_65)  # disabled
range_32 = Range(Domain=construct_domain_31, Steps=10)  # disabled
construct_point_138 = ConstructPoint(XCoordinate=range_32, YCoordinate=0, ZCoordinate=0)  # disabled
interpolate_83 = Interpolate(Vertices=construct_point_138, Degree=3, Periodic=False, KnotStyle=1)  # -> Curve, Length, Domain; disabled
curve_middle_27 = CurveMiddle(Curve=interpolate_83.Curve)  # disabled
end_points_57 = EndPoints(Curve=interpolate_83.Curve)  # -> Start, End; disabled
text_tag_3d_74 = TextTag3D(Location=end_points_57.End, Text=panel_53, Size=panel_50, Justification=7)  # disabled

expression_28 = Expression(x=range_32, A=panel_49, B=number_slider_51, Expression="A*x^2 + B")  # disabled

construct_point_139 = ConstructPoint(XCoordinate=range_32, YCoordinate=expression_28, ZCoordinate=0)  # disabled
construct_point_140 = ConstructPoint(XCoordinate=0, YCoordinate=expression_28, ZCoordinate=0)  # disabled
interpolate_84 = Interpolate(Vertices=construct_point_139, Degree=3, Periodic=False, KnotStyle=1)  # -> Curve, Length, Domain; disabled
interpolate_85 = Interpolate(Vertices=construct_point_140, Degree=3, Periodic=False, KnotStyle=1)  # -> Curve, Length, Domain; disabled
point_on_curve_29 = PointOnCurve(interpolate_84.Curve, parameter=0.814)  # disabled
end_points_58 = EndPoints(Curve=interpolate_84.Curve)  # -> Start, End; disabled
end_points_59 = EndPoints(Curve=interpolate_85.Curve)  # -> Start, End; disabled
deconstruct_27 = Deconstruct(Point=graft(point_on_curve_29))  # -> XComponent, YComponent, ZComponent; disabled
construct_point_141 = ConstructPoint(XCoordinate=0, YCoordinate=deconstruct_27.YComponent, ZCoordinate=0)  # disabled
construct_point_142 = ConstructPoint(XCoordinate=deconstruct_27.XComponent, YCoordinate=0, ZCoordinate=0)  # disabled
line_65 = Line(StartPoint=construct_point_141, EndPoint=point_on_curve_29)  # disabled
line_66 = Line(StartPoint=construct_point_142, EndPoint=point_on_curve_29)  # disabled
line_67 = Line(StartPoint=end_points_57.Start, EndPoint=end_points_58.Start)  # disabled
line_68 = Line(StartPoint=end_points_59.Start, EndPoint=end_points_58.Start)  # disabled
line_69 = Line(StartPoint=end_points_57.End, EndPoint=end_points_58.End)  # disabled
line_70 = Line(StartPoint=end_points_59.End, EndPoint=end_points_58.End)  # disabled
offset_curve_24 = OffsetCurve(Curve=interpolate_84.Curve, Plane=PlaneXY(0, 0, 0), Distance=panel_51, BothSides=False, Kinks=0, CapType=1)  # disabled
boundary_surfaces_24 = BoundarySurfaces(Edges=offset_curve_24)  # disabled
text_tag_3d_75 = TextTag3D(Location=end_points_59.End, Text=panel_52, Size=panel_50, Justification=6)  # disabled
text_tag_3d_76 = TextTag3D(Location=point_on_curve_29, Text=panel_66, Size=panel_50, Justification=7)  # disabled
text_tag_3d_77 = TextTag3D(Location=construct_point_141, Text=panel_67, Size=panel_50, Justification=6)  # disabled
text_tag_3d_78 = TextTag3D(Location=construct_point_142, Text=panel_54, Size=panel_50, Justification=7)  # disabled

circle = Circle(Plane=end_points_58.Start, Radius=panel_50)  # disabled
boundary_surfaces_25 = BoundarySurfaces(Edges=circle)  # disabled
circle_2 = Circle(Plane=end_points_58.End, Radius=panel_50)  # disabled

# ----
# y  = x/|x| = {1 if x > 0, -1 if x > 0}
number_slider_55 = Slider(0.001, range=0.001..4)
number_slider_56 = Slider(4, range=0..4)
negative_24 = Negative(Value=number_slider_55)
negative_25 = Negative(Value=number_slider_56)
construct_domain_32 = ConstructDomain(DomainStart=number_slider_55, DomainEnd=number_slider_56)
construct_domain_33 = ConstructDomain(DomainStart=negative_24, DomainEnd=negative_25)
number_slider_57 = Slider(100, range=0..1000000)
A_5 = Slider(0.1, range=0..0.1)
division = Division(A=number_slider_57, B="2")
range_33 = Range(Domain=[construct_domain_32, construct_domain_33], Steps=number_slider_57)
cull_index = CullIndex(List=range_33, Indices=division, Wrap=True)
construct_point_143 = ConstructPoint(XCoordinate=range_33, YCoordinate=0, ZCoordinate=0)
interpolate_86 = Interpolate(Vertices=construct_point_143, Degree=3, Periodic=False, KnotStyle=1)  # -> Curve, Length, Domain
curve_middle_28 = CurveMiddle(Curve=interpolate_86.Curve)
end_points_60 = EndPoints(Curve=interpolate_86.Curve)  # -> Start, End
text_tag_3d_79 = TextTag3D(Location=end_points_60.End, Text="x", Size=".12", Justification=7)

# ----
# y  = √x
number_slider_58 = Slider(-4, range=-4..4.001)
# the Signum Function:
# - Latin for "sign"
# the value of sgn x indicates whether x is positive
# or negative
# - the domain of sgn consists of all real numbers
# except zero
# - ero is not regarded as positive or negative
# but the range of sgn consists of only two numbers
# -1 and 1
# see graph of sgn below:
number_slider_59 = Slider(100, range=0..100)
construct_domain_34 = ConstructDomain(DomainStart=number_slider_58, DomainEnd=Slider(4, range=0..4))
A_6 = Slider(0.1, range=0..0.1)
range_34 = Range(Domain=construct_domain_34, Steps=number_slider_59)
construct_point_144 = ConstructPoint(XCoordinate=range_34, YCoordinate=0, ZCoordinate=0)
interpolate_87 = Interpolate(Vertices=construct_point_144, Degree=3, Periodic=False, KnotStyle=1)  # -> Curve, Length, Domain
curve_middle_29 = CurveMiddle(Curve=interpolate_87.Curve)
end_points_61 = EndPoints(Curve=interpolate_87.Curve)  # -> Start, End
text_tag_3d_80 = TextTag3D(Location=end_points_61.End, Text="x", Size=".12", Justification=7)

expression_29 = Expression(x=range_34, A="1", B=Slider(0, range=0..10), Expression="A*Sqrt(x) + B")
panel_68 = Panel("""    
     y = Sqrt(x)""")

construct_point_145 = ConstructPoint(XCoordinate=range_34, YCoordinate=expression_29, ZCoordinate=0)
construct_point_146 = ConstructPoint(XCoordinate=0, YCoordinate=expression_29, ZCoordinate=0)
interpolate_88 = Interpolate(Vertices=construct_point_145, Degree=3, Periodic=False, KnotStyle=1)  # -> Curve, Length, Domain
interpolate_89 = Interpolate(Vertices=construct_point_146, Degree=3, Periodic=False, KnotStyle=1)  # -> Curve, Length, Domain
point_on_curve_30 = PointOnCurve(interpolate_88.Curve, parameter=0.73)
end_points_62 = EndPoints(Curve=interpolate_88.Curve)  # -> Start, End
end_points_63 = EndPoints(Curve=interpolate_89.Curve)  # -> Start, End
deconstruct_28 = Deconstruct(Point=graft(point_on_curve_30))  # -> XComponent, YComponent, ZComponent
panel_69 = Panel(point_on_curve_30)
construct_point_147 = ConstructPoint(XCoordinate=0, YCoordinate=deconstruct_28.YComponent, ZCoordinate=0)
construct_point_148 = ConstructPoint(XCoordinate=deconstruct_28.XComponent, YCoordinate=0, ZCoordinate=0)
line_71 = Line(StartPoint=construct_point_147, EndPoint=point_on_curve_30)
line_72 = Line(StartPoint=construct_point_148, EndPoint=point_on_curve_30)
line_73 = Line(StartPoint=end_points_61.Start, EndPoint=end_points_62.Start)
line_74 = Line(StartPoint=end_points_63.Start, EndPoint=end_points_62.Start)
line_75 = Line(StartPoint=end_points_61.End, EndPoint=end_points_62.End)
line_76 = Line(StartPoint=end_points_63.End, EndPoint=end_points_62.End)
offset_curve_25 = OffsetCurve(Curve=interpolate_88.Curve, Plane=PlaneXY(0, 0, 0), Distance=".06", BothSides=False, Kinks=0, CapType=1)
boundary_surfaces_26 = BoundarySurfaces(Edges=offset_curve_25)
# Operations on Functions:
# - like numbers, functions can be added, subtracted,
# multiplied, and devided (except when the
# denominator is 0)
# to produce new functions
# - If ƒ and g are functions, then for every x
#  that belongs to both ƒ and g we define:
# 
# (ƒ + g)(x) = ƒ(x) + g(x)
# (ƒ - g)(x) = ƒ(x) - g(x)
# (ƒg)(x) = ƒ(x)g(x)
# (ƒ/g)(x) = ƒ(x)/g(x) where g(x) != 0
# 
# if c is a real number then
# (cƒ)(x) = cf(x)
# 
# be watchful of domains when performing operations
# - since D(ƒ) = [-1, ∞) and D(g) = (-∞, 0)∪(0,∞),
# therefore we have
# D(ƒ + g) = D(ƒ - g) = D(ƒ * g)= [-1, 0)∪(0,∞)
# and
# D(ƒ / g)= [-1, 0)∪(0, 1)∪(1, ∞)
# note g(0) is not defined
# 
# There is another method, called composition,
# by which functions can be combined to form new functions
# 
# Composition of Functions:
# - the composition of two functions ƒ and g is another function,
# denoted ƒ ⚬ g(x) = ƒ(g(x))
# for every x for which ƒ(g(x)) makes sense.
# Thus D(ƒ ⚬ g) consists of all numbers
# x in D(g) such that g(x) is in D(ƒ)
text_tag_3d_81 = TextTag3D(Location=end_points_63.End, Text="     y    ", Size=".12", Justification=6)
text_tag_3d_82 = TextTag3D(Location=point_on_curve_30, Text=panel_68, Size=".12", Justification=7)
text_tag_3d_83 = TextTag3D(Location=construct_point_147, Text="Sqrt(x)     ", Size=".12", Justification=6)
text_tag_3d_84 = TextTag3D(Location=construct_point_148, Text="x", Size=".12", Justification=7)

# ----
# more complicated functions have serious drawbacks
# when having to complete laborious computations
# "reasonable curves"
# ƒ(x) = x^(2/3)
number_slider_60 = Slider(0.001, range=0.001..4)
# By using a scientific calculator
# we can calculate approx values
# If we plot these values and try to draw a curve through them
# we may miss the cusp
# (an infinitely sharp point) at the origin
# Usless we calculate near x = 0
# we would likely miss a very important feature
# By using calculus we will not miss these features
# and without having to calculate many coordinates
number_slider_61 = Slider(4, range=0..4)
negative_26 = Negative(Value=number_slider_61)
negative_27 = Negative(Value=number_slider_60)
construct_domain_35 = ConstructDomain(DomainStart=negative_26, DomainEnd=negative_27)
construct_domain_36 = ConstructDomain(DomainStart=number_slider_60, DomainEnd=number_slider_61)
number_slider_62 = Slider(28, range=0..100)
A_7 = Slider(0.1, range=0..0.1)
range_35 = Range(Domain=construct_domain_35, Steps=number_slider_62)
range_36 = Range(Domain=construct_domain_36, Steps=number_slider_62)
construct_point_149 = ConstructPoint(XCoordinate=range_36, YCoordinate=0, ZCoordinate=0)
interpolate_90 = Interpolate(Vertices=construct_point_149, Degree=3, Periodic=False, KnotStyle=1)  # -> Curve, Length, Domain
curve_middle_30 = CurveMiddle(Curve=interpolate_90.Curve)
end_points_64 = EndPoints(Curve=interpolate_90.Curve)  # -> Start, End
text_tag_3d_85 = TextTag3D(Location=end_points_64.End, Text="x", Size=".12", Justification=7)

expression_30 = Expression(x=cull_index, A="1", B=Slider(0, range=0..10), Expression="A*(x/abs(x)) + B")
panel_70 = Panel("""    
     y = x/|x|""")

expression_31 = Expression(x=range_36, A="1", B=Slider(0, range=0..10), Expression="A*(x^(2/3)) + B")
reverse_list = ReverseList(List=range_35)
panel_71 = Panel("""    
     ƒ(x) = x^(2/3)""")

construct_point_150 = ConstructPoint(XCoordinate=cull_index, YCoordinate=expression_30, ZCoordinate=0)
interpolate_91 = Interpolate(Vertices=construct_point_150, Degree=3, Periodic=False, KnotStyle=1)  # -> Curve, Length, Domain
construct_point_151 = ConstructPoint(XCoordinate=0, YCoordinate=expression_30, ZCoordinate=0)
interpolate_92 = Interpolate(Vertices=construct_point_151, Degree=3, Periodic=False, KnotStyle=1)  # -> Curve, Length, Domain
point_on_curve_31 = PointOnCurve(interpolate_91.Curve, parameter=0.523)
end_points_65 = EndPoints(Curve=interpolate_91.Curve)  # -> Start, End
end_points_66 = EndPoints(Curve=interpolate_92.Curve)  # -> Start, End
deconstruct_29 = Deconstruct(Point=graft(point_on_curve_31))  # -> XComponent, YComponent, ZComponent
panel_72 = Panel(point_on_curve_31)
construct_point_152 = ConstructPoint(XCoordinate=0, YCoordinate=deconstruct_29.YComponent, ZCoordinate=0)
construct_point_153 = ConstructPoint(XCoordinate=deconstruct_29.XComponent, YCoordinate=0, ZCoordinate=0)
line_77 = Line(StartPoint=construct_point_152, EndPoint=point_on_curve_31)
line_78 = Line(StartPoint=construct_point_153, EndPoint=point_on_curve_31)
line_79 = Line(StartPoint=end_points_60.Start, EndPoint=end_points_65.Start)
line_80 = Line(StartPoint=end_points_66.Start, EndPoint=end_points_65.Start)
line_81 = Line(StartPoint=end_points_60.End, EndPoint=end_points_65.End)
line_82 = Line(StartPoint=end_points_66.End, EndPoint=end_points_65.End)
offset_curve_26 = OffsetCurve(Curve=interpolate_91.Curve, Plane=PlaneXY(0, 0, 0), Distance=".06", BothSides=False, Kinks=0, CapType=1)
boundary_surfaces_27 = BoundarySurfaces(Edges=offset_curve_26)
text_tag_3d_86 = TextTag3D(Location=end_points_66.End, Text="     y    ", Size=".12", Justification=6)
text_tag_3d_87 = TextTag3D(Location=point_on_curve_31, Text=panel_70, Size=".12", Justification=7)
text_tag_3d_88 = TextTag3D(Location=construct_point_152, Text="x/|x|      ", Size=".12", Justification=6)
text_tag_3d_89 = TextTag3D(Location=construct_point_153, Text="x", Size=".12", Justification=7)

curve_23 = Curve(interpolate_91.Curve)
dispatch = Dispatch(List=flatten(curve_23), DispatchPattern=[True, False])  # -> ListA, ListB
end_points_67 = EndPoints(Curve=dispatch.ListA)  # -> Start, End
end_points_68 = EndPoints(Curve=dispatch.ListB)  # -> Start, End

circle_3 = Circle(Plane=end_points_68.Start, Radius=".12")
circle_4 = Circle(Plane=end_points_67.Start, Radius=".12")

construct_point_154 = ConstructPoint(XCoordinate=range_36, YCoordinate=expression_31, ZCoordinate=0)
construct_point_155 = ConstructPoint(XCoordinate=reverse_list, YCoordinate=expression_31, ZCoordinate=0)
interpolate_93 = Interpolate(Vertices=construct_point_155, Degree=3, Periodic=False, KnotStyle=1)  # -> Curve, Length, Domain
interpolate_94 = Interpolate(Vertices=construct_point_154, Degree=3, Periodic=False, KnotStyle=1)  # -> Curve, Length, Domain
construct_point_156 = ConstructPoint(XCoordinate=0, YCoordinate=expression_31, ZCoordinate=0)
interpolate_95 = Interpolate(Vertices=construct_point_156, Degree=3, Periodic=False, KnotStyle=1)  # -> Curve, Length, Domain
point_on_curve_32 = PointOnCurve(interpolate_94.Curve, parameter=0.523)
end_points_69 = EndPoints(Curve=interpolate_94.Curve)  # -> Start, End
end_points_70 = EndPoints(Curve=interpolate_95.Curve)  # -> Start, End
deconstruct_30 = Deconstruct(Point=graft(point_on_curve_32))  # -> XComponent, YComponent, ZComponent
panel_73 = Panel(point_on_curve_32)
construct_point_157 = ConstructPoint(XCoordinate=0, YCoordinate=deconstruct_30.YComponent, ZCoordinate=0)
construct_point_158 = ConstructPoint(XCoordinate=deconstruct_30.XComponent, YCoordinate=0, ZCoordinate=0)
line_83 = Line(StartPoint=construct_point_157, EndPoint=point_on_curve_32)
line_84 = Line(StartPoint=construct_point_158, EndPoint=point_on_curve_32)
line_85 = Line(StartPoint=end_points_64.Start, EndPoint=end_points_69.Start)
line_86 = Line(StartPoint=end_points_70.Start, EndPoint=end_points_69.Start)
line_87 = Line(StartPoint=end_points_64.End, EndPoint=end_points_69.End)
line_88 = Line(StartPoint=end_points_70.End, EndPoint=end_points_69.End)
offset_curve_27 = OffsetCurve(
    Curve=[interpolate_93.Curve, interpolate_94.Curve],
    Plane=PlaneXY(0, 0, 0),
    Distance=".03",
    BothSides=Toggle(True),
    Kinks=0,
    CapType=1)
boundary_surfaces_28 = BoundarySurfaces(Edges=offset_curve_27)
text_tag_3d_90 = TextTag3D(Location=end_points_70.End, Text="     y    ", Size=".12", Justification=6)
text_tag_3d_91 = TextTag3D(Location=point_on_curve_32, Text=panel_71, Size=".12", Justification=7)
text_tag_3d_92 = TextTag3D(Location=construct_point_157, Text="x^(2/3)", Size=".12", Justification=6)
text_tag_3d_93 = TextTag3D(Location=construct_point_158, Text="x", Size=".12", Justification=7)

curve_24 = Curve([interpolate_93.Curve, interpolate_94.Curve])
dispatch_2 = Dispatch(List=flatten(curve_24), DispatchPattern=[True, False])  # -> ListA, ListB
end_points_71 = EndPoints(Curve=dispatch_2.ListA)  # -> Start, End
end_points_72 = EndPoints(Curve=dispatch_2.ListB)  # -> Start, End

circle_5 = Circle(Plane=end_points_72.Start, Radius=".12")
circle_6 = Circle(Plane=end_points_71.Start, Radius=".12")

# ----
# ƒ ◦ g(x) = ƒ(g(x)) = Sqrt(g(x) = Sqrt(x + 1)
# D(ƒ ◦ g) = [-1, ∞)
number_slider_63 = Slider(4, range=0..4)
# ƒ(x) = Sqrt(x) and g(x) = x + 1
# we can calculate the following compositions:
panel_74 = Panel("-1")
construct_domain_37 = ConstructDomain(DomainStart=panel_74, DomainEnd=number_slider_63)
A_8 = Slider(0.1, range=0..0.1)
number_slider_64 = Slider(0, range=-5..5)
range_37 = Range(Domain=construct_domain_37, Steps=Slider(100, range=0..100))
panel_75 = Panel("1")
construct_point_159 = ConstructPoint(XCoordinate=range_37, YCoordinate=0, ZCoordinate=0)
interpolate_96 = Interpolate(Vertices=construct_point_159, Degree=3, Periodic=False, KnotStyle=1)  # -> Curve, Length, Domain
curve_middle_31 = CurveMiddle(Curve=interpolate_96.Curve)
end_points_73 = EndPoints(Curve=interpolate_96.Curve)  # -> Start, End
text_tag_3d_94 = TextTag3D(Location=end_points_73.End, Text="x", Size=".12", Justification=7)

# ----
# ƒ ◦ ƒ(x) = ƒ(ƒ(x)) = Sqrt(ƒ(x)) = Sqrt(Sqrt(x)) = x^(1/4)
# D(ƒ ◦ ƒ) = [0, ∞)
number_slider_65 = Slider(4, range=0..4)
construct_domain_38 = ConstructDomain(DomainStart="-1", DomainEnd=number_slider_65)
A_9 = Slider(0.1, range=0..0.1)
number_slider_66 = Slider(0, range=-5..5)
range_38 = Range(Domain=construct_domain_38, Steps=Slider(100, range=0..100))
construct_point_160 = ConstructPoint(XCoordinate=range_38, YCoordinate=0, ZCoordinate=0)
interpolate_97 = Interpolate(Vertices=construct_point_160, Degree=3, Periodic=False, KnotStyle=1)  # -> Curve, Length, Domain
curve_middle_32 = CurveMiddle(Curve=interpolate_97.Curve)
end_points_74 = EndPoints(Curve=interpolate_97.Curve)  # -> Start, End
text_tag_3d_95 = TextTag3D(Location=end_points_74.End, Text="x", Size=".12", Justification=7)

# ----
# g ◦ g(x) = g(g(x)) = g(x) + 1 = (x + 1) + 1 = x + 2
# D(g ◦ g) = IR
number_slider_67 = Slider(4, range=0..4)
panel_77 = Panel("-1")
A_10 = Slider(0.1, range=0..0.1)
number_slider_68 = Slider(0, range=-5..5)

negative_28 = Negative(Value=number_slider_67)

# ----
# g ◦ ƒ  ◦ g(x) = g(ƒ(g(x))) = ƒ(g(x)) + 1 = Sqrt(x + 1) + 1
# D(g ◦ ƒ  ◦ g(x)) = (-1, ∞)
number_slider_69 = Slider(4, range=0..4)
construct_domain_39 = ConstructDomain(DomainStart="-1", DomainEnd=number_slider_69)
A_11 = Slider(0.1, range=0..0.1)
number_slider_70 = Slider(0, range=-5..5)
range_39 = Range(Domain=construct_domain_39, Steps=Slider(100, range=0..100))
construct_point_161 = ConstructPoint(XCoordinate=range_39, YCoordinate=0, ZCoordinate=0)
interpolate_98 = Interpolate(Vertices=construct_point_161, Degree=3, Periodic=False, KnotStyle=1)  # -> Curve, Length, Domain
curve_middle_33 = CurveMiddle(Curve=interpolate_98.Curve)
end_points_75 = EndPoints(Curve=interpolate_98.Curve)  # -> Start, End
text_tag_3d_96 = TextTag3D(Location=end_points_75.End, Text="x", Size=".12", Justification=7)

# ----
# g ◦ ƒ(x) = g(ƒ(x)) = ƒ(x) + 1 = Sqrt(x) + 1
# D(g ◦ ƒ) = [0, ∞)
number_slider_71 = Slider(4, range=0..4)
construct_domain_40 = ConstructDomain(DomainStart="0", DomainEnd=number_slider_71)
A_12 = Slider(0.1, range=0..0.1)
number_slider_72 = Slider(0, range=-5..5)
range_40 = Range(Domain=construct_domain_40, Steps=Slider(100, range=0..100))
construct_point_162 = ConstructPoint(XCoordinate=range_40, YCoordinate=0, ZCoordinate=0)
interpolate_99 = Interpolate(Vertices=construct_point_162, Degree=3, Periodic=False, KnotStyle=1)  # -> Curve, Length, Domain
curve_middle_34 = CurveMiddle(Curve=interpolate_99.Curve)
end_points_76 = EndPoints(Curve=interpolate_99.Curve)  # -> Start, End
text_tag_3d_97 = TextTag3D(Location=end_points_76.End, Text="x", Size=".12", Justification=7)

construct_domain_41 = ConstructDomain(DomainStart=negative_28, DomainEnd=number_slider_67)
range_41 = Range(Domain=construct_domain_41, Steps=Slider(100, range=0..100))
construct_point_163 = ConstructPoint(XCoordinate=range_41, YCoordinate=0, ZCoordinate=0)
interpolate_100 = Interpolate(Vertices=construct_point_163, Degree=3, Periodic=False, KnotStyle=1)  # -> Curve, Length, Domain
curve_middle_35 = CurveMiddle(Curve=interpolate_100.Curve)
end_points_77 = EndPoints(Curve=interpolate_100.Curve)  # -> Start, End
text_tag_3d_98 = TextTag3D(Location=end_points_77.End, Text="x", Size=".12", Justification=7)

expression_32 = Expression(x=range_41, A=Slider(1, range=0..10), Expression="A * (x + 2)")
curve_25 = Curve()
dispatch_3 = Dispatch(List=flatten(curve_25), DispatchPattern=[True, False])  # -> ListA, ListB
end_points_78 = EndPoints(Curve=dispatch_3.ListA)  # -> Start, End
end_points_79 = EndPoints(Curve=dispatch_3.ListB)  # -> Start, End
panel_81 = Panel("""    
     g ◦ g(x) = A * (x + 2)""")

construct_point_164 = ConstructPoint(XCoordinate=range_41, YCoordinate=expression_32, ZCoordinate=0)
interpolate_101 = Interpolate(Vertices=construct_point_164, Degree=3, Periodic=False, KnotStyle=1)  # -> Curve, Length, Domain
construct_point_165 = ConstructPoint(XCoordinate=0, YCoordinate=expression_32, ZCoordinate=0)
interpolate_102 = Interpolate(Vertices=construct_point_165, Degree=3, Periodic=False, KnotStyle=1)  # -> Curve, Length, Domain
point_on_curve_33 = PointOnCurve(interpolate_101.Curve, parameter=0.711)
end_points_80 = EndPoints(Curve=interpolate_101.Curve)  # -> Start, End
end_points_81 = EndPoints(Curve=interpolate_102.Curve)  # -> Start, End
deconstruct_31 = Deconstruct(Point=graft(point_on_curve_33))  # -> XComponent, YComponent, ZComponent
panel_82 = Panel(point_on_curve_33)
construct_point_166 = ConstructPoint(XCoordinate=0, YCoordinate=deconstruct_31.YComponent, ZCoordinate=0)
construct_point_167 = ConstructPoint(XCoordinate=deconstruct_31.XComponent, YCoordinate=0, ZCoordinate=0)
line_89 = Line(StartPoint=construct_point_166, EndPoint=point_on_curve_33)
line_90 = Line(StartPoint=construct_point_167, EndPoint=point_on_curve_33)
line_91 = Line(StartPoint=end_points_77.Start, EndPoint=end_points_80.Start)
line_92 = Line(StartPoint=end_points_81.Start, EndPoint=end_points_80.Start)
line_93 = Line(StartPoint=end_points_77.End, EndPoint=end_points_80.End)
line_94 = Line(StartPoint=end_points_81.End, EndPoint=end_points_80.End)
offset_curve_28 = OffsetCurve(Curve=interpolate_101.Curve, Plane=PlaneXY(0, 0, 0), Distance=".03", BothSides=Toggle(True), Kinks=0, CapType=1)
boundary_surfaces_29 = BoundarySurfaces(Edges=offset_curve_28)
circle_7 = Circle(Plane=end_points_79.Start, Radius=".12")
text_tag_3d_99 = TextTag3D(Location=end_points_81.End, Text="     y    ", Size=".12", Justification=6)
text_tag_3d_100 = TextTag3D(Location=point_on_curve_33, Text=panel_81, Size=".12", Justification=7)
text_tag_3d_101 = TextTag3D(Location=construct_point_166, Text="A * (x + 2)", Size=".12", Justification=6)
text_tag_3d_102 = TextTag3D(Location=construct_point_167, Text="x", Size=".12", Justification=7)
circle_8 = Circle(Plane=end_points_78.Start, Radius=".12")

expression_33 = Expression(x=range_37, A=Slider(1, range=0..10), Expression="A * (Sqrt(x + 1))")
panel_83 = Panel("""    
     ƒ ◦ g(x) = A * (Sqrt(x + 1))""")

expression_34 = Expression(x=range_38, A=Slider(1, range=0..10), Expression="A * (Sqrt(Sqrt(x)))")
dispatch_4 = Dispatch(DispatchPattern=[True, False])  # -> ListA, ListB
end_points_82 = EndPoints(Curve=dispatch_4.ListB)  # -> Start, End
panel_84 = Panel("""    
     ƒ ◦ ƒ(x) = A * (x^(1/4))""")

expression_35 = Expression(x=range_40, A=Slider(0.64, range=0..10), Expression="A * (Sqrt(x) + 1)")
dispatch_5 = Dispatch(DispatchPattern=[True, False])  # -> ListA, ListB
end_points_83 = EndPoints(Curve=dispatch_5.ListB)  # -> Start, End
panel_85 = Panel("""    
     g ◦ ƒ(x) = A * (Sqrt(x) + 1)""")

expression_36 = Expression(x=range_39, A=Slider(1, range=0..10), Expression="A * (Sqrt(x + 1) + 1)")
panel_86 = Panel("""    
     g ◦ f ◦ g(x) = A * (Sqrt(x + 1) + 1)""")

construct_point_168 = ConstructPoint(XCoordinate=range_37, YCoordinate=expression_33, ZCoordinate=0)
interpolate_103 = Interpolate(Vertices=construct_point_168, Degree=3, Periodic=False, KnotStyle=1)  # -> Curve, Length, Domain
construct_point_169 = ConstructPoint(XCoordinate=0, YCoordinate=expression_33, ZCoordinate=0)
interpolate_104 = Interpolate(Vertices=construct_point_169, Degree=3, Periodic=False, KnotStyle=1)  # -> Curve, Length, Domain
point_on_curve_34 = PointOnCurve(interpolate_103.Curve, parameter=1)
end_points_84 = EndPoints(Curve=interpolate_103.Curve)  # -> Start, End
end_points_85 = EndPoints(Curve=interpolate_104.Curve)  # -> Start, End
deconstruct_32 = Deconstruct(Point=graft(point_on_curve_34))  # -> XComponent, YComponent, ZComponent
panel_87 = Panel(point_on_curve_34)
construct_point_170 = ConstructPoint(XCoordinate=0, YCoordinate=deconstruct_32.YComponent, ZCoordinate=0)
construct_point_171 = ConstructPoint(XCoordinate=deconstruct_32.XComponent, YCoordinate=0, ZCoordinate=0)
line_95 = Line(StartPoint=construct_point_170, EndPoint=point_on_curve_34)
line_96 = Line(StartPoint=construct_point_171, EndPoint=point_on_curve_34)
line_97 = Line(StartPoint=end_points_73.Start, EndPoint=end_points_84.Start)
line_98 = Line(StartPoint=end_points_85.Start, EndPoint=end_points_84.Start)
line_99 = Line(StartPoint=end_points_73.End, EndPoint=end_points_84.End)
line_100 = Line(StartPoint=end_points_85.End, EndPoint=end_points_84.End)
offset_curve_29 = OffsetCurve(Curve=interpolate_103.Curve, Plane=PlaneXY(0, 0, 0), Distance=".03", BothSides=Toggle(True), Kinks=0, CapType=1)
boundary_surfaces_30 = BoundarySurfaces(Edges=offset_curve_29)
text_tag_3d_103 = TextTag3D(Location=end_points_85.End, Text="     y    ", Size=".12", Justification=6)
text_tag_3d_104 = TextTag3D(Location=point_on_curve_34, Text=panel_83, Size=".12", Justification=7)
text_tag_3d_105 = TextTag3D(Location=construct_point_170, Text="A * (Sqrt(x + 1))", Size=".12", Justification=6)
text_tag_3d_106 = TextTag3D(Location=construct_point_171, Text="x", Size=".12", Justification=7)

curve_26 = Curve(interpolate_103.Curve)
dispatch_6 = Dispatch(List=flatten(curve_26), DispatchPattern=[True, False])  # -> ListA, ListB
end_points_86 = EndPoints(Curve=dispatch_6.ListB)  # -> Start, End
end_points_87 = EndPoints(Curve=curve_26)  # -> Start, End

circle_9 = Circle(Plane=end_points_86.Start, Radius=".12")
circle_10 = Circle(Plane=end_points_87.Start, Radius=".12")
# if H(x) = (1 - x)/(1 + x)
# calculate H ◦ H(x) and specify its domain
# 
# H ◦ H(x) = (1 - H(x))/(1 + H(x)) =
# 
# (1 - ((1 - x)/(1 + x)) / (1 + ((1 - x)/(1 + x))) =
# 
# (1 + x - 1 + x)/(1 + x + 1 - x) = x,
# 
# forvided that x != -1
# the domain of H ◦ H(x) is
# (-∞, -1) U (-1, ∞) because H(x) is not
# defined for x = -1, neither is H(H(x))
boundary_surfaces_31 = BoundarySurfaces(Edges=circle_10)

construct_point_172 = ConstructPoint(XCoordinate=range_40, YCoordinate=expression_35, ZCoordinate=0)
interpolate_105 = Interpolate(Vertices=construct_point_172, Degree=3, Periodic=False, KnotStyle=1)  # -> Curve, Length, Domain
construct_point_173 = ConstructPoint(XCoordinate=0, YCoordinate=expression_35, ZCoordinate=0)
interpolate_106 = Interpolate(Vertices=construct_point_173, Degree=3, Periodic=False, KnotStyle=1)  # -> Curve, Length, Domain
point_on_curve_35 = PointOnCurve(interpolate_105.Curve, parameter=1)
end_points_88 = EndPoints(Curve=interpolate_105.Curve)  # -> Start, End
end_points_89 = EndPoints(Curve=interpolate_106.Curve)  # -> Start, End
deconstruct_33 = Deconstruct(Point=graft(point_on_curve_35))  # -> XComponent, YComponent, ZComponent
panel_88 = Panel(point_on_curve_35)
construct_point_174 = ConstructPoint(XCoordinate=0, YCoordinate=deconstruct_33.YComponent, ZCoordinate=0)
construct_point_175 = ConstructPoint(XCoordinate=deconstruct_33.XComponent, YCoordinate=0, ZCoordinate=0)
line_101 = Line(StartPoint=construct_point_174, EndPoint=point_on_curve_35)
line_102 = Line(StartPoint=construct_point_175, EndPoint=point_on_curve_35)
line_103 = Line(StartPoint=end_points_76.Start, EndPoint=end_points_88.Start)
line_104 = Line(StartPoint=end_points_89.Start, EndPoint=end_points_88.Start)
line_105 = Line(StartPoint=end_points_76.End, EndPoint=end_points_88.End)
line_106 = Line(StartPoint=end_points_89.End, EndPoint=end_points_88.End)
circle_11 = Circle(Plane=end_points_83.Start, Radius=".12")
offset_curve_30 = OffsetCurve(Curve=interpolate_105.Curve, Plane=PlaneXY(0, 0, 0), Distance=".03", BothSides=Toggle(True), Kinks=0, CapType=1)
boundary_surfaces_32 = BoundarySurfaces(Edges=offset_curve_30)
text_tag_3d_107 = TextTag3D(Location=end_points_89.End, Text="     y    ", Size=".12", Justification=6)
text_tag_3d_108 = TextTag3D(Location=point_on_curve_35, Text=panel_85, Size=".12", Justification=7)
text_tag_3d_109 = TextTag3D(Location=construct_point_174, Text="A * (Sqrt(x) + 1)", Size=".12", Justification=6)
text_tag_3d_110 = TextTag3D(Location=construct_point_175, Text="x", Size=".12", Justification=7)

curve_27 = Curve(interpolate_105.Curve)
end_points_90 = EndPoints(Curve=curve_27)  # -> Start, End

circle_12 = Circle(Plane=end_points_90.Start, Radius=".12")
boundary_surfaces_33 = BoundarySurfaces(Edges=circle_12)

construct_point_176 = ConstructPoint(XCoordinate=range_38, YCoordinate=expression_34, ZCoordinate=0)
interpolate_107 = Interpolate(Vertices=construct_point_176, Degree=3, Periodic=False, KnotStyle=1)  # -> Curve, Length, Domain
construct_point_177 = ConstructPoint(XCoordinate=0, YCoordinate=expression_34, ZCoordinate=0)
interpolate_108 = Interpolate(Vertices=construct_point_177, Degree=3, Periodic=False, KnotStyle=1)  # -> Curve, Length, Domain
point_on_curve_36 = PointOnCurve(interpolate_107.Curve, parameter=0.596)
end_points_91 = EndPoints(Curve=interpolate_107.Curve)  # -> Start, End
end_points_92 = EndPoints(Curve=interpolate_108.Curve)  # -> Start, End
deconstruct_34 = Deconstruct(Point=graft(point_on_curve_36))  # -> XComponent, YComponent, ZComponent
panel_89 = Panel(point_on_curve_36)
construct_point_178 = ConstructPoint(XCoordinate=0, YCoordinate=deconstruct_34.YComponent, ZCoordinate=0)
construct_point_179 = ConstructPoint(XCoordinate=deconstruct_34.XComponent, YCoordinate=0, ZCoordinate=0)
line_107 = Line(StartPoint=construct_point_178, EndPoint=point_on_curve_36)
line_108 = Line(StartPoint=construct_point_179, EndPoint=point_on_curve_36)
line_109 = Line(StartPoint=end_points_74.Start, EndPoint=end_points_91.Start)
line_110 = Line(StartPoint=end_points_92.Start, EndPoint=end_points_91.Start)
line_111 = Line(StartPoint=end_points_74.End, EndPoint=end_points_91.End)
line_112 = Line(StartPoint=end_points_92.End, EndPoint=end_points_91.End)
circle_13 = Circle(Plane=end_points_82.Start, Radius=".12")
offset_curve_31 = OffsetCurve(Curve=interpolate_107.Curve, Plane=PlaneXY(0, 0, 0), Distance=".03", BothSides=Toggle(True), Kinks=0, CapType=1)
# Odd and Even Functions:
# - graphs of a function will have certain kinds of symetry
# - the simplest kind  relates the value of
# ƒ at -1 to its value at x
# 
# Suppose that -x belongs to D(ƒ)
# we say that ƒ is an odd function if
# ƒ(-x) = -ƒ(x) for every x in D(ƒ)
# we say that ƒ is an even function if
# ƒ(-x) = ƒ(x) for every x in D(ƒ)
# 
# Odd powers of x such as x, x^3, x^5,...,x^(-1), x^(-3),... are odd functions
# even powers are even functions
# The absolute value function |x| is an even function
# any function which depends only on x^2
# is an even function of x
# 
# Note:
# the graph of an odd function is symetric about the origin
# a line drawn from any point on the graph
# passing through the origin will come to
# another point on the graph
# 
# the graph of an even functon is symetric about the y-axis
# a perpendicular line drawn from any point
# on the graph perpendicular to the y-axis will continue the same distance to another
# point on the graph
# 
# Note that an odd function defined at x = 0
# must vanish (=0) there
# because f(0) = f(-0) = -f(0) implies
# 2ƒ(0) = 0, and so ƒ(0) = 0
boundary_surfaces_34 = BoundarySurfaces(Edges=offset_curve_31)
text_tag_3d_111 = TextTag3D(Location=end_points_92.End, Text="     y    ", Size=".12", Justification=6)
text_tag_3d_112 = TextTag3D(Location=point_on_curve_36, Text=panel_84, Size=".12", Justification=7)
text_tag_3d_113 = TextTag3D(Location=construct_point_178, Text="A * ((Sqrt(Sqrt(x)))", Size=".12", Justification=6)
text_tag_3d_114 = TextTag3D(Location=construct_point_179, Text="x", Size=".12", Justification=7)

curve_28 = Curve(interpolate_107.Curve)
end_points_93 = EndPoints(Curve=curve_28)  # -> Start, End

circle_14 = Circle(Plane=end_points_93.Start, Radius=".12")
boundary_surfaces_35 = BoundarySurfaces(Edges=circle_14)

construct_point_180 = ConstructPoint(XCoordinate=range_39, YCoordinate=expression_36, ZCoordinate=0)
interpolate_109 = Interpolate(Vertices=construct_point_180, Degree=3, Periodic=False, KnotStyle=1)  # -> Curve, Length, Domain
construct_point_181 = ConstructPoint(XCoordinate=0, YCoordinate=expression_36, ZCoordinate=0)
interpolate_110 = Interpolate(Vertices=construct_point_181, Degree=3, Periodic=False, KnotStyle=1)  # -> Curve, Length, Domain
point_on_curve_37 = PointOnCurve(interpolate_109.Curve, parameter=0.862)
end_points_94 = EndPoints(Curve=interpolate_109.Curve)  # -> Start, End
end_points_95 = EndPoints(Curve=interpolate_110.Curve)  # -> Start, End
deconstruct_35 = Deconstruct(Point=graft(point_on_curve_37))  # -> XComponent, YComponent, ZComponent
panel_90 = Panel(point_on_curve_37)
construct_point_182 = ConstructPoint(XCoordinate=0, YCoordinate=deconstruct_35.YComponent, ZCoordinate=0)
construct_point_183 = ConstructPoint(XCoordinate=deconstruct_35.XComponent, YCoordinate=0, ZCoordinate=0)
line_113 = Line(StartPoint=construct_point_182, EndPoint=point_on_curve_37)
line_114 = Line(StartPoint=construct_point_183, EndPoint=point_on_curve_37)
line_115 = Line(StartPoint=end_points_75.Start, EndPoint=end_points_94.Start)
line_116 = Line(StartPoint=end_points_95.Start, EndPoint=end_points_94.Start)
line_117 = Line(StartPoint=end_points_75.End, EndPoint=end_points_94.End)
line_118 = Line(StartPoint=end_points_95.End, EndPoint=end_points_94.End)
offset_curve_32 = OffsetCurve(Curve=interpolate_109.Curve, Plane=PlaneXY(0, 0, 0), Distance=".03", BothSides=Toggle(True), Kinks=0, CapType=1)
boundary_surfaces_36 = BoundarySurfaces(Edges=offset_curve_32)
text_tag_3d_115 = TextTag3D(Location=end_points_95.End, Text="     y    ", Size=".12", Justification=6)
text_tag_3d_116 = TextTag3D(Location=point_on_curve_37, Text=panel_86, Size=".12", Justification=7)
text_tag_3d_117 = TextTag3D(Location=construct_point_182, Text="A * (Sqrt(x + 1) + 1)", Size=".12", Justification=6)
text_tag_3d_118 = TextTag3D(Location=construct_point_183, Text="x", Size=".12", Justification=7)

curve_29 = Curve(interpolate_109.Curve)
dispatch_7 = Dispatch(List=flatten(curve_29), DispatchPattern=[True, False])  # -> ListA, ListB
end_points_96 = EndPoints(Curve=curve_29)  # -> Start, End
end_points_97 = EndPoints(Curve=dispatch_7.ListB)  # -> Start, End

circle_15 = Circle(Plane=end_points_97.Start, Radius=".12")
circle_16 = Circle(Plane=end_points_96.Start, Radius=".12")

# ----
# ƒ ◦ g(x) = ƒ(g(x)) = Sqrt(g(x) = Sqrt(x + 1)
# D(ƒ ◦ g) = [-1, ∞)
number_slider_73 = Slider(4, range=0..4)
number_slider_74 = Slider(1.934, range=-5..5)
negative_29 = Negative(Value=number_slider_73)
construct_domain_42 = ConstructDomain(DomainStart=negative_29, DomainEnd=number_slider_74)
construct_domain_43 = ConstructDomain(DomainStart=number_slider_74, DomainEnd=number_slider_73)
number_slider_75 = Slider(100, range=0..100)
number_slider_76 = Slider(1, range=0..10)
range_42 = Range(Domain=construct_domain_43, Steps=number_slider_75)
range_43 = Range(Domain=construct_domain_42, Steps=number_slider_75)
construct_point_184 = ConstructPoint(XCoordinate=range_43, YCoordinate=0, ZCoordinate=0)
construct_point_185 = ConstructPoint(XCoordinate=range_42, YCoordinate=0, ZCoordinate=0)
interpolate_111 = Interpolate(Vertices=construct_point_184, Degree=3, Periodic=False, KnotStyle=1)  # -> Curve, Length, Domain
interpolate_112 = Interpolate(Vertices=construct_point_185, Degree=3, Periodic=False, KnotStyle=1)  # -> Curve, Length, Domain
curve_middle_36 = CurveMiddle(Curve=interpolate_111.Curve)
end_points_98 = EndPoints(Curve=interpolate_111.Curve)  # -> Start, End
curve_middle_37 = CurveMiddle(Curve=interpolate_112.Curve)
end_points_99 = EndPoints(Curve=interpolate_112.Curve)  # -> Start, End
text_tag_3d_119 = TextTag3D(Location=end_points_98.End, Text="x", Size=".12", Justification=7)
text_tag_3d_120 = TextTag3D(Location=end_points_99.End, Text="x", Size=".12", Justification=7)

expression_37 = Expression(x=range_43, A=number_slider_76, Expression="A * x")
expression_38 = Expression(x=range_42, A=number_slider_76, Expression="A * x")
panel_93 = Panel("""    
     H(x) = A * x""")
panel_94 = Panel("""    
     H(x) = A * x""")

construct_point_186 = ConstructPoint(XCoordinate=range_43, YCoordinate=expression_37, ZCoordinate=0)
construct_point_187 = ConstructPoint(XCoordinate=range_42, YCoordinate=expression_38, ZCoordinate=0)
interpolate_113 = Interpolate(Vertices=construct_point_186, Degree=3, Periodic=False, KnotStyle=1)  # -> Curve, Length, Domain
interpolate_114 = Interpolate(Vertices=construct_point_187, Degree=3, Periodic=False, KnotStyle=1)  # -> Curve, Length, Domain
construct_point_188 = ConstructPoint(XCoordinate=0, YCoordinate=expression_37, ZCoordinate=0)
construct_point_189 = ConstructPoint(XCoordinate=0, YCoordinate=expression_38, ZCoordinate=0)
interpolate_115 = Interpolate(Vertices=construct_point_188, Degree=3, Periodic=False, KnotStyle=1)  # -> Curve, Length, Domain
interpolate_116 = Interpolate(Vertices=construct_point_189, Degree=3, Periodic=False, KnotStyle=1)  # -> Curve, Length, Domain
point_on_curve_38 = PointOnCurve(interpolate_113.Curve, parameter=0.66)
point_on_curve_39 = PointOnCurve(interpolate_114.Curve, parameter=0.5)
end_points_100 = EndPoints(Curve=interpolate_113.Curve)  # -> Start, End
end_points_101 = EndPoints(Curve=interpolate_115.Curve)  # -> Start, End
end_points_102 = EndPoints(Curve=interpolate_114.Curve)  # -> Start, End
end_points_103 = EndPoints(Curve=interpolate_116.Curve)  # -> Start, End
deconstruct_36 = Deconstruct(Point=graft(point_on_curve_38))  # -> XComponent, YComponent, ZComponent
panel_95 = Panel(point_on_curve_38)
deconstruct_37 = Deconstruct(Point=graft(point_on_curve_39))  # -> XComponent, YComponent, ZComponent
panel_96 = Panel(point_on_curve_39)
construct_point_190 = ConstructPoint(XCoordinate=0, YCoordinate=deconstruct_36.YComponent, ZCoordinate=0)
construct_point_191 = ConstructPoint(XCoordinate=deconstruct_36.XComponent, YCoordinate=0, ZCoordinate=0)
construct_point_192 = ConstructPoint(XCoordinate=0, YCoordinate=deconstruct_37.YComponent, ZCoordinate=0)
construct_point_193 = ConstructPoint(XCoordinate=deconstruct_37.XComponent, YCoordinate=0, ZCoordinate=0)
line_119 = Line(StartPoint=construct_point_190, EndPoint=point_on_curve_38)
line_120 = Line(StartPoint=construct_point_191, EndPoint=point_on_curve_38)
line_121 = Line(StartPoint=end_points_98.Start, EndPoint=end_points_100.Start)
line_122 = Line(StartPoint=end_points_101.Start, EndPoint=end_points_100.Start)
line_123 = Line(StartPoint=end_points_98.End, EndPoint=end_points_100.End)
line_124 = Line(StartPoint=end_points_101.End, EndPoint=end_points_100.End)
line_125 = Line(StartPoint=construct_point_192, EndPoint=point_on_curve_39)
line_126 = Line(StartPoint=construct_point_193, EndPoint=point_on_curve_39)
line_127 = Line(StartPoint=end_points_99.Start, EndPoint=end_points_102.Start)
line_128 = Line(StartPoint=end_points_103.End, EndPoint=end_points_102.End)
line_129 = Line(StartPoint=end_points_103.Start, EndPoint=end_points_102.Start)
line_130 = Line(StartPoint=end_points_99.End, EndPoint=end_points_102.End)
offset_curve_33 = OffsetCurve(Curve=interpolate_113.Curve, Plane=PlaneXY(0, 0, 0), Distance=".03", BothSides=Toggle(True), Kinks=0, CapType=1)
offset_curve_34 = OffsetCurve(Curve=interpolate_114.Curve, Plane=PlaneXY(0, 0, 0), Distance=".03", BothSides=Toggle(True), Kinks=0, CapType=1)
boundary_surfaces_37 = BoundarySurfaces(Edges=offset_curve_33)
text_tag_3d_121 = TextTag3D(Location=end_points_101.End, Text="     y    ", Size=".12", Justification=6)
text_tag_3d_122 = TextTag3D(Location=point_on_curve_38, Text=panel_93, Size=".12", Justification=7)
text_tag_3d_123 = TextTag3D(Location=construct_point_190, Text="A * x", Size=".12", Justification=6)
text_tag_3d_124 = TextTag3D(Location=construct_point_191, Text="x", Size=".12", Justification=7)
boundary_surfaces_38 = BoundarySurfaces(Edges=offset_curve_34)
text_tag_3d_125 = TextTag3D(Location=end_points_103.End, Text="     y    ", Size=".12", Justification=6)
text_tag_3d_126 = TextTag3D(Location=point_on_curve_39, Text=panel_94, Size=".12", Justification=7)
text_tag_3d_127 = TextTag3D(Location=construct_point_192, Text="A * x", Size=".12", Justification=6)
text_tag_3d_128 = TextTag3D(Location=construct_point_193, Text="x", Size=".12", Justification=7)

curve_30 = Curve(interpolate_113.Curve)
dispatch_8 = Dispatch(List=flatten(curve_30), DispatchPattern=[True, False])  # -> ListA, ListB
curve_31 = Curve(interpolate_114.Curve)
dispatch_9 = Dispatch(List=flatten(curve_31), DispatchPattern=[True, False])  # -> ListA, ListB
end_points_104 = EndPoints(Curve=dispatch_8.ListB)  # -> Start, End
end_points_105 = EndPoints(Curve=curve_30)  # -> Start, End
end_points_106 = EndPoints(Curve=dispatch_9.ListB)  # -> Start, End
end_points_107 = EndPoints(Curve=curve_31)  # -> Start, End

circle_17 = Circle(Plane=end_points_104.Start, Radius=".12")
circle_18 = Circle(Plane=end_points_106.Start, Radius=".12")
circle_19 = Circle(Plane=end_points_105.End, Radius=".12")
circle_20 = Circle(Plane=end_points_107.Start, Radius=".12")

negative_30 = Negative(Value=Slider(4, range=0..4))

construct_domain_44 = ConstructDomain(DomainStart=negative_30, DomainEnd="2")
# ƒ(x) = Sqrt(2 - x)
range_44 = Range(Domain=construct_domain_44, Steps=Slider(24, range=0..100))

expression_39 = Expression(x=range_44, A=Slider(1, range=0..10), B=Slider(0, range=0..10), Expression="A * (Sqrt(2 - x))")
panel_97 = Panel("""A * (Sqrt(2 - x))
       """)

construct_point_194 = ConstructPoint(XCoordinate=range_44, YCoordinate=0, ZCoordinate=0)
construct_point_195 = ConstructPoint(XCoordinate=0, YCoordinate=range_44, ZCoordinate=0)
construct_point_196 = ConstructPoint(XCoordinate=range_44, YCoordinate=expression_39, ZCoordinate=0)
interpolate_117 = Interpolate(Vertices=construct_point_194, Degree=3, Periodic=False, KnotStyle=1)  # -> Curve, Length, Domain
interpolate_118 = Interpolate(Vertices=construct_point_195, Degree=3, Periodic=False, KnotStyle=1)  # -> Curve, Length, Domain
interpolate_119 = Interpolate(Vertices=construct_point_196, Degree=3, Periodic=False, KnotStyle=1)  # -> Curve, Length, Domain

curve_middle_38 = CurveMiddle(Curve=interpolate_117.Curve)
point_on_curve_40 = PointOnCurve(interpolate_119.Curve, parameter=0.229)
end_points_108 = EndPoints(Curve=interpolate_117.Curve)  # -> Start, End
end_points_109 = EndPoints(Curve=interpolate_118.Curve)  # -> Start, End
deconstruct_38 = Deconstruct(Point=point_on_curve_40)  # -> XComponent, YComponent, ZComponent
construct_point_197 = ConstructPoint(XCoordinate=0, YCoordinate=deconstruct_38.YComponent, ZCoordinate=0)
construct_point_198 = ConstructPoint(XCoordinate=deconstruct_38.XComponent, YCoordinate=0, ZCoordinate=0)

offset_curve_35 = OffsetCurve(Curve=interpolate_119.Curve, Plane=PlaneXY(0, 0, 0), Distance=".03", BothSides=Toggle(True), Kinks=0, CapType=1)
line_131 = Line(StartPoint=construct_point_198, EndPoint=point_on_curve_40)
boundary_surfaces_39 = BoundarySurfaces(Edges=offset_curve_35)
line_132 = Line(StartPoint=construct_point_197, EndPoint=point_on_curve_40)
curve_32 = Curve(interpolate_119.Curve)

concatenate_13 = Concatenate(FragmentA="      ƒ(x) = ", FragmentB=panel_97)
text_tag_3d_129 = TextTag3D(Location=point_on_curve_40, Text=concatenate_13, Size=".12", Justification=7)
text_tag_3d_130 = TextTag3D(Location=construct_point_197, Text=panel_97, Size=".12", Justification=1)
text_tag_3d_131 = TextTag3D(Location=construct_point_198, Text="x", Size=".12", Justification=7)
text_tag_3d_132 = TextTag3D(Location=curve_middle_38, Text="0         ", Size=".12", Justification=3)

text_tag_3d_133 = TextTag3D(Location=construct_point_38, Text="A * (2 - x)", Size=".12", Justification=1)
text_tag_3d_134 = TextTag3D(Location=end_points_8.End, Text="y    ", Size=".12", Justification=6)
text_tag_3d_135 = TextTag3D(Location=end_points_7.End, Text="x", Size=".12", Justification=7)
text_tag_3d_136 = TextTag3D(Location=construct_point_39, Text="x", Size=".12", Justification=7)
text_tag_3d_137 = TextTag3D(Location=curve_middle_4, Text="0         ", Size=".12", Justification=3)

concatenate_14 = Concatenate(FragmentA="      ƒ(x) = ", FragmentB="A * (2 - x)")

text_tag_3d_138 = TextTag3D(Location=point_on_curve_3, Text=concatenate_14, Size=".12", Justification=7)

panel_98 = Panel("""    
     ƒ(x) = """)
text_tag_3d_139 = TextTag3D(Location=construct_point_40, Text=panel_21, Size=".12", Justification=1)
text_tag_3d_140 = TextTag3D(Location=end_points_10.End, Text="y    ", Size=".12", Justification=6)
text_tag_3d_141 = TextTag3D(Location=end_points_9.End, Text="x", Size=".12", Justification=7)
text_tag_3d_142 = TextTag3D(Location=construct_point_41, Text="x", Size=".12", Justification=7)
text_tag_3d_143 = TextTag3D(Location=curve_middle_5, Text="0         ", Size=".12", Justification=3)

concatenate_15 = Concatenate(FragmentA=panel_98, FragmentB=panel_21)

text_tag_3d_144 = TextTag3D(Location=point_on_curve_4, Text=concatenate_15, Size=".12", Justification=7)

text_tag_3d_145 = TextTag3D(Location=construct_point_44, Text="A * (2 - x^2)", Size=".12", Justification=1)
text_tag_3d_146 = TextTag3D(Location=end_points_14.End, Text="y    ", Size=".12", Justification=6)
text_tag_3d_147 = TextTag3D(Location=end_points_13.End, Text="x", Size=".12", Justification=7)
text_tag_3d_148 = TextTag3D(Location=construct_point_45, Text="x", Size=".12", Justification=7)
text_tag_3d_149 = TextTag3D(Location=curve_middle_7, Text="0         ", Size=".12", Justification=3)

concatenate_16 = Concatenate(FragmentA="      ƒ(x) = ", FragmentB="A * (2 - x^2)")

text_tag_3d_150 = TextTag3D(Location=point_on_curve_6, Text=concatenate_16, Size=".12", Justification=7)

# ----
# watch for complex numbers
number_slider_77 = Slider(0.02, range=-4..4)
square_5 = Square(Value=number_slider_77)
subtraction_6 = Subtraction(A="4", B=square_5)
square_root_3 = SquareRoot(Value=subtraction_6)

division_2 = Division(A="1", B=square_root_3)

panel_99 = Panel(division_2)

panel_100 = Panel("""    
     ƒ(x) = """)
text_tag_3d_151 = TextTag3D(Location=construct_point_115, Text=panel_37, Size=".12", Justification=1)
text_tag_3d_152 = TextTag3D(Location=end_points_40.End, Text="y    ", Size=".12", Justification=6)
text_tag_3d_153 = TextTag3D(Location=end_points_39.End, Text="x", Size=".12", Justification=7)
text_tag_3d_154 = TextTag3D(Location=construct_point_116, Text="x", Size=".12", Justification=7)
text_tag_3d_155 = TextTag3D(Location=curve_middle_20, Text="0         ", Size=".12", Justification=3)

concatenate_17 = Concatenate(FragmentA=panel_100, FragmentB=panel_37)

text_tag_3d_156 = TextTag3D(Location=point_on_curve_19, Text=concatenate_17, Size=".12", Justification=7)

panel_101 = Panel("""    
     ƒ(x) = """)
text_tag_3d_157 = TextTag3D(Location=end_points_38.End, Text="y    ", Size=".12", Justification=6)
text_tag_3d_158 = TextTag3D(Location=end_points_37.End, Text="x", Size=".12", Justification=7)
text_tag_3d_159 = TextTag3D(Location=construct_point_114, Text="x", Size=".12", Justification=7)
text_tag_3d_160 = TextTag3D(Location=curve_middle_19, Text="0         ", Size=".12", Justification=3)

concatenate_18 = Concatenate(FragmentA=panel_101, FragmentB="   A * (abs(x) + abs(x - B))")

text_tag_3d_161 = TextTag3D(Location=point_on_curve_18, Text=concatenate_18, Size=".12", Justification=7)

panel_102 = Panel("""    
     ƒ(x) = """)
text_tag_3d_162 = TextTag3D(Location=construct_point_117, Text=panel_38, Size=".12", Justification=1)
text_tag_3d_163 = TextTag3D(Location=end_points_42.End, Text="y    ", Size=".12", Justification=6)
text_tag_3d_164 = TextTag3D(Location=end_points_41.End, Text="x", Size=".12", Justification=7)
text_tag_3d_165 = TextTag3D(Location=construct_point_118, Text="x", Size=".12", Justification=7)
text_tag_3d_166 = TextTag3D(Location=curve_middle_21, Text="0         ", Size=".12", Justification=3)

concatenate_19 = Concatenate(FragmentA=panel_102, FragmentB=panel_38)

text_tag_3d_167 = TextTag3D(Location=point_on_curve_20, Text=concatenate_19, Size=".12", Justification=7)

panel_103 = Panel("""    
     ƒ(x) = """)
text_tag_3d_168 = TextTag3D(Location=end_points_44.End, Text="y    ", Size=".12", Justification=6)
text_tag_3d_169 = TextTag3D(Location=end_points_43.End, Text="x", Size=".12", Justification=7)
text_tag_3d_170 = TextTag3D(Location=construct_point_120, Text="x", Size=".12", Justification=7)
text_tag_3d_171 = TextTag3D(Location=curve_middle_22, Text="0         ", Size=".12", Justification=3)

concatenate_20 = Concatenate(FragmentA=panel_103, FragmentB="   A * abs(x^2 - 1)")

text_tag_3d_172 = TextTag3D(Location=point_on_curve_21, Text=concatenate_20, Size=".12", Justification=7)

panel_104 = Panel("""    
     ƒ(x) = """)
text_tag_3d_173 = TextTag3D(Location=construct_point_121, Text=panel_40, Size=".12", Justification=1)
text_tag_3d_174 = TextTag3D(Location=end_points_46.End, Text="y    ", Size=".12", Justification=6)
text_tag_3d_175 = TextTag3D(Location=end_points_45.End, Text="x", Size=".12", Justification=7)
text_tag_3d_176 = TextTag3D(Location=construct_point_122, Text="x", Size=".12", Justification=7)
text_tag_3d_177 = TextTag3D(Location=curve_middle_23, Text="0         ", Size=".12", Justification=3)

concatenate_21 = Concatenate(FragmentA=panel_104, FragmentB=panel_40)

text_tag_3d_178 = TextTag3D(Location=point_on_curve_22, Text=concatenate_21, Size=".12", Justification=7)

panel_105 = Panel("""    
     ƒ(x) = """)
text_tag_3d_179 = TextTag3D(Location=construct_point_123, Text=panel_39, Size=".12", Justification=1)
text_tag_3d_180 = TextTag3D(Location=end_points_48.End, Text="y    ", Size=".12", Justification=6)
text_tag_3d_181 = TextTag3D(Location=end_points_47.End, Text="x", Size=".12", Justification=7)
text_tag_3d_182 = TextTag3D(Location=construct_point_124, Text="x", Size=".12", Justification=7)
text_tag_3d_183 = TextTag3D(Location=curve_middle_24, Text="0         ", Size=".12", Justification=3)

concatenate_22 = Concatenate(FragmentA=panel_105, FragmentB=panel_39)

text_tag_3d_184 = TextTag3D(Location=point_on_curve_23, Text=concatenate_22, Size=".12", Justification=7)

panel_106 = Panel("""    
     ƒ(x) = """)
text_tag_3d_185 = TextTag3D(Location=end_points_50.End, Text="y    ", Size=".12", Justification=6)
text_tag_3d_186 = TextTag3D(Location=end_points_49.End, Text="x", Size=".12", Justification=7)
text_tag_3d_187 = TextTag3D(Location=construct_point_126, Text="x", Size=".12", Justification=7)
text_tag_3d_188 = TextTag3D(Location=curve_middle_25, Text="0         ", Size=".12", Justification=3)

concatenate_23 = Concatenate(FragmentA=panel_106, FragmentB="   A * 1/(Sqrt(4 - x^2))")

text_tag_3d_189 = TextTag3D(Location=point_on_curve_24, Text=concatenate_23, Size=".12", Justification=7)
