# Grasshopper definition C#ScriptingForGrasshopperSamples_WS_001.gh (Grasshopper 1.0.7)
# Copyright: bernhard muller bijoutiers
# plug-ins: Workshop, Bifocals

# Essential Guide to C# Scripting
# inspired by: Rajaa Issa
wickerson_s_first_grasshopper_component = WickersonsFirstGrasshopperComponent()
# The Grasshopper C# Component
gene_pool = GenePool(
    Decimals=0,
    Maximum=100,
    Minimum=0,
    Value=[26.00110165, 58.48794848, 18.50926313, 22.38775521, 50.92372608, 5.508037985, 64.50332332, 87.46321243, 32.0196855, 36.53144456])
iseven_isodd_c_script = CSharpScript(num=gene_pool)  # -> out, IsEven, IsOdd; inputs num: Int32
# ---------- iseven_isodd_c_script: C# ----------
    int mod1 = num % 2;
    IsEven = (mod1 == 0 ? true : false);

    int mod2 = num % 2;
    IsOdd = (mod2 == 1 ? true : false);
# ---------- end iseven_isodd_c_script ----------
panel = Panel(gene_pool)
panel_2 = Panel(iseven_isodd_c_script.IsOdd)
panel_3 = Panel(iseven_isodd_c_script.IsEven)
# The Grasshopper C# Component
integer = Integer(iseven_isodd_c_script.IsOdd)
integer_2 = Integer(iseven_isodd_c_script.IsEven)
panel_4 = Panel(integer)
panel_5 = Panel(integer_2)
sphere = Sphere(Base=PlaneXY(0, 0, 0), Radius=1)
unit_x = UnitX(Factor=integer_2)
unit_z = UnitZ(Factor=integer)
number_slider = Slider(2, range=0..2)
move = Move(Geometry=sphere, Motion=unit_x)  # -> Geometry, Transform
move_2 = Move(Geometry=sphere, Motion=unit_z)  # -> Geometry, Transform
list_length = ListLength(List=move.Geometry)
number_slider_2 = Slider(1, range=0..1)
list_length_2 = ListLength(List=move_2.Geometry)
range = Range(Domain=number_slider, Steps=expr("x-1", list_length))
range_2 = Range(Domain=number_slider, Steps=expr("x-1", list_length_2))
vector_xyz = VectorXYZ(XComponent=0, YComponent=0, ZComponent=number_slider_2)  # -> Vector, Length
vector_xyz_2 = VectorXYZ(XComponent=number_slider_2, YComponent=0, ZComponent=0)  # -> Vector, Length
pi = Pi(Factor=range)
pi_2 = Pi(Factor=range_2)
rotate_3d = Rotate3D(Geometry=move.Geometry, Angle=pi, Center=Point(0, 0, 0), Axis=vector_xyz.Vector)  # -> Geometry, Transform
rotate_3d_2 = Rotate3D(Geometry=move_2.Geometry, Angle=pi_2, Center=Point(0, 0, 0), Axis=vector_xyz_2.Vector)  # -> Geometry, Transform
merge = Merge(Data1=rotate_3d.Geometry, Data2=rotate_3d_2.Geometry)
solid_union = SolidUnion(Breps=merge)  # disabled
