# Grasshopper definition 3-pint parabola problems.gh (Grasshopper 1.0.7)
# plug-ins: The Dominion

pt = Point([Point(-3.038394255, 6.223061028, 0), Point(1.142018347, 5.589207854, 0), Point(-2.253623658, 1.72572184, 0)])
xy = XYPlane(Origin=Point(0, 0, 0))
pi = Pi(Factor=Slider(0, range=0..2))
item = ListItem(List=pt, Index=0, Wrap=True)  # -> Item, Item1, Item2
prot = RotatePlane(Plane=xy, Angle=pi)
deplane = DeconstructPlane(Plane=prot)  # -> Origin, XAxis, YAxis, ZAxis
vecplnangle = AngleInPlane(Plane=PlaneXY(0, 0, 0), Vector=deplane.XAxis)
solveparab3 = _3PointParabolaSolver(Plane=prot, P1=item.Item, P2=item.Item1, P3=item.Item2)
conrparab = ConstructRotatedParabola(A=1, B=0, C=0, Rotation=pi, Domain=Domain(-5, 5))  # disabled
standconic = StandardiseConic(Conic=solveparab3)
deparab = DeconstructParabola(Parabola=solveparab3)  # -> ConicSection, ControlPoints, Focus1, BasePlane, VertexPlane, Domain, Roots, Direction, ConicFormatted
orient = Orient(Geometry=pt, Source=deparab.BasePlane, Target=PlaneXY(0, 0, 0))  # -> Geometry, Transform
deconic = DeconstructConic(Conic=solveparab3)  # -> ConicSection, Focus1, Focus2, BasePlane, A, B, C, D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; disabled
deconic_2 = DeconstructConic(Conic=standconic)  # -> ConicSection, Focus1, Focus2, BasePlane, A, B, C, D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
panel = Panel([deparab.ConicFormatted, deparab.Direction, deconic_2.ConicFormatted_2])
orient_2 = Orient(Geometry=pt, Source=PlaneXY(0, 0, 0), Target=PlaneXY(0, 0, 0))  # -> Geometry, Transform
panel_2 = Panel(deparab.VertexPlane)
data = Data([deparab.BasePlane, deparab.VertexPlane])
