# Grasshopper definition 5_point_anim.gh (Grasshopper 1.0.7)
# plug-ins: The Dominion

pt = Point([Point(53.29306624, 8.102501908, 0), Point(15.68974411, -12.1954649, 0), Point(28.04728814, -42.91284675, 0), Point(72.43269428, 2.985354493, 0)])
pt_2 = Point([Point(-64.58568052, 170.0835323, 0), Point(125.302597, -90.28900192, 0), Point(11.92385988, -29.21148024, 0), Point(30.12572635, 15.5219204, 0), Point(-22.01182336, 4.724203005, 0)])
nurbs = NurbsCurve(Vertices=pt, Degree=3, Periodic=invert(False))  # -> Curve, Length, Domain
series = Series(Start=0, Step=1, Count=10)
item = ListItem(List=pt_2, Index=0, Wrap=True)  # -> Item, Item1, Item2, Item3, Item4
offset_l = OffsetCurveLoose(Curve=nurbs.Curve, Distance=series)
crv = Curve(<curve referenced from the Rhino model>)
solveconic5 = _5PointConicSolver(P1=item.Item, P2=item.Item1, P3=item.Item2, P4=item.Item3, P5=item.Item4)  # -> graft(Conic)
cp = ControlPoints(Curve=offset_l)  # -> Points, Weights, Knots
divide = DivideCurve(Curve=crv, Count=Slider(9, range=0..32), Kinks=False)  # -> Points, Tangents, Parameters
series_2 = Series(Start=0, Step=1, Count=10)
rec = DataRecorder(solveconic5, DataLimit=-10, RecordData=True)
item_2 = ListItem(List=cp.Points, Index=0, Wrap=True)  # -> flatten(Item), flatten(Item1), flatten(Item2), flatten(Item3), Item4
pt_3 = ConstructPoint(XCoordinate=0, YCoordinate=series_2, ZCoordinate=0)
solveconic5_2 = _5PointConicSolver(P1=item_2.Item, P2=item_2.Item1, P3=item_2.Item2, P4=item_2.Item3, P5=divide.Points)
