# Grasshopper definition animated_logo2.gh (Grasshopper 1.0.7)
# plug-ins: The Dominion

number_slider = Slider(1, range=0..1)
timer = Timer(TimerInterval=20, Target=c_script)  # disabled
c_script = CSharpScript(reset=Button())  # -> out, A; inputs reset: Boolean
# ---------- c_script: C# ----------
    if (reset)
    {
      x = -1;
    }

    A = x++;
# ---------- c_script: C# additional code ----------
  int x;
# ---------- end c_script ----------
number_slider_2 = Slider(0.25, range=0..1)
expression = Expression(x=c_script.A, y=Slider(44.32, range=0..100), Expression="if(x/y<1, x/y, 1)")
range = Range(Domain=Domain(0, 1), Steps=Slider(4, range=0..10))
graph = GraphMapper(
    range,
    x0=0,
    x1=1,
    y0=0,
    y1=1,
    container_name="Bezier",
    cpx=[0, 0.1968622655, 0.3771377802, 1],
    cpy=[0.1577655077, 0.3743407726, 0.5277413726, 0.5464143753])
graph_2 = GraphMapper(
    expression,
    x0=0,
    x1=1,
    y0=-1,
    y1=1,
    container_name="Bezier",
    cpx=[0, 0.9804205298, 0.4861536324, 1],
    cpy=[0.5001817942, 0.5496330857, 0.04527878761, 0.499866426])
graph_3 = GraphMapper(
    expression,
    x0=0,
    x1=1,
    y0=0,
    y1=1,
    container_name="Bezier",
    cpx=[0, 0.4926505685, 0.4712155163, 1],
    cpy=[0.5024106503, 0.2366161346, 0.9439724684, 0.529204607])
graph_4 = GraphMapper(
    expression,
    x0=0,
    x1=1,
    y0=0,
    y1=1,
    container_name="Bezier",
    cpx=[0, 0.6432081461, 1, 1],
    cpy=[0, 0.3032419086, 0.1376729608, 1])
graph_5 = GraphMapper(expression, x0=0, x1=1, y0=0, y1=1, container_name="Bezier", cpx=[0, 0, 1, 1], cpy=[1, 0, 0, 0.2692618966])
expression_2 = Expression(x=graph_3, Expression="2*x")
larger = LargerThan(FirstNumber=expression, SecondNumber=0)  # -> LargerThan, OrEqualTo
expression_3 = Expression(x=graph_2, y=Slider(1.987, range=0..16), Expression="2*pi*x*y")
xy = XYPlane(Origin=Point(0, 0, 0))
panel = Panel(expression_2)
int = Integer(larger.LargerThan)
prot = RotatePlane(Plane=xy, Angle=expression_3)
weave = Weave(Pattern=int, Stream0=expression, Stream1=graph, NullGaps=False)
panel_2 = Panel(expression_3)
multiplication = Multiplication(A=graph_4, B=weave)
domlogo = DominionLogo(Plane=prot, Ratio=expression_2, Thickness=graph_5, Borders=multiplication)  # -> Logo, Borders
boundary = BoundarySurfaces(Edges=domlogo.Logo)
loft = Loft(Curves=domlogo.Borders, Options={Adjust=False, Closed=False, LoftEnds=0, LoftSimp=0, LoftType=0, Rebuild=10, Refit=0.01})
merge = Merge(Data1=boundary, Data2=loft)
preview = CustomPreview(Geometry=merge, Material=ColourSwatch(SwatchColor=RGB(18, 18, 18)))
