# Grasshopper definition animated_logo_test.gh (Grasshopper 1.0.7)
# plug-ins: The Dominion

domlogo = DominionLogo(Ratio=Slider(1.273, range=0..2), Thickness=Slider(0.841, range=0..2))
explode = Explode(Curve=domlogo, Recursive=True)  # -> Segments, Vertices
points = PointList(Points=explode.Vertices, Size=Slider(0.1, range=0.1..1))
