# Grasshopper definition conic_animation.gh (Grasshopper 1.0.7)
# plug-ins: The Dominion

pt = Point([Point(-104.1187899, -75.00497693, 0), Point(73.43944932, 128.9046618, 0), Point(70.92979223, -83.16136248, 0), Point(-102.8639614, 123.8853476, 0), Point(6.951613143, 151.6307471, 0)])
number_slider = Slider(-0.759, range=-1..1)  # disabled
number_slider_2 = Slider(-1, range=-1..1)  # disabled
item = ListItem(List=pt, Index=0, Wrap=True)  # -> Item, Item1, Item2, Item3, Item4
conhyperb = ConstructHyperbola(Plane=PlaneXY(0, 0, 0), A=1, B=1, H=10, Flip=False)  # disabled
solveconic5 = _5PointConicSolver(P1=item.Item, P2=item.Item1, P3=item.Item2, P4=item.Item3, P5=item.Item4)
deconic = DeconstructConic(Conic=solveconic5)  # -> ConicSection, Focus1, Focus2, BasePlane, A, B, C, D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
pi = Pi(Factor=1)
pt_2 = ConstructPoint(XCoordinate=0, YCoordinate=0, ZCoordinate=0)  # disabled
Y = UnitY(Factor=1)  # disabled
csolve = ConicSolver(A=1, B=0, C=number_slider, D=0, E=-1, F=number_slider_2)  # disabled
dom = ConstructDomain(DomainStart=0, DomainEnd=pi)
deplane = DeconstructPlane(Plane=deconic.BasePlane)  # -> Origin, XAxis, YAxis, ZAxis
line = LineSDL(Start=pt_2, Direction=Y, Length=1)  # disabled
crv = Curve(csolve)  # disabled
line_2 = LineSDL(Start=deplane.Origin, Direction=deplane.YAxis, Length=1)
revsrf = Revolution(Curve=crv, Axis=line, Domain=Domain(0, 6.283185307))  # disabled
revsrf_2 = Revolution(Curve=deconic.ConicSection, Axis=line_2, Domain=dom)
