# Grasshopper definition dominion_sample_001.gh (Grasshopper 1.0.7)
# plug-ins: The Dominion

pt = Point([Point(33.5133444, 26.91055225, 0), Point(47.59016575, 9.667120213, 0), Point(28.8690556, -1.61683659, 0), Point(22.65005668, 14.34739775, 0)])
pt_2 = Point([Point(-1.136011349, 30.50397226, 0), Point(7.13461608, 33.51730164, 0), Point(14.18708908, 29.79872496, 0), Point(7.006389298, 21.7845511, 0), Point(0.338596642, 21.0793038, 0)])
pt_3 = Point([Point(-11.42221248, 13.92969797, 0), Point(-18.32914809, 8.944240695, 0), Point(-8.462097226, 5.412875123, 0)])
item = ListItem(List=pt_2, Index=0, Wrap=True)  # -> Item, Item1, Item2, Item3, Item4
item_2 = ListItem(List=pt_3, Index=0, Wrap=True)  # -> Item, Item1, Item2
pt_4 = ConstructPoint(XCoordinate=Slider(2.336, range=0..10), YCoordinate=Slider(0, range=0..10), ZCoordinate=0)
pt_5 = ConstructPoint(XCoordinate=Slider(8.426, range=0..10), YCoordinate=Slider(8.021, range=0..10), ZCoordinate=0)
pi = Pi(Factor=Slider(0.5, range=-2..2))
pi_2 = Pi(Factor=Slider(0, range=-2..2))
item_3 = ListItem(List=pt, Index=0, Wrap=True)  # -> Item, Item1, Item2, Item3
pi_3 = Pi(Factor=Slider(0.5, range=-2..2))
xy = XYPlane(Origin=pt_5)
xy_2 = XYPlane(Origin=Point(0, 0, 0))
xy_3 = XYPlane(Origin=Point(0, 0, 0))
expression = Expression(x=Slider(0.575, range=0..1), Expression="{cos(2*pi*x), sin(2*pi*x),0}")
prot = RotatePlane(Plane=xy_2, Angle=pi)
prot_2 = RotatePlane(Plane=xy_3, Angle=pi_2)
cir = Circle(Plane=pt_4, Radius=Slider(0.539, range=0..1))
cir_2 = Circle(Plane=xy, Radius=Slider(1.936, range=0..5))
# The Dominion Angle Component defines angle between -Pi To Pi, so full rotation is calculated
X = UnitX(Factor=1)
solveparab4 = _4PointParabolaSolver(P1=item_3.Item, P2=item_3.Item1, P3=item_3.Item2, P4=item_3.Item3)  # -> Parabola1, Parabola2
conhyperb = ConstructHyperbola(Plane=prot_2, A=Slider(0.5, range=0..1), B=Slider(1, range=0..1), H=10, Flip=Toggle(True))
inntang = InnerTangents(Circle1=cir, Circle2=cir_2)  # -> Tangent1, Tangent2
outtang = OuterTangents(Circle1=cir, Circle2=cir_2)  # -> Tangent1, Tangent2
conrparab = ConstructRotatedParabola(A=1, B=0, C=0, Rotation=pi_3, Domain=Domain(-5, 5))
solveconic5 = _5PointConicSolver(P1=item.Item, P2=item.Item1, P3=item.Item2, P4=item.Item3, P5=item.Item4)
solveparab3 = _3PointParabolaSolver(Plane=prot, P1=item_2.Item, P2=item_2.Item1, P3=item_2.Item2)
vecang = SignedVectorAngle(Plane=PlaneXY(0, 0, 0), Vector1=X, Vector2=expression)
conparabq = ConstructQuadraticParabola(Plane=PlaneXY(0, 0, 0), A=Slider(0.25, range=0..1), B=Slider(-2, range=-5..5), C=0, Domain=Domain(-10, 10))
# Regular Angle Component only defines angle in the positive domain (0 To Pi)
angle = Angle(VectorA=X, VectorB=expression)  # -> Angle, Reflex
merge = Merge(Data1=vecang, Data2=angle.Angle)
panel = Panel(merge)
