# Grasshopper definition dominion_sample_002.gh (Grasshopper 1.0.7)
# plug-ins: The Dominion

number_slider = Slider(10, range=0..10)
number_slider_2 = Slider(1, range=0..2)
number_slider_3 = Slider(1, range=0..5)
neg = Negative(Value=number_slider_2)
neg_2 = Negative(Value=number_slider_3)
pt = ConstructPoint(XCoordinate=0, YCoordinate=0, ZCoordinate=0)
Y = UnitY(Factor=1)
dom = ConstructDomain(DomainStart=Slider(0, range=0..5), DomainEnd=Slider(4.258, range=0..10))
dom_2 = ConstructDomain(DomainStart="pi/2", DomainEnd="3*pi/2")
dom_3 = ConstructDomain(DomainStart=neg_2, DomainEnd=number_slider_3)
conhyperb = ConstructHyperbola(Plane=PlaneXY(0, 0, 0), A=1, B=1, H=10, Flip=False)
csolve = ConicSolver(
    A=1,
    B=Slider(0.74, range=-1..1),
    C=Slider(0.166, range=0..1),
    D=Slider(1, range=0..1),
    E=Slider(1, range=0..1),
    F=Slider(1, range=0..1))
conhyperb_2 = ConstructHyperbola(Plane=PlaneXY(0, 0, 0), A=Slider(1, range=0..1), B=1, H=number_slider, Flip=False)
conparab = ConstructParabola(A=1, Domain=dom)
line = LineSDL(Start=pt, Direction=Y, Length=1)
conparabq = ConstructQuadraticParabola(Plane=PlaneXY(0, 0, 0), A=neg, B=0, C=number_slider_2, Domain=dom_3)
dehyperb = DeconstructHyperbola(Hyperbola=conhyperb)  # -> HyperbolaSection, ControlPoints, AxisA, AxisB, Focus1, Focus2, BasePlane, Apex
deconic = DeconstructConic(Conic=csolve)  # -> ConicSection, Focus1, Focus2, BasePlane, A, B, C, D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
dehyperb_2 = DeconstructHyperbola(Hyperbola=conhyperb_2)  # -> HyperbolaSection, ControlPoints, AxisA, AxisB, Focus1, Focus2, BasePlane, Apex
deparab = DeconstructParabola(Parabola=conparabq)  # -> ParabolaSection, ControlPoints, AxisA, AxisB, Focus, BasePlane, VertexPlane, Domain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
crv = Curve(conparabq)
deplane = DeconstructPlane(Plane=deconic.BasePlane)  # -> Origin, XAxis, YAxis, ZAxis
dom_4 = ConstructDomain(DomainStart=0, DomainEnd=Slider(0.5, range=0..1))
end = EndPoints(Curve=dehyperb_2.HyperbolaSection)  # -> Start, End
line_2 = LineSDL(Start=deplane.Origin, Direction=deplane.YAxis, Length=1)
item = ListItem(List=dehyperb_2.HyperbolaSection, Index=0, Wrap=True)  # -> Item, Item1
item_2 = ListItem(List=end.Start, Index=0, Wrap=True)  # -> Item, Item1
item_3 = ListItem(List=deparab.Roots, Index=0, Wrap=True)  # -> Item, Item1
subcrv = SubCurve(BaseCurve=deconic.ConicSection, Domain=dom_2)
neg_3 = Negative(Value=number_slider)
deplane_2 = DeconstructPlane(Plane=dehyperb.BasePlane)  # -> Origin, XAxis, YAxis, ZAxis
subcrv_2 = SubCurve(BaseCurve=dehyperb.HyperbolaSection, Domain=dom_4)
dist = Distance(PointA=item_2.Item, PointB=item_2.Item1)
dist_2 = Distance(PointA=item_3.Item, PointB=item_3.Item1)
Y_2 = UnitY(Factor=neg_3)
line_3 = LineSDL(Start=deplane_2.Origin, Direction=deplane_2.XAxis, Length=1)
# paraboloid
revsrf = Revolution(Curve=conparab, Axis=line, Domain=Domain(0, 6.283185307))
# hyperboloids
revsrf_2 = Revolution(Curve=conhyperb, Axis=line, Domain=Domain(0, 6.283185307))
revsrf_3 = Revolution(Curve=subcrv_2, Axis=line_3, Domain=Domain(0, 6.283185307))
# ellipsoid
revsrf_4 = Revolution(Curve=subcrv, Axis=line_2, Domain=Domain(0, 6.283185307))
division = Division(A=dist, B=dist_2)
scale = Scale(Center=Point(0, 0, 0), Factor=division)  # -> Geometry, Transform
orient = Orient(Source=PlaneXY(0, 0, 0), Target=Y_2)  # -> Geometry, Transform
xz = XZPlane(Origin=Point(0, 0, 0))
merge = Merge(Data1=flatten(scale.Transform), Data2=flatten(orient.Transform))
orient_2 = Orient(Geometry=crv, Source=PlaneXY(0, 0, 0), Target=xz)  # -> Geometry, Transform
comp = Compound(Transforms=merge)
transform = Transform(Geometry=orient_2.Geometry, Transform=comp)
# hyperbolic paraboloid
swp2 = Sweep2(Rail1=item.Item, Rail2=item.Item1, Sections=transform, SameHeight=False)
