# Grasshopper definition double_hyperb.gh (Grasshopper 1.0.7)
# plug-ins: The Dominion

pt = Point([Point(-11.73328234, -54.59616617, 0), Point(6.603547713, 6.971732516, 0), Point(24.58727612, -54.13641227, 0), Point(47.77360881, -16.8265834, 0), Point(-27.6414962, -16.67815969, 0)])
item = ListItem(List=pt, Index=0, Wrap=True)  # -> Item, Item1, Item2, Item3, Item4
solveconic5 = _5PointConicSolver(P1=item.Item, P2=item.Item1, P3=item.Item2, P4=item.Item3, P5=item.Item4)
panel = Panel("""{Origin=2.79945596881611,9.25667140541875,0 
XAxis=-0.999987434867789,0.00501299377002426,0, 
YAxis=0,0,1, 
ZAxis=0.00501299377002426,0.999987434867789,0}""")
conhyperb = ConstructHyperbola(Plane=PlaneXY(0, 0, 0), A=1, B=1, H=10, Flip=False)  # disabled
deconic = DeconstructConic(Conic=solveconic5)  # -> ConicSection, Focus1, Focus2, BasePlane, A, B, C, D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
pln = Plane(deconic.BasePlane)
deplane = DeconstructPlane(Plane=pln)  # -> Origin, XAxis, YAxis, ZAxis
pl = ConstructPlane(Origin=deplane.Origin, XAxis=deplane.YAxis, YAxis=deplane.ZAxis)
mirror = Mirror(Geometry=deconic.ConicSection, Plane=pl)  # -> Geometry, Transform
panel_2 = Panel(pl)
