# Grasshopper definition logo_idea.gh (Grasshopper 1.0.7)
# plug-ins: The Dominion

number_slider = Slider(1, range=0..1)
number_slider_2 = Slider(0, range=0..1)
dom = ConstructDomain(DomainStart=Slider(-1, range=-10..1), DomainEnd=Slider(0, range=-1..1))
dom_2 = ConstructDomain(DomainStart=Slider(0.826, range=0..10), DomainEnd=Slider(2.525, range=0..10))
dom_3 = ConstructDomain(DomainStart=0, DomainEnd=Slider(0.42, range=0..1))
range = Range(Domain=dom_3, Steps=10)
range_2 = Range(Domain=dom_2, Steps=10)
range_3 = Range(Domain=dom, Steps=10)
range_4 = Range(Domain=Domain(0, 1), Steps=10)
panel = Panel(range_4)
csolve = ConicSolver(A=range_4, B=0, C=range_3, D=0, E=number_slider_2, F=number_slider)
csolve_2 = ConicSolver(A=range, B=0, C=range_2, D=0, E=number_slider_2, F=number_slider)
panel_2 = Panel(range_3)
