# Grasshopper definition parabola_test.gh (Grasshopper 1.0.7)
# plug-ins: The Dominion

pi = Pi(Factor=Slider(0.5, range=0..1))
dom = ConstructDomain(DomainStart=Slider(-1, range=-1..1), DomainEnd=1)
conparab = ConstructParabola(A=1, Domain=dom)
number_slider = Slider(2, range=0..10)
number_slider_2 = Slider(1, range=0..1)
evalconic = EvaluateConicAt(Conic=conparab, YPostion=number_slider)  # -> PointsX, PointsY
conrparab = ConstructRotatedParabola(A=1, B=0, C=0, Rotation=pi, Domain=dom)
pline = PolyLine(Vertices=evalconic.PointsY, Closed=False)
range = Range(Domain=number_slider, Steps=10)
cp = ControlPoints(Curve=conrparab)  # -> Points, Weights, Knots
deconic = DeconstructConic(Conic=conrparab)  # -> ConicSection, Focus1, Focus2, BasePlane, A, B, C, D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
neg = Negative(Value=number_slider)
panel = Panel(deconic.ConicFormatted)
evalconic_2 = EvaluateConicAt(Conic=conrparab, XPostion=neg)  # -> PointsX, PointsY
panel_2 = Panel(cp.Points)
panel_3 = Panel(evalconic_2.PointsX)
