# Grasshopper definition testing parabolas.gh (Grasshopper 1.0.7)
# plug-ins: The Dominion

pi = Pi(Factor=Slider(0.25, range=0..1))
xy = XYPlane(Origin=Point(0, 0, 0))
prot = RotatePlane(Plane=xy, Angle=pi)
conparabq = ConstructQuadraticParabola(Plane=prot, A=1, B=0, C=0, Domain=Domain(-10, 10))
deparab = DeconstructParabola(Conic=conparabq)  # -> ConicSection, Focus1, Focus2, BasePlane, A, B, C, D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
csolve = ConicSolver(A=deparab.A, B=deparab.B, C=deparab.C, D=deparab.D, E=deparab.E, F=deparab.F)
deparab_2 = DeconstructParabola(Conic=csolve)  # -> ConicSection, Focus1, Focus2, BasePlane, A, B, C, D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
panel = Panel(deparab_2.ConicFormatted)
csolve_2 = ConicSolver(A=deparab_2.A, B=deparab_2.B, C=deparab_2.C, D=0, E=0, F=deparab_2.F)
pt = Point(deparab_2.Roots)
evalconic = EvaluateConicAt(Conic=csolve_2, YPostion=Slider(1, range=-1..1))  # -> PointsX, PointsY
