# Grasshopper definition the_dominion_logo.gh (Grasshopper 1.0.7)

number_slider = Slider(0.314, range=0..1)
number_slider_2 = Slider(1, range=0..1)
number_slider_3 = Slider(0.5, range=0..1)
expression = Expression(x=number_slider, Expression="x/2")
number_slider_4 = Slider(6.084, range=0..100)
multiplication = Multiplication(A=expression, B=number_slider_2)
multiplication_2 = Multiplication(A=number_slider, B=number_slider_2)
multiplication_3 = Multiplication(A=number_slider_4, B=multiplication_2)
subtraction = Subtraction(A=number_slider_3, B=multiplication)
addition = Addition(A=number_slider_3, B=multiplication)
multiplication_4 = Multiplication(A=number_slider_4, B=Slider(1.25, range=0..2))
subtraction_2 = Subtraction(A=number_slider_4, B=multiplication_3)
merge = Merge(Data1=subtraction, Data2=addition)
expression_2 = Expression(x=number_slider_4, Expression="x*sin(π/6)")
multiplication_5 = Multiplication(A=multiplication_4, B=Slider(1, range=0..1))
expression_3 = Expression(x=number_slider_4, Expression="x*sin(π/6)")
expression_4 = Expression(x=subtraction_2, Expression="x*sin(π/6)")
expression_5 = Expression(x=number_slider_4, Expression="x*sin(π/6)")
multiplication_6 = Multiplication(A=number_slider_4, B=merge)
merge_2 = Merge(Data1="0", Data2=multiplication_4)
expression_6 = Expression(x=expression_2, y=multiplication_4, Expression="2*x+y")
expression_7 = Expression(x=multiplication_6, Expression="x*sin(π/6)")
multiplication_7 = Multiplication(A=multiplication_4, B=number_slider)
addition_2 = Addition(A=multiplication_5, B=expression_2)
neg = Negative(Value=number_slider_4)
neg_2 = Negative(Value=multiplication_6)
expression_8 = Expression(x=expression_5, y=multiplication_4, Expression="2*x+y")
addition_3 = Addition(A=multiplication_7, B=expression_4)
subtraction_3 = Subtraction(A=expression_6, B=expression_4, C=multiplication_7)
subtraction_4 = Subtraction(A=expression_6, B=expression_3, C=multiplication_7)
addition_4 = Addition(A=multiplication_7, B=expression_3)
merge_3 = Merge(Data1=addition_2, Data2=expression_6)
addition_5 = Addition(A=expression_5, B=merge_2)
rev = ReverseList(List=expression_7)
subtraction_5 = Subtraction(A=addition_2, B=multiplication_7)
merge_4 = Merge(Data1=neg, Data2="0")
neg_3 = Negative(Value=number_slider_4)
subtraction_6 = Subtraction(A=merge_3, B=multiplication_7)
merge_5 = Merge(Data1=subtraction_3, Data2=addition_3)
merge_6 = Merge(Data1=subtraction_4, Data2=addition_4)
addition_6 = Addition(A=subtraction_5, B=rev)
pt = ConstructPoint(XCoordinate=0, YCoordinate=merge_2, ZCoordinate=0)
pt_2 = ConstructPoint(XCoordinate=neg_3, YCoordinate=addition_5, ZCoordinate=0)
pt_3 = ConstructPoint(XCoordinate=number_slider_4, YCoordinate=addition_5, ZCoordinate=0)
pt_4 = ConstructPoint(XCoordinate=0, YCoordinate=expression_8, ZCoordinate=0)
expression_9 = Expression(x=expression_6, Expression="x/2")
pt_5 = ConstructPoint(XCoordinate=subtraction_2, YCoordinate=merge_5, ZCoordinate=0)
pt_6 = ConstructPoint(XCoordinate=number_slider_4, YCoordinate=merge_6, ZCoordinate=0)
pt_7 = ConstructPoint(XCoordinate=merge_4, YCoordinate=merge_3, ZCoordinate=0)
pt_8 = ConstructPoint(XCoordinate=neg_2, YCoordinate=addition_6, ZCoordinate=0)
pt_9 = ConstructPoint(XCoordinate=merge_4, YCoordinate=subtraction_6, ZCoordinate=0)
pt_10 = ConstructPoint(XCoordinate=neg_2, YCoordinate=expression_7, ZCoordinate=0)
rev_2 = ReverseList(List=pt_2)
item = ListItem(List=pt, Index=0, Wrap=True)
rev_3 = ReverseList(List=pt_6)
pt_11 = ConstructPoint(XCoordinate=0, YCoordinate=expression_9, ZCoordinate=0)
rev_4 = ReverseList(List=pt_8)
rev_5 = ReverseList(List=pt_9)
pline = PolyLine(Vertices=pt_3, Closed=False)
pline_2 = PolyLine(Vertices=pt, Closed=False)
pline_3 = PolyLine(Vertices=pt_2, Closed=False)
merge_7 = Merge(Data1=pt_5, Data2=rev_3)
merge_8 = Merge(Data1=rev_2, Data2=item, Data3=pt_3, Data4=pt_4)
merge_9 = Merge(Data1=pt_7, Data2=rev_5)
number_slider_5 = Slider(0.867, range=0..2)
merge_10 = Merge(Data1=pt_10, Data2=rev_4)
xz = XZPlane(Origin=pt_11)
merge_11 = Merge(Data1=pline_2, Data2=pline)
merge_12 = Merge(Data1=pline_3, Data2=pline_2)
pline_4 = PolyLine(Vertices=merge_9, Closed=invert(False))
pline_5 = PolyLine(Vertices=merge_8, Closed=invert(False))
loft = Loft(Curves=merge_11, Options={Adjust=False, Closed=False, LoftEnds=0, LoftSimp=0, LoftType=0, Rebuild=10, Refit=0.01})
loft_2 = Loft(Curves=merge_12, Options={Adjust=False, Closed=False, LoftEnds=0, LoftSimp=0, LoftType=0, Rebuild=10, Refit=0.01})
merge_13 = Merge(Data1=number_slider_5, Data2=Slider(1.657, range=0..2), Data3=number_slider_5, Data4=Slider(0.345, range=0..2))
mirror = Mirror(Geometry=pline_4, Plane=PlaneYZ(0, 0, 0))  # -> Geometry, Transform
number_slider_6 = Slider(0.321, range=0..1)
ma = MassAddition(Input=merge_13)  # -> Result, PartialResults
pline_6 = PolyLine(Vertices=merge_7, Closed=invert(False))
number_slider_7 = Slider(0.5, range=0..1)
pline_7 = PolyLine(Vertices=merge_10, Closed=invert(False))
mirror_2 = Mirror(Geometry=mirror.Geometry, Plane=xz)  # -> Geometry, Transform
expression_10 = Expression(x=number_slider_6, Expression="x/2")
merge_14 = Merge(Data1=pline_4, Data2=pline_7, Data3=mirror.Geometry, Data4=mirror_2.Geometry, Data5=pline_6)
expression_11 = Expression(x=number_slider_6, Expression="1-x")
addition_7 = Addition(A=number_slider_7, B=expression_10)
subtraction_7 = Subtraction(A=number_slider_7, B=expression_10)
dom²num = ConstructDomain²(UMin=subtraction_7, UMax=addition_7, VMin=0, VMax=expression_11)
dom²num_2 = ConstructDomain²(UMin=0, UMax=1, VMin=expression_11, VMax=1)
dom²num_3 = ConstructDomain²(UMin=0, UMax=1, VMin=expression_11, VMax=1)
dom²num_4 = ConstructDomain²(UMin=0, UMax=1, VMin=0, VMax=number_slider_6)
dom²num_5 = ConstructDomain²(UMin=expression_11, UMax=1, VMin=number_slider_6, VMax=expression_11)
runion = RegionUnion(Curves=merge_14)
merge_15 = Merge(Data1=dom²num_2, Data2=dom²num)
merge_16 = Merge(Data1=dom²num_3, Data2=dom²num_4, Data3=dom²num_5)
subsrf = Isotrim(Surface=reparameterize(loft_2), Domain=merge_15)
subsrf_2 = Isotrim(Surface=reparameterize(loft), Domain=merge_16)
srf = Surface(runion)
debrep = DeconstructBrep(Brep=subsrf)  # -> Faces, Edges, Vertices
debrep_2 = DeconstructBrep(Brep=subsrf_2)  # -> Faces, Edges, Vertices
join = JoinCurves(Curves=debrep.Edges, Preserve=False)  # -> flatten(Curves)
join_2 = JoinCurves(Curves=debrep_2.Edges, Preserve=False)  # -> flatten(Curves)
merge_17 = Merge(Data1=join, Data2=join_2)
offset = OffsetCurve(Curve=pline_5, Distance=ma.PartialResults, Plane=PlaneXY(0, 0, 0), Corners=1)  # -> flatten(Curve)
runion_2 = RegionUnion(Curves=merge_17)
path_mapper = PathMapper(offset, source="{A}(i)", target="{floor(i/2)}")
loft_3 = Loft(Curves=path_mapper, Options={Adjust=False, Closed=False, LoftEnds=0, LoftSimp=0, LoftType=0, Rebuild=10, Refit=0.01})  # -> flatten(Loft)
boundary = BoundarySurfaces(Edges=runion_2)
merge_18 = Merge(Data1=flatten(loft_3), Data2=flatten(srf))
merge_19 = Merge(Data1=flatten(loft_3))
material = CreateMaterial(
    Diffuse=ColourSwatch(SwatchColor=RGB(0, 0, 0)),
    Specular=RGB(255, 255, 255),
    Emission=RGB(0, 0, 0),
    Transparency=0,
    Shine=0)
preview = CustomPreview(Geometry=merge_18, Material=material)
preview_2 = CustomPreview(Geometry=merge_19, Material=material)
