# Grasshopper definition 5 point test.gh (Grasshopper 1.0.7)
# plug-ins: The Dominion

pt = Point([Point(10.41791899, -7.943057161, 0), Point(-44.04913011, -20.61152972, 0), Point(55.00426563, 2.55964861, 0), Point(18.12989024, -45.03301551, 0), Point(44.99046384, 35.74824358, 0)])
number_slider = Slider(1, range=0..1)
item = ListItem(List=pt, Index=0, Wrap=True)  # -> Item, Item1, Item2, Item3, Item4
neg = Negative(Value=Slider(1, range=0..1))
csolve = ConicSolver(A=number_slider, B=0, C=number_slider, D=0, E=Slider(0, range=0..1), F=neg)
solveconic5 = _5PointConicSolver(P1=item.Item, P2=item.Item1, P3=item.Item2, P4=item.Item3, P5=item.Item4)
standconic = StandardiseConic(Conic=solveconic5)
deconic = DeconstructConic(Conic=solveconic5)  # -> ConicSection, Focus1, Focus2, BasePlane, A, B, C, D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
deconic_2 = DeconstructConic(Conic=standconic)  # -> ConicSection, Focus1, Focus2, BasePlane, A, B, C, D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
orient = Orient(Geometry=pt, Source=deconic.BasePlane, Target=PlaneXY(0, 0, 0))  # -> Geometry, Transform
neg_2 = Negative(Value=deconic_2.A)
neg_3 = Negative(Value=deconic_2.C)
panel = Panel(deconic_2.ConicFormatted)
csolve_2 = ConicSolver(A=deconic.A, B=deconic.B, C=deconic.C, D=deconic.D, E=deconic.E, F=deconic.F)
csolve_3 = ConicSolver(A=neg_2, B=deconic_2.B, C=neg_3, D=deconic_2.D, E=deconic_2.E, F=deconic_2.F)
xz = XZPlane(Origin=Point(0, 0, 0))
transform = Transform()
mirror = Mirror(Geometry=csolve_3, Plane=xz)  # -> Geometry, Transform
