# Grasshopper definition conic_rotation_testing.gh (Grasshopper 1.0.7)
# plug-ins: The Dominion

panel = Panel("""0.16
0.2""")
pt = Point([Point(97.67859179, 35.22100872, 0), Point(170.8986581, 54.14092249, 0), Point(157.8505387, -14.50729894, 0), Point(154.2111478, 49.04176902, 0), Point(96.16499869, -0.5376282952, 0)])
item = ListItem(List=pt, Index=0, Wrap=True)  # -> Item, Item1, Item2, Item3, Item4
csolv = ConicSolver(A=Slider(-0.338, range=-1..1), B=0, C=Slider(0.157, range=-1..1), D=0, E=0, F="1")
item_2 = ListItem(List=panel, Index=Toggle(False), Wrap=True)
csolv5 = _5PointConicSolver(P1=item.Item, P2=item.Item1, P3=item.Item2, P4=item.Item3, P5=item.Item4)
planesrf = PlaneSurface(Plane=PlaneXY(0, 0, 0), XSize=Domain(-10, 10), YSize=Domain(-10, 10))
pi = Pi(Factor=Slider(0.235, range=0..1))
number_slider = Slider(0.183, range=0.182..0.183)
rotate = Rotate(Geometry=csolv5, Angle=pi, Plane=PlaneXY(0, 0, 0))  # -> Geometry, Transform
rotate_2 = Rotate(Angle=pi, Plane=PlaneXY(0, 0, 0))  # -> Geometry, Transform
sconic = StandardiseConic(Conic=rotate.Geometry)
panel_2 = Panel("1")
dconic = DeconstructConic(Conic=rotate.Geometry)  # -> ConicSection, Focus1, Focus2, BasePlane, A, B, C, D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
dconic_2 = DeconstructConic(Conic=sconic)  # -> ConicSection, Focus1, Focus2, BasePlane, A, B, C, D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
csolv_2 = ConicSolver(A=dconic_2.A, B=dconic_2.B, C=dconic_2.C, D=0, E=0, F=dconic_2.F)
panel_3 = Panel(dconic.ConicFormatted)
csolv_3 = ConicSolver(A=dconic.A, B=dconic.B, C=dconic.C, D=dconic.D, E=dconic.E, F=dconic.F)
panel_4 = Panel(dconic_2.ConicFormatted)
