# Grasshopper definition dual.gh (Grasshopper 1.0.7)

pt = Point([Point(6.391588737, 4.296332421, 0), Point(-6.371180938, 2.302731902, 0)])
item = ListItem(List=pt, Index=0, Wrap=True)  # -> Item, Item1
pline = PolyLine(Vertices=pt, Closed=False)
vec2pt = Vector2Pt(PointA=item.Item, PointB=item.Item1, Unitize=invert(False))  # -> Vector, Length
dprod = DotProduct(VectorA=item.Item, VectorB=vec2pt.Vector, Unitize=False)
vec = Vector(item.Item)
expression = Expression(d=dprod, v=vec2pt.Vector, p1=item.Item, Expression="(d*v -p1)/((p1•p1)-d*d)")
cir = Circle(Plane=PlaneXY(0, 0, 0), Radius=1)
