# Grasshopper definition hyperbola testing.gh (Grasshopper 1.0.7)
# plug-ins: The Dominion

crv = Curve(<curve referenced from the Rhino model>)
dom = ConstructDomain(DomainStart=0, DomainEnd=Slider(1, range=0..1))
crvdom = CurveDomain(Curve=crv)  # -> Curve, Domain
subcrv = SubCurve(BaseCurve=crv, Domain=dom)
cp = ControlPoints(Curve=subcrv)  # -> Points, Weights, Knots
contype = ConicType(Curve=crv)
panel = Panel(contype)
panel_2 = Panel(cp.Points)
panel_3 = Panel(cp.Weights)
