# Grasshopper definition parab_hyperb.gh (Grasshopper 1.0.7)
# plug-ins: The Dominion

pt = Point(Point(-5.206258854, -4.382372772, 0))
range = Range(Domain="-2*Pi To 2*Pi", Steps=Slider(256, range=0..256))
number_slider = Slider(1, range=0..1)
pi = Pi(Factor=Slider(0, range=0..1))
xy = XYPlane(Origin=pt)
pi_2 = Pi(Factor=Slider(0.508, range=0..1))
prot = RotatePlane(Plane=xy, Angle=pi_2)
cot = CoTangent(Value=pi_2)
entwine = Entwine(FlattenInputs=True)
conhyperb = ConstructHyperbola(Plane=prot, A=1, B=number_slider, H=10, Flip=False)
number_slider_2 = Slider(8, range=0..100)
neg = Negative(Value=number_slider)
panel = Panel(cot)
csolve = ConicSolver(A=1, B=0, C=neg, D=0, E=Slider(0, range=0..1), F=Slider(1, range=0..1))  # disabled
conparabq = ConstructQuadraticParabola(Plane=prot, A=1, B=0, C=0, Domain=Domain(-10, 10))
pt_2 = ConstructPoint(XCoordinate=range, YCoordinate=entwine, ZCoordinate=0)
range_2 = Range(Domain=number_slider_2, Steps=number_slider_2)
graph = QuickGraph(entwine, SortOrder=0)
deparab = DeconstructParabola(Parabola=conparabq)  # -> ParabolaSection, ControlPoints, AxisA, AxisB, Focus, BasePlane, VertexPlane, Domain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
standconic = StandardiseConic(Conic=conparabq)  # disabled
neg_2 = Negative(Value=number_slider_2)
intcrv = Interpolate(Vertices=pt_2, Degree=3, Periodic=False, KnotStyle=1)  # -> flatten(Curve), Length, Domain
crv = Curve(conparabq)
evalconic = EvaluateConicAt(Conic=conparabq, XPostion=neg_2, YPostion=Slider(2, range=0..10))  # -> PointsX, PointsY
deconic = DeconstructConic(Conic=conhyperb)  # -> ConicSection, Focus1, Focus2, BasePlane, A, B, C, D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
cp = ControlPoints(Curve=crv)  # -> Points, Weights, Knots
item = ListItem(List=intcrv.Curve, Index=Slider(2, range=0..2), Wrap=True)
panel_2 = Panel(evalconic.PointsY)
panel_3 = Panel(deconic.ConicFormatted)
