# Grasshopper definition parabola_focus.gh (Grasshopper 1.0.7)
# plug-ins: The-Dominion

number_slider = Slider(3, range=0..10)
pt = Point([Point(10.21583792, -0.06881589844, 0), Point(19.02205469, 10.61945652, 0), Point(18.33266518, 3.366356563, 0), Point(8.180032122, 1.310278355, 0), Point(-4.223298052, 10.90655439, 0)])
xy = XYPlane(Origin=Point(0, 0, 0))
pt_2 = Point([Point(-54.54728084, -14.39149542, 0), Point(-31.12475329, 11.02471422, 0), Point(-40.96473505, -10.18082786, 0), Point(-67.50980212, -2.324098237, 0)])
pi = Pi(Factor=Slider(1.406, range=0..2))
item = ListItem(List=pt, Index=0, Wrap=True)  # -> Item, Item1, Item2, Item3, Item4
prot = RotatePlane(Plane=xy, Angle=pi)
addition = Addition(A=number_slider, B="sqrt(10)")
subtraction = Subtraction(A=number_slider, B="sqrt(10)")
solveconic4 = _4PointConicSolver(Plane=prot, Points=pt_2)
solveconic5 = _5PointConicSolver(P1=item.Item, P2=item.Item1, P3=item.Item2, P4=item.Item3, P5=item.Item4)
expression = Expression(
    x=Slider(7, range=0..10),
    y=Slider(3, range=0..10),
    a=Slider(4, range=0..10),
    b=Slider(2, range=0..10),
    k=[subtraction, addition],
    Expression="1/(2*(b-k))*(x-a)²+(b+k)/2")
orient = Orient(Geometry=solveconic4, Source=PlaneXY(0, 0, 0), Target=prot)  # -> Geometry, Transform
panel = Panel(expression)
