# Grasshopper definition parabola_rotation_test.gh (Grasshopper 1.0.7)
# plug-ins: The Dominion

pi = Pi(Factor=Slider(0.5, range=0..2))
dom = ConstructDomain(DomainStart="-1", DomainEnd=1)
conrparab = ConstructRotatedParabola(A=1, B=0, C=0, Rotation=pi, Domain=dom)
deconic = DeconstructConic(Conic=conrparab)  # -> ConicSection, Focus1, Focus2, BasePlane, A, B, C, D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
cp = ControlPoints(Curve=conrparab)  # -> Points, Weights, Knots
panel = Panel(cp.Points)
panel_2 = Panel(deconic.ConicFormatted)
